# Grasshopper definition TerminalAutomation_Updated_WebApp.ghx (Grasshopper 1.0.8)
# plug-ins: Pufferfish, Human, Wombat, AirportPlanning

# ---- group: Domestic Profile
checked_bag = Slider(30, range=10..100)
# Passenger Profiles
online_check_in = Slider(30, range=10..100)
male = Slider(70, range=10..100)
peak_arrival_time_before_flight_min = Panel("90")

# ---- group: International Profile
checked_bag_2 = Slider(30, range=10..100)
online_check_in_2 = Slider(30, range=10..100)
peak_arrival_time_before_flight_min_2 = Panel("120")
male_2 = Slider(70, range=10..100)

# ---- group: Spatial Inputs
boundary_dimensions_x = Slider(261, range=50..350)
boundary_dimensionsy = Slider(40, range=10..100)
# Facility Specific Inputs
no_of_entry_gates = Slider(4, range=2..30)

# ---- group: Planning Inputs
p_domestic = Slider(60, range=0..100)
p_departing = Slider(70, range=20..100)
p_using_checkin = Slider(80, range=20..80)
level_of_service = ValueList({"A", "B", "C", "D", "E", "F"}, selected="C")
avg_processing_min = Panel("2.5")
toggle = BooleanToggle(False)

# ----
# Planning Inputs
annual_pax_million = Slider(30, range=1..50)

# ---- group: Spatial Inputs / E-Gates
offset_from_check_in = Slider(2, range=2..10)

# ---- group: Spatial Inputs / Immigration Counters
offset_from_e_gates = Slider(2, range=2..10)

# ---- group: Spatial Inputs / Check In
config_b_max_counters_in_line = Panel("15")
list = ValueList({"Config A:Perpendicular to Movement", "Config B:Parallel to Movement"}, selected="Config B:Parallel to Movement")
config_a_max_counters_in_line = Panel("40")

# ----
check_in_counters = Slider(140, range=60..150)

domestic_passenger_profile_peak_arrival = GetString(peak_arrival_time_before_flight_min, AtLeast=1, AtMost=1, TreeAccess=False)  # "{Domestic Passenger Profile} Peak Arrival Time Before Flight (min)"
domestic_passenger_profile_checked_bag = GetInteger(checked_bag, AtLeast=1, AtMost=1, Maximum=100, Minimum=10, TreeAccess=False)
domestic_passenger_profile_online_check = GetInteger(online_check_in, AtLeast=1, AtMost=1, Maximum=100, Minimum=10, TreeAccess=False)  # "{Domestic Passenger Profile} Online Check In (%)"
domestic_passenger_profile_male = GetInteger(male, AtLeast=1, AtMost=1, Maximum=100, Minimum=10, TreeAccess=False)
division = Division(A=domestic_passenger_profile_checked_bag, B="100")
division_2 = Division(A=domestic_passenger_profile_online_check, B="100")
division_3 = Division(A=domestic_passenger_profile_male, B="100")

# ---- group: Spatial Inputs
spatial_inputs_no_of_entry_gates = GetInteger(no_of_entry_gates, AtLeast=1, AtMost=1, Maximum=30, Minimum=2, TreeAccess=False)
spatial_inputs_boundary_dimensions_x = GetInteger(boundary_dimensions_x, AtLeast=1, AtMost=1, Maximum=350, Minimum=50, TreeAccess=False)
spatial_inputs_boundary_dimensions_y = GetInteger(boundary_dimensionsy, AtLeast=1, AtMost=1, Maximum=100, Minimum=10, TreeAccess=False)

# ----
spatial_inputs_immigration_offset_from_e = GetInteger(offset_from_e_gates, AtLeast=1, AtMost=1, Maximum=100, Minimum=10, TreeAccess=False)  # "{Spatial Inputs}Immigration Offset from E-Gates (m)"

international_passenger_profile_peak_arr = GetString(peak_arrival_time_before_flight_min_2, AtLeast=1, AtMost=1, TreeAccess=False)  # "{International Passenger Profile} Peak Arrival Time Before Flight (min)"
international_passenger_profile_checked = GetInteger(checked_bag_2, AtLeast=1, AtMost=1, Maximum=100, Minimum=10, TreeAccess=False)  # "{International Passenger Profile} Checked Bag (%)"
international_passenger_profile_online_c = GetInteger(online_check_in_2, AtLeast=1, AtMost=1, Maximum=100, Minimum=10, TreeAccess=False)  # "{International Passenger Profile} Online Check In (%)"
international_passenger_profile_male = GetInteger(male_2, AtLeast=1, AtMost=1, Maximum=100, Minimum=10, TreeAccess=False)
division_4 = Division(A=international_passenger_profile_checked, B="100")
division_5 = Division(A=international_passenger_profile_male, B="100")
division_6 = Division(A=international_passenger_profile_online_c, B="100")

# ---- group: Spatial Inputs
spatial_inputs_orientation_of_check_in_c = GetString(
    list,
    {"Config A:Perpendicular to Movement", "Config B:Parallel to Movement"}, selected=[],
    AtLeast=1,
    AtMost=1,
    Prompt="Select Configuration for the Check In counters",
    TreeAccess=False)  # "{Spatial Inputs} Orientation of Check In Counters"
spatial_inputs_max_counters_in_a_row = GetInteger(config_a_max_counters_in_line, AtLeast=1, AtMost=1, Maximum=50, Minimum=15, TreeAccess=False)
spatial_inputs_max_counters_in_a_columns = GetInteger(config_b_max_counters_in_line, AtLeast=1, AtMost=1, Maximum=50, Minimum=5, TreeAccess=False)

# ----
spatial_inputs_offset_from_check_in_m = GetInteger(offset_from_check_in, AtLeast=1, AtMost=1, Maximum=100, Minimum=10, TreeAccess=False)

# ---- group: Planning Inputs / IATA Inputs
planning_inputs_total_check_in_counters = GetInteger(check_in_counters, AtLeast=1, AtMost=1, Maximum=150, Minimum=60, TreeAccess=False)
total_check_in_counters_optimise_boolean = GetBoolean(
    toggle,
    AtLeast=1,
    AtMost=1,
    FalseValue="Optimize Manually",
    TreeAccess=False,
    TrueValue="Optimize Counters Automatically")
planning_inputs_avg_process_time_min_for = GetString(avg_processing_min, AtLeast=1, AtMost=1, TreeAccess=False)  # "{Planning Inputs} Avg.Process time (min) for Check-In"

# ---- group: Planning Inputs
planning_inputs_passengers_using_check_i = GetInteger(p_using_checkin, AtLeast=1, AtMost=1, Maximum=80, Minimum=20, TreeAccess=False)  # "{Planning Inputs} Passengers Using Check-In (%)"
planning_inputs_annual_pax_million = GetInteger(annual_pax_million, AtLeast=1, AtMost=1, Maximum=50, Minimum=1, TreeAccess=False)
planning_inputs_passenger_departing = GetInteger(p_departing, AtLeast=1, AtMost=1, Maximum=100, Minimum=10, TreeAccess=False)
planning_inputs_level_of_service = GetString(level_of_service, {"A", "B", "C", "D", "E", "F"}, selected=[], AtLeast=1, AtMost=1, TreeAccess=False)

# ----
planning_inputs_domestic_passenger = GetInteger(p_domestic, AtLeast=1, AtMost=1, Maximum=100, Minimum=10, TreeAccess=False)
panel = Panel("""Config A:Perpendicular to Movement
Config B:Parallel to Movement""")
index = ItemIndex(List=panel, Item=panel)
everything_except_check_in_area_m2 = Panel("""1.4
1.2
1.0
0.8
0.6
0.5""")
panel_2 = Panel("""A
B
C
D
E
F""")
wait_ciculatearea_m2 = Panel("""10
12
20
25
30
1000""")
wait_ciculatearea_m2_2 = Panel("""2.7
2.3
1.9
1.5
1.0
1.0""")
check_in_area_m2 = Panel("""1.6
1.4
1.2
1.0
0.8
0.5""")
num = Number(planning_inputs_avg_process_time_min_for)
index_2 = ItemIndex(List=wait_ciculatearea_m2, Item=wait_ciculatearea_m2)
list_2 = ValueList({"Domestic": 0, "International": 1}, selected="Domestic")
list_3 = ValueList({"Origin": 0, "Transfer": 1, "Destination": 2}, selected="Origin")
list_4 = ValueList({"Domestic": 0, "International": 1}, selected="International")
list_5 = ValueList({"Origin": 0, "Transfer": 1, "Destination": 2}, selected="Origin")
ap = ArrivalProfile(Peak=domestic_passenger_profile_peak_arrival, Sigma="1.5")
ap_2 = ArrivalProfile(Peak=international_passenger_profile_peak_arr, Sigma="2.5")
random_seed = Panel("5")
wp = WalkingProfile(AverageSpeed="1.35", StandardDeviation="1")
division_7 = Division(A=planning_inputs_domestic_passenger, B="100")
pp = PassengerProfile(
    Name="Domestic Economy",
    Percentage=Slider(100, range=0..100),
    PassengerType=list_2,
    Journey=list_3,
    OnlineCheckInProbability=division_2,
    CheckedBagProbability=division,
    ServiceTimeMultiplier=1,
    MaleProbability=division_3,
    ArrivalProfile=ap)
pp_2 = PassengerProfile(
    Name="International Leisure",
    Percentage=Slider(100, range=0..100),
    PassengerType=list_4,
    Journey=list_5,
    OnlineCheckInProbability=division_6,
    CheckedBagProbability=division_4,
    ServiceTimeMultiplier=1,
    MaleProbability=division_5,
    ArrivalProfile=ap_2)
avg_processing_min_2 = Panel("2.5")
min_passenger = Panel("1.5")
target_wait_min = Panel("20")
staffing = Slider(100, range=0..100)
optimize_counters = BooleanToggle(True)
sp = ServiceProfile(MeanServiceTime=avg_processing_min_2, StandardDeviation=min_passenger)
avg_processing_min_3 = Panel("1.5")
min_passenger_2 = Panel("0.5")
tmatch = MatchText(Text=planning_inputs_level_of_service, Pattern=panel_2, Case=True)
sp_2 = ServiceProfile(MeanServiceTime=avg_processing_min_3, StandardDeviation=min_passenger_2)
index_3 = ItemIndex(List=panel_2, Item=panel_2)
dispatch = Dispatch(List=index_3, DispatchPattern=tmatch)  # -> ListA, ListB
item = ListItem(List=panel_2, Index=dispatch.ListA, Wrap=True)
item_2 = ListItem(List=everything_except_check_in_area_m2, Index=dispatch.ListA, Wrap=True)
item_3 = ListItem(List=check_in_area_m2, Index=dispatch.ListA, Wrap=True)
item_4 = ListItem(List=wait_ciculatearea_m2_2, Index=dispatch.ListA, Wrap=True)
item_5 = ListItem(List=wait_ciculatearea_m2, Index=dispatch.ListA, Wrap=True)
optimize_counters_2 = BooleanToggle(True)
target_wait_min_2 = Panel("10")
staffing_2 = Slider(100, range=0..100)
xy = XYPlane(Origin="0,0,0")
from_facility = ValueList({"CheckIn", "BagDrop", "Immigration", "Security"}, selected="CheckIn")
from_facility_2 = ValueList({"CheckIn", "BagDrop", "Immigration", "Security"}, selected="BagDrop")
eligible = Slider(100, range=0..100)

dom = ConstructDomain(DomainStart=0, DomainEnd=spatial_inputs_boundary_dimensions_x)
dom_2 = ConstructDomain(DomainStart=0, DomainEnd=spatial_inputs_boundary_dimensions_y)
rectangle = Rectangle(Plane=xy, XSize=dom, YSize=dom_2, Radius=0)  # -> Rectangle, Length
disc = Discontinuity(Curve=rectangle.Rectangle, Level=1)  # -> Points, Parameters
shatter = Shatter(Curve=rectangle.Rectangle, Parameters=disc.Parameters)
item_6 = ListItem(List=shatter, Index=0, Wrap=True)  # -> Item2, Item1, Item
offset = OffsetCurve(Curve=rectangle.Rectangle, Distance=expr("-x/2", "0.4"), Corners=1)
range = Range(Domain=Domain(0, 1), Steps=expr("x*2", spatial_inputs_no_of_entry_gates))
crv = Curve(item_6.Item2)
boundary = BoundarySurfaces(Edges=flatten([offset, rectangle.Rectangle]))
dispatch_2 = Dispatch(List=range, DispatchPattern=[True, False])  # -> ListA, ListB
eval = EvaluateCurve(Curve=reparameterize(crv), Parameter=dispatch_2.ListB)  # -> Point, Tangent, Angle

e_gate = Mesh(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)
brec = BoundingRectangle(Geometry=e_gate, Plane=PlaneXY(0, 0, 0), Axis=0, Slide=0, Union=True)  # -> Bounding, DimensionX, DimensionY
tmatch_2 = MatchText(Text=spatial_inputs_orientation_of_check_in_c, Pattern=panel, Case=True)
debrep = DeconstructBrep(Brep=brec.Bounding)  # -> Faces, Edges, Vertices
item_7 = ListItem(List=debrep.Vertices, Index=0, Wrap=True)
dispatch_3 = Dispatch(List=index, DispatchPattern=tmatch_2)  # -> ListA, ListB
from_facility_3 = ValueList({"CheckIn", "BagDrop", "Immigration", "Security"}, selected="BagDrop")
from_facility_4 = ValueList({"CheckIn", "BagDrop", "Immigration", "Security"}, selected="Immigration")
filter = StreamFilter(Gate=dispatch_3.ListA, Stream0=spatial_inputs_max_counters_in_a_row, Stream1=spatial_inputs_max_counters_in_a_columns)
min_passenger_3 = Panel("0.2")
avg_processing_min_4 = Panel("0.4")
target_wait_min_3 = Panel("10")
sp_3 = ServiceProfile(MeanServiceTime=avg_processing_min_4, StandardDeviation=min_passenger_3)
c_bake = ContextBake(BoundaryInput_48_83_227_100=boundary)
emigration_counter = Mesh([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])
avg_processing_min_5 = Panel("0.25")
min_passenger_4 = Panel("0.1")
target_wait_min_4 = Panel("10")

panel_3 = Panel("Block 01")
panel_4 = Panel("Block 02")

brec_2 = BoundingRectangle(Geometry=emigration_counter, Plane=PlaneXY(0, 0, 0), Axis=0, Slide=0, Union=True)  # -> Bounding, DimensionX, DimensionY
mirror = Mirror(Geometry=emigration_counter, Plane=PlaneYZ(0, 0, 0))  # -> Geometry, Transform
sort_pt = SortPoints(Points=eval.Point)  # -> Points, Indices

dom_3 = ConstructDomain(DomainStart=expr("-x", "0"), DomainEnd="6")
dom_4 = ConstructDomain(DomainStart=expr("-x", "6"), DomainEnd="6")
X = UnitX(Factor=1)
rectangle_2 = Rectangle(Plane=sort_pt.Points, XSize=dom_4, YSize=dom_3, Radius=0)  # -> Rectangle, Length
area = Area(Geometry=rectangle_2.Rectangle)  # -> Area, Centroid
X_2 = UnitX(Factor=expr("-x", "6"))
srf = Surface(rectangle_2.Rectangle)
move = Move(Geometry=area.Centroid, Motion=X_2)  # -> Geometry, Transform
line = LineSDL(Start=move.Geometry, Direction=X, Length=expr("x*2", "6"))

mesh = Mesh(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)
sp_4 = ServiceProfile(MeanServiceTime=avg_processing_min_5, StandardDeviation=min_passenger_4)
mesh_2 = Mesh(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)
addition = Addition(A="0", B="1.2")
multiplication = Multiplication(A=brec_2.DimensionX, B="1.05")
geo = Geometry([emigration_counter, mirror.Geometry])
index_4 = ItemIndex(List=sort_pt.Points, Item=sort_pt.Points)
_2checkin_module = Curve(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)
addition_2 = Addition(A=index_4, B="1")
concat = Concatenate(FragmentA="Gate ", FragmentB=addition_2)
multiplication_2 = Multiplication(A="10", B="2")
brec_3 = BoundingRectangle(Geometry=rectangle.Rectangle, Plane=PlaneXY(0, 0, 0), Axis=0, Slide=0, Union=True)  # -> Bounding, DimensionX, DimensionY
multiplication_3 = Multiplication(A="20", B="2")

expression = Expression(x=planning_inputs_annual_pax_million, Expression="0.002*(1/x^(1/2))")
multiplication_4 = Multiplication(A=planning_inputs_annual_pax_million, B="1000000")
multiplication_5 = Multiplication(A=expression, B=multiplication_4)
roundf = RoundToFactor(NumberX=multiplication_5, Factor="200", RoundType=0)  # -> Rounded, Difference, MultiplierR, MultiplierX
dhp = Integer(roundf.Rounded)

pd = PassengerDemand(
    DesignHourDemand=dhp,
    DeparturePercentage=planning_inputs_passenger_departing,
    DomesticPercentage=planning_inputs_domestic_passenger)
pg = PassengerGenerator(
    PassengerDemand=pd,
    DomesticProfiles=pp,
    InternationalProfiles=pp_2,
    DepartureMinute="800",
    SimulationHorizon="300",
    WalkingProfile=wp,
    RandomSeed=random_seed)  # -> Passengers, PassengerGenerationResult, ArrivalSimulations
pdt = PassengerDetails(Passengers=pg.Passengers)  # -> PassengerID, ArrivalTime, ServiceTime, StartService, EndService, WaitingTime, AssignedCounter, WalkingSpeed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
chk = CheckIn(
    Passengers=pg.Passengers,
    ServiceProfile=sp,
    CheckInCounters="8",
    OptimizeCounters=optimize_counters,
    TargetWait=target_wait_min,
    StaffingPercentage=staffing,
    RandomSeed=random_seed)  # -> Passengers, CheckInPassengers, QueueResults, CountersUsed, PeakQueueLength, AverageWait, MaximumWait, _95thPercentileWait, CounterUtilization

list_6 = ValueList({"Island", "Linear", "Flow-Through"}, selected="Flow-Through")
list_7 = ValueList({"CheckIn": 0, "BagDrop": 1, "Security": 2, "Immigration": 3}, selected="CheckIn")
division_8 = Division(B="2")
tpl = FacilityTemplate(FacilityType=list_7, TopologyOverride=list_6)  # -> Template, AvailableTopologies
std = FacilityStandards(
    FacilityType=list_7,
    QueueAreaPax=Slider(1.3, range=1.3..1.8),
    ProcessorWidth=division_8,
    ProcessorDepth=2,
    ProcessorPitch=division_8,
    Circulation=25,
    Support=10)
size = FacilitySizer(OperationalResults=chk.QueueResults, Passengers=chk.Passengers, Standards=std, Template=tpl.Template)  # -> SizingResult, TotalArea, QueueArea, ProcessingArea, CirculationArea, Topology, Advice, EquipmentNames, EquipmentCounts
panel_5 = Panel(size.QueueArea)

panel_6 = Panel(pdt.ArrivalTime)
qs = QueueStatistics(QueueResults=chk.QueueResults)  # -> AverageWait, MaximumWait, _95thPercentileWait, PeakQueueLength, ResourceUtilization
filter_2 = PassengerFilter(Passengers=chk.Passengers)  # -> Domestic, International, Male, Female, CheckedBags, CabinBagOnly
bd = BagDrop(
    Passengers=chk.Passengers,
    ServiceProfile=sp_2,
    BagDropCounters=8,
    OptimizeCounters=optimize_counters_2,
    TargetWait=target_wait_min_2,
    StaffingPercentage=staffing_2,
    RandomSeed=random_seed)  # -> Passengers, QueueResults, PhysicalCounters

list_8 = ValueList({"CheckIn": 0, "BagDrop": 1, "Security": 2, "Immigration": 3, "Verification": 4}, selected="BagDrop")
list_9 = ValueList({"Island", "Linear", "Retrofit"}, selected="Linear")
division_9 = Division(B="2")
tpl_2 = FacilityTemplate(FacilityType=list_8, TopologyOverride=list_9)  # -> Template, AvailableTopologies
std_2 = FacilityStandards(
    FacilityType=list_8,
    QueueAreaPax=Slider(1.3, range=1.3..1.8),
    ProcessorWidth=division_9,
    ProcessorDepth=2,
    ProcessorPitch=division_9,
    Circulation=25,
    Support=10)
size_2 = FacilitySizer(OperationalResults=bd.QueueResults, Passengers=bd.Passengers, Standards=std_2, Template=tpl_2.Template)  # -> SizingResult, TotalArea, QueueArea, ProcessingArea, CirculationArea, Topology, Advice, EquipmentNames, EquipmentCounts
panel_7 = Panel(size_2.TotalArea)

wlk = Walking(Passengers=bd.Passengers, Distance="50", WalkingSpeed=wp, FromFacility=from_facility, ToFacility=from_facility_2)
ver = PassengerVerification(Passengers=wlk, EligiblePercentage=eligible, ThroughputPerGate=300, DesignUtilization=0.85)  # -> Passengers, VerificationResults, RequiredGates, EligiblePassengers
wlk_2 = Walking(Passengers=ver.Passengers, Distance="50", WalkingSpeed=wp, FromFacility=from_facility_3, ToFacility=from_facility_4)

# ---- group: Passenger Verification
list_10 = ValueList({"CheckIn": 0, "BagDrop": 1, "Security": 2, "Immigration": 3, "Verification": 4}, selected="Verification")
list_11 = ValueList({"Island", "Linear", "Flow-Through"}, selected="Flow-Through")
tpl_3 = FacilityTemplate(FacilityType=list_10)  # -> Template, AvailableTopologies
std_3 = FacilityStandards(
    FacilityType=list_10,
    QueueAreaPax=item_2,
    ProcessorWidth=brec.DimensionX,
    ProcessorDepth=brec.DimensionY,
    ProcessorPitch=brec.DimensionX,
    Circulation=25,
    Support=10)
panel_8 = Panel(tpl_3.AvailableTopologies)
size_3 = FacilitySizer(OperationalResults=ver.VerificationResults, Passengers=ver.Passengers, Standards=std_3, Template=tpl_3.Template)  # -> SizingResult, TotalArea, QueueArea, ProcessingArea, CirculationArea, Topology, Advice, EquipmentNames, EquipmentCounts

# ----
filter_3 = PassengerFilter(Passengers=wlk_2)  # -> Domestic, International, Male, Female, CheckedBags, CabinBagOnly
imm = Immigration(
    Passengers=filter_3.International,
    ServiceProfile=sp_3,
    ImmigrationBooths=8,
    OptimizeBooths=Toggle(True),
    TargetWait=target_wait_min_3,
    StaffingPercentage=Slider(100, range=0..100),
    RandomSeed=random_seed)  # -> Passengers, QueueResults, PhysicalBooths
merge = Merge(Data1=flatten(filter_3.Domestic), Data2=flatten(imm.Passengers))
pdt_2 = PassengerDetails(Passengers=imm.Passengers)  # -> PassengerID, ArrivalTime, ServiceTime, StartService, EndService, WaitingTime, AssignedCounter, WalkingSpeed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
panel_9 = Panel(pdt_2.ArrivalTime)
sec = Security(
    Passengers=merge,
    ServiceProfile=sp_4,
    SecurityLanes=8,
    OptimizeLanes=Toggle(True),
    TargetWait=target_wait_min_4,
    StaffingPercentage=Slider(80, range=0..100),
    RandomSeed=random_seed)  # -> Passengers, QueueResults, PhysicalLanes

number_slider = Slider(1.2, range=0.2..1.2)
list_12 = ValueList({"CheckIn": 0, "BagDrop": 1, "Security": 2, "Immigration": 3, "Verification": 4}, selected="Immigration")
list_13 = ValueList({"Linear": "Linear ", "Staggered", "E-Gate Bank"}, selected="Staggered")
tpl_4 = FacilityTemplate(FacilityType=list_12, TopologyOverride=list_13)  # -> Template, AvailableTopologies
std_4 = FacilityStandards(
    FacilityType=list_12,
    QueueAreaPax=item_2,
    ProcessorWidth=multiplication,
    ProcessorDepth=brec_2.DimensionY,
    ProcessorPitch=brec_2.DimensionX,
    Circulation=25,
    Support=10)
size_4 = FacilitySizer(OperationalResults=imm.QueueResults, Passengers=imm.Passengers, Standards=std_4, Template=tpl_4.Template)  # -> SizingResult, TotalArea, QueueArea, ProcessingArea, CirculationArea, Topology, Advice, EquipmentNames, EquipmentCounts

pdt_3 = PassengerDetails(Passengers=sec.Passengers)  # -> PassengerID, ArrivalTime, ServiceTime, StartService, EndService, WaitingTime, AssignedCounter, WalkingSpeed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
qs_2 = QueueStatistics(QueueResults=sec.QueueResults)  # -> AverageWait, MaximumWait, _95thPercentileWait, PeakQueueLength, ResourceUtilization
pdt_4 = PassengerDetails(Passengers=sec.Passengers)  # -> PassengerID, ArrivalTime, ServiceTime, StartService, EndService, simplify(WaitingTime), AssignedCounter, WalkingSpeed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
subtraction = Subtraction(A=brec_3.DimensionX, B=multiplication_3)
subtraction_2 = Subtraction(A=brec_3.DimensionY, B=multiplication_2)
area_2 = Area(Geometry=brec_3.Bounding)  # -> Area, Centroid
x_ray_machine = Mesh(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)
wtmd_machine = Mesh(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)
X_3 = UnitX(Factor="1.2")
division_10 = Division(A=subtraction, B=brec_3.DimensionX)
division_11 = Division(A=subtraction_2, B=brec_3.DimensionY)
Z = UnitZ(Factor="0.1")
brec_4 = BoundingRectangle(Geometry=wtmd_machine, Plane=PlaneXY(0, 0, 0), Axis=0, Slide=0, Union=True)  # -> Bounding, DimensionX, DimensionY
brec_5 = BoundingRectangle(Geometry=x_ray_machine, Plane=PlaneXY(0, 0, 0), Axis=0, Slide=0, Union=True)  # -> Bounding, DimensionX, DimensionY
panel_10 = Panel(pdt_3.EndService)
scale_nu = ScaleNU(Geometry=brec_3.Bounding, Plane=area_2.Centroid, ScaleX=division_10, ScaleY=division_11, ScaleZ=1)  # -> Geometry, Transform
panel_11 = Panel(pdt_4.WaitingTime)
Y = UnitY(Factor=expr("-x", spatial_inputs_offset_from_check_in_m))
dim = Dimensions(Surface=scale_nu.Geometry)  # -> UDimension, VDimension
addition_3 = Addition(A=brec_4.DimensionX, B=Slider(0.75, range=0..1))
explode = Explode(Curve=scale_nu.Geometry, Recursive=True)  # -> Segments, Vertices
drec = DeconstructRectangle(Rectangle=scale_nu.Geometry)  # -> BasePlane, XInterval, YInterval
multiplication_6 = Multiplication(A=multiplication, B="2")
multiplication_7 = Multiplication(A=addition_3, B="2.2")
addition_4 = Addition(A=brec_5.DimensionX, B=multiplication_7)
X_4 = UnitX(Factor=multiplication_6)
item_8 = ListItem(List=explode.Segments, Index=0, Wrap=True)  # -> Item, Item1, Item2
arrlinear = LinearArray(Geometry=geo, Direction=X_4, Count=expr("x/2", imm.PhysicalBooths))  # -> Geometry, Transform

number_slider_2 = Slider(1.2, range=0.2..1.2)
list_14 = ValueList({"CheckIn": 0, "BagDrop": 1, "Security": 2, "Immigration": 3, "Verification": 4}, selected="Security")
list_15 = ValueList({"Centralized", "Decentralized"}, selected="Centralized")
tpl_5 = FacilityTemplate(FacilityType=list_14, TopologyOverride=list_15)  # -> Template, AvailableTopologies
std_5 = FacilityStandards(
    FacilityType=list_14,
    QueueAreaPax=item_2,
    ProcessorWidth=addition_4,
    ProcessorDepth=brec_5.DimensionY,
    ProcessorPitch=multiplication_7,
    Circulation="10",
    Support=10)
size_5 = FacilitySizer(OperationalResults=sec.QueueResults, Passengers=sec.Passengers, Standards=std_5, Template=tpl_5.Template)  # -> SizingResult, TotalArea, QueueArea, ProcessingArea, CirculationArea, Topology, simplify(Advice), flatten(EquipmentNames), flatten(EquipmentCounts)
filter_4 = PassengerFilter(Passengers=sec.Passengers)  # -> Domestic, International, Male, Female, CheckedBags, CabinBagOnly

brec_6 = BoundingRectangle(Geometry=flatten(arrlinear.Geometry), Plane=PlaneXY(0, 0, 0), Axis=0, Slide=0, Union=True)  # -> Bounding, DimensionX, DimensionY
area_3 = Area(Geometry=brec_6.Bounding)  # -> Area, Centroid

queuearea = Number(size_5.QueueArea)
processingarea = Number(size_5.ProcessingArea)
circulationarea = Number(size_5.CirculationArea)
item_9 = ListItem(List=size_5.EquipmentNames, Index=0, Wrap=True)  # -> Item, Item1, Item2
item_10 = ListItem(List=size_5.EquipmentCounts, Index=0, Wrap=True)  # -> Item, Item1, Item2
panel_12 = Panel(item_9.Item)
panel_13 = Panel(item_9.Item1)
panel_14 = Panel(item_9.Item2)
division_12 = Division(A=item_10.Item, B=item_10.Item2)
division_13 = Division(A=item_10.Item, B=item_10.Item1)
round = Round(Number=division_13)  # -> Nearest, Floor, Ceiling
round_2 = Round(Number=division_12)  # -> Nearest, Floor, Ceiling
addition_5 = Addition(A=round.Ceiling, B=round_2.Ceiling)
series = Series(Start=0, Step=addition_3, Count=addition_5)
X_5 = UnitX(Factor=series)
move_2 = Move(Geometry=wtmd_machine, Motion=X_5)  # -> simplify(Geometry), Transform
merge_2 = Merge(Data1=simplify(x_ray_machine), Data2=simplify(move_2.Geometry))
brec_7 = BoundingRectangle(Geometry=flatten(merge_2), Plane=PlaneXY(0, 0, 0), Axis=0, Slide=0, Union=True)  # -> Bounding, flatten(DimensionX), DimensionY
multiplication_8 = Multiplication(A=queuearea, B=division_7)
multiplication_9 = Multiplication(A=circulationarea, B=division_7)
multiplication_10 = Multiplication(A=processingarea, B=division_7)
multiplication_11 = Multiplication(A=item_10.Item, B=division_7)
addition_6 = Addition(A=brec_7.DimensionX, B="0")  # -> simplify(Result)
group = Group(Geometry=flatten(merge_2))
area_4 = Area(Geometry=brec_7.Bounding)  # -> Area, Centroid
subtraction_3 = Subtraction(A=item_10.Item, B=multiplication_11)
subtraction_4 = Subtraction(A=queuearea, B=multiplication_8)
subtraction_5 = Subtraction(A=circulationarea, B=multiplication_9)
subtraction_6 = Subtraction(A=processingarea, B=multiplication_10)
cluster = Cluster(N=addition_6, C=subtraction_3, relay=group, O=area_4.Centroid, A=subtraction_4, A_2=subtraction_5)  # -> geo_2, R, V
cluster_2 = Cluster(N=addition_6, C=multiplication_11, relay=group, O=area_4.Centroid, A=multiplication_8, A_2=multiplication_9)  # -> geo_2, R, V
move_3 = Move(Geometry=cluster_2.R, Motion=cluster_2.V)  # -> Geometry, Transform
move_4 = Move(Geometry=cluster.R, Motion=cluster.V)  # -> Geometry, Transform
geo_2 = Geometry(cluster_2.geo_2)
geo_3 = Geometry(cluster.geo_2)
brec_8 = BoundingRectangle(Geometry=move_3.Geometry, Plane=PlaneXY(0, 0, 0), Axis=0, Slide=0, Union=True)  # -> Bounding, DimensionX, DimensionY
X_6 = UnitX(Factor=brec_8.DimensionX)
move_5 = Move(Geometry=move_4.Geometry, Motion=X_6)  # -> Geometry, Transform
move_6 = Move(Geometry=geo_3, Motion=X_6)  # -> Geometry, Transform

num_2 = Number("100")
filter_5 = PassengerFilter(Passengers=filter_4.Domestic)  # -> Domestic, International, Male, Female, CheckedBags, CabinBagOnly
Y_2 = UnitY(Factor=1)
brec_9 = BoundingRectangle(Geometry=flatten([move_3.Geometry, geo_2]), Plane=PlaneXY(0, 0, 0), Axis=0, Slide=0, Union=True)  # -> Bounding, DimensionX, DimensionY
explode_2 = Explode(Curve=brec_9.Bounding, Recursive=True)  # -> Segments, Vertices
item_11 = ListItem(List=explode_2.Segments, Index=0, Wrap=True)  # -> Item2, Item1, Item
merge_3 = Merge(Data1=move_5.Geometry, Data2=move_6.Geometry)
brec_10 = BoundingRectangle(Geometry=[move_5.Geometry, move_6.Geometry], Plane=PlaneXY(0, 0, 0), Axis=0, Slide=0, Union=True)  # -> Bounding, DimensionX, DimensionY
merge_4 = Merge(Data1=move_3.Geometry, Data2=geo_2)
curvepoint = PointOnCurve(item_11.Item2, parameter=0.5)
pdecon = Deconstruct(Point=curvepoint)  # -> XComponent, YComponent, ZComponent
Z_2 = UnitZ(Factor="0.17")
area_5 = Area(Geometry=brec_10.Bounding)  # -> Area, Centroid
explode_3 = Explode(Curve=brec_10.Bounding, Recursive=True)  # -> Segments, Vertices
item_12 = ListItem(List=explode_3.Segments, Index=0, Wrap=True)  # -> Item2, Item1, Item
curvepoint_2 = PointOnCurve(item_12.Item2, parameter=0.5)
custom_mesh_settings = SettingsCustom(
    StitchSeams=True,
    SimplePlanes=True,
    Refine=False,
    MinCount=16,
    MaxCount=400,
    AspectRatio="1",
    MaxDistance=0,
    MaxAngle=20,
    MinEdge=0,
    MaxEdge=0)
dwell = DwellTimeRetailBuffer(
    Passengers=sec.Passengers,
    DepartureMinute="800",
    GateOpenTime="50",
    GateCloseTime="15",
    PeakArrival="30",
    RandomSeed=random_seed)  # -> Passengers, AverageDwellTime
list_16 = ValueList({"CheckIn": 0, "BagDrop": 1, "Security": 2, "Immigration": 3, "Verification": 4, "Boarding": 5, "Retail": 6}, selected="Retail")
list_17 = ValueList({"CheckIn": 0, "BagDrop": 1, "Security": 2, "Immigration": 3, "Verification": 4, "Boarding": 5, "Retail": 6}, selected="Retail")
pdt_5 = PassengerDetails(Passengers=sec.Passengers)  # -> PassengerID, ArrivalTime, ServiceTime, StartService, EndService, simplify(WaitingTime), AssignedCounter, WalkingSpeed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
tpl_6 = FacilityTemplate(FacilityType=list_16)  # -> Template, AvailableTopologies
std_6 = FacilityStandards(
    FacilityType=list_17,
    QueueAreaPax=1.2,
    ProcessorWidth=1.5,
    ProcessorDepth=2,
    ProcessorPitch=1.8,
    Circulation=25,
    Support=10)
num_3 = Number(dwell.AverageDwellTime)
size_6 = FacilitySizer(OperationalResults=num_3, Passengers=dwell.Passengers, Standards=std_6, Template=tpl_6.Template)  # -> SizingResult, TotalArea, QueueArea, ProcessingArea, CirculationArea, Topology, Advice, EquipmentNames, EquipmentCounts
panel_15 = Panel(size_6.EquipmentNames)
panel_16 = Panel(size_6.EquipmentCounts)
md_slider = MDSlider(
    SliderMode=0,
    slider_value=Point(0.502658751, 1, 0.5),
    x_domain=Domain(0, 1),
    y_domain=Domain(0, 1),
    z_domain=Domain(0, 1))
division_14 = Division(A="100", B="100")
xy_2 = XYPlane(Origin=Point(0, 0, 0))
prot = RotatePlane(Plane=xy_2, Angle=degrees("90"))
tag_orientation = StreamFilter(Gate=dispatch_3.ListA, Stream0=xy_2, Stream1=prot)
list_18 = ValueList({"3 Seat Module": 3, "4 Seat Module": 4, "5 Seat Module": 5}, selected="3 Seat Module")
list_19 = ValueList({"CheckIn": 0, "BagDrop": 1, "Security": 2, "Immigration": 3, "Verification": 4, "Boarding": 5}, selected="Boarding")
panel_17 = Panel("2")
panel_18 = Panel("100")
over_design = ColourSwatch(SwatchColor=RGB(255, 83, 23))
sub_optimum = ColourSwatch(SwatchColor=RGB(255, 200, 61))
optimum = ColourSwatch(SwatchColor=RGB(43, 166, 53))
Z_3 = UnitZ(Factor=1)
mesh_3 = Mesh([<mesh referenced from the Rhino model> x3])
panel_19 = Panel("""3
4""")
panel_20 = Panel()
lng = ListLength(List=panel_19)
repeat = RepeatData(Data=mesh_3, Length=lng)
concat_2 = Concatenate(FragmentA=panel_20, FragmentB="(150)")
bbox = BoundingBox(Content=repeat, Plane=PlaneXY(0, 0, 0))  # -> Box, Box_2
debrep_2 = DeconstructBrep(Brep=bbox.Box)  # -> Faces, Edges, Vertices
panel_21 = Panel("""A
B
C
D
E
F
G
H
I
J
K
L""")
item_13 = ListItem(List=debrep_2.Vertices, Index=0, Wrap=True)
yz = YZPlane(Origin=item_13)
mirror_2 = Mirror(Geometry=graft(repeat), Plane=yz)  # -> simplify(Geometry), Transform
panel_22 = Panel("1,0.5")
merge_5 = Merge(Data1=simplify(graft(repeat)), Data2=mirror_2.Geometry)
bang = ExplodeTree(Data=merge_5)  # -> Branch0, Branch1, Branch2
brec_11 = BoundingRectangle(Geometry=merge_5, Plane=PlaneXY(0, 0, 0), Axis=0, Slide=0, Union=True)  # -> Bounding, simplify(flatten(DimensionX)), simplify(DimensionY)
item_14 = ListItem(List=brec_11.DimensionX, Index=0, Wrap=True)
bang_2 = ExplodeTree(Data=brec_11.DimensionY)  # -> Branch0, Branch1, Branch2
group_2 = Group(Geometry=bang.Branch1)
textsrf = TextOnSurface(Text=concat, Font="Sans Bold:no Italic:no", Height="1.5", Depth=0, BaseLine=line, BaseSurface=srf)  # -> flatten(Symbols)
move_7 = Move(Geometry=textsrf, Motion=Z)  # -> Geometry, Transform

c_bake_2 = ContextBake(Gates_48_83_227_100=srf)
c_bake_3 = ContextBake(Gates_46_61_122_255=move_7.Geometry)

cset = CreateSet(List=item_14)  # -> Set, Map
addition_7 = Addition(A=cset.Set, B="1.2")
filter_6 = StreamFilter(Gate=0, Stream0="Over-Designed", Stream1="Optimum", Stream2="Sub-Optimum")
paramptinrec = ParameterPointInRectangle(Rectangle=rectangle.Rectangle, ParameterX=0.5, ParameterY=0.85)  # -> Point, Normal
filter_7 = StreamFilter(Gate=0, Stream0=over_design, Stream1=optimum, Stream2=sub_optimum)
Z_4 = UnitZ(Factor=0.1)
panel_23 = Panel("sq.m.This includes Queue Area, Circulation Area and Corridor Area")
division_15 = Division(A="18", B=addition_7)
pt = Point(paramptinrec.Point)
X_7 = UnitX(Factor=1)
round_3 = Round(Number=division_15)  # -> Nearest, Floor, Ceiling
series_2 = Series(Start=0, Step=addition_7, Count=round_3.Ceiling)
line_2 = LineSDL(Start=pt, Direction=expr("-x*100", X_7), Length="500")
line_3 = LineSDL(Start=pt, Direction=X_7, Length="500")
X_8 = UnitX(Factor=series_2)
join = JoinCurves(Curves=[line_3, line_2], Preserve=False)
move_8 = Move(Geometry=group_2, Motion=X_8)  # -> Geometry, Transform
flip = FlipCurve(Curve=join)  # -> Curve, Flag
srf_2 = Surface(rectangle.Rectangle)
Y_3 = UnitY(Factor=1)
move_9 = Move(Geometry=move_8.Geometry, Motion=Y_3)  # -> Geometry, Transform

concat_3 = Concatenate(FragmentA="Your desired LoS was ", FragmentB=item, FragmentC=",and you are successfully delivering it.")

brec_12 = BoundingRectangle(Geometry=_2checkin_module, Plane=PlaneXY(0, 0, 0), Axis=0, Slide=0, Union=True)  # -> Bounding, DimensionX, DimensionY
brec_13 = BoundingRectangle(Geometry=rectangle.Rectangle, Plane=PlaneXY(0, 0, 0), Axis=0, Slide=0, Union=True)  # -> Bounding, DimensionX, DimensionY

disc_2 = Discontinuity(Curve=brec_13.Bounding, Level=1)  # -> Points, Parameters
shatter_2 = Shatter(Curve=brec_13.Bounding, Parameters=disc_2.Parameters)
item_15 = ListItem(List=shatter_2, Index=0, Wrap=True)  # -> Item1, Item, Item1_2, Item2
crv_2 = Curve(item_15.Item)

division_16 = Division(A=brec_12.DimensionX, B="2")
division_17 = Division(A=dim.VDimension, B=division_16)
round_4 = Round(Number=division_17)  # -> Nearest, Floor, Ceiling
division_18 = Division(A=brec_12.DimensionX, B="2")
min = Minimum(A=round_4.Nearest, B=filter)
multiplication_12 = Multiplication(A=min, B="2")
division_19 = Division(A=brec_12.DimensionX, B="2")
multiplication_13 = Multiplication(A=min, B=division_19)
X_9 = UnitX(Factor=expr("x/2", brec_12.DimensionX))

multiplication_14 = Multiplication(A=planning_inputs_passenger_departing, B=dhp, C="0.01")
multiplication_15 = Multiplication(A=multiplication_14, B=planning_inputs_passengers_using_check_i, C="0.01")
min_passenger_5 = Panel("1.5")
filter_8 = StreamFilter(
    Gate=total_check_in_counters_optimise_boolean,
    Stream0=planning_inputs_total_check_in_counters,
    Stream1=Slider(80, range=80..150))
avr = Average(Input=qs.ResourceUtilization)
roundd = RoundToDecimalPlace(NumberX=avr, DecimalPlace="2", RoundType=2)  # -> Rounded, Difference

physical_counter_check_in = Integer(multiplication_15)

c_script = CSharpScript(
    PaxCount=physical_counter_check_in,
    DepMinute="800",
    Horizon="300",
    Run=Toggle(True),
    Seed=Slider(60, range=0..100),
    Mean=num,
    StandardDeviation=min_passenger_5,
    N=filter_8,
    MaxLoS=item_5,
    Optimize=total_check_in_counters_optimise_boolean)  # -> out, OptimalN, StaffedN, Fitness, ArrivalMinutes, ServiceTimes, LambdaValues, Histogram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; inputs PaxCount: Int32, DepMinute: Int32, Horizon: Int32, Run: Boolean, Seed: Int32, Mean: Double, StandardDeviation: Double, N: Int32, MaxLoS: Double, Optimize: Boolean, StaffingPercentage: Double
# ---------- c_script: C# ----------
using System;
using System.Collections;
using System.Collections.Generic;
using System.Linq;

public class Script_Instance : GH_ScriptInstance
{
    #region Notes
    /* 
      Optimized Queue Simulation, Counter Optimizer & Staffing Level Adjustment
      - Event-driven O(P log P) peak queue tracking
      - Monotonic optimization loop with early-exit logic
      - Dynamic active counter calculation based on physical desks (N) and StaffingPercentage
    */
    #endregion

    public class Passenger
    {
        public double ArrivalTime { get; set; }
        public double ServiceTime { get; set; }
        public double StartServiceTime { get; set; }
        public double EndServiceTime { get; set; }
        public double WaitTime { get; set; }
        public int AssignedCounter { get; set; }
    }

    public class Counter
    {
        public int Id { get; set; }
        public double NextAvailableTime { get; set; }
    }

    private void RunScript(
		int PaxCount,
		int DepMinute,
		int Horizon,
		bool Run,
		int Seed,
		double Mean,
		double StandardDeviation,
		int N,
		double MaxLoS,
		bool Optimize,
		double StaffingPercentage,
		ref object OptimalN,
		ref object StaffedN,
		ref object Fitness,
		ref object ArrivalMinutes,
		ref object ServiceTimes,
		ref object LambdaValues,
		ref object Histogram,
		ref object PeakQueueLength,
		ref object AverageWait,
		ref object MaxWait,
		ref object Wait95,
		ref object CounterUtilization)
    {
        if (!Run)
            return;

        // Clamp the staffing percentage for computational safety
        if (StaffingPercentage <= 0.0) StaffingPercentage = 100.0;
        if (StaffingPercentage > 100.0) StaffingPercentage = 100.0;

        Random rnd = new Random(Seed);

        // ------------------------------------------------------------------
        // Part 1: Generate Arrival Profile (Gaussian Shape)
        // ------------------------------------------------------------------
        List<double> lambda = new List<double>();
        List<int> hist = new List<int>();
        List<int> arrivals = new List<int>();

        double peak = 90.0;   
        double sigma = 35.0;  
        double totalWeight = 0.0;

        for (int t = Horizon; t >= 1; t--)
        {
            double z = (t - peak) / sigma;
            double w = Math.Exp(-0.5 * z * z);
            lambda.Add(w);
            totalWeight += w;
        }

        double scale = (double)PaxCount / totalWeight;
        for (int i = 0; i < lambda.Count; i++)
        {
            lambda[i] *= scale;
        }

        int generated = 0;
        for (int i = 0; i < Horizon; i++)
        {
            double lam = lambda[i];
            int count = SamplePoisson(lam, rnd);

            if (generated + count > PaxCount)
                count = PaxCount - generated;

            hist.Add(count);

            int minutesBeforeDeparture = Horizon - i;
            int arrivalMinute = DepMinute - minutesBeforeDeparture;

            for (int k = 0; k < count; k++)
            {
                arrivals.Add(arrivalMinute);
            }

            generated += count;

            if (generated >= PaxCount)
            {
                for (int j = i + 1; j < Horizon; j++)
                    hist.Add(0);
                break;
            }
        }

        List<double> arrivalTimes = arrivals.Select(a => (double)(Horizon - (DepMinute - a))).ToList();

        // ------------------------------------------------------------------
        // Part 2: Generate Service Times (Lognormal Distribution)
        // ------------------------------------------------------------------
        List<double> genServiceTimes = new List<double>();
        for (int i = 0; i < arrivalTimes.Count; i++)
        {
            double s = SampleLognormal(Mean, StandardDeviation, rnd);
            genServiceTimes.Add(s);
        }

        // ------------------------------------------------------------------
        // Part 3: Queuing Simulation & Optimization Loop
        // ------------------------------------------------------------------
        int chosenN = N;
        int chosenActiveN = N;
        double bestFitness = -1.0;

        double finalAverageWait = 0.0;
        double finalMaxWait = 0.0;
        double finalWait95 = 0.0;
        int finalPeakQueueLength = 0;
        List<double> finalUtilization = new List<double>();

        if (!Optimize)
        {
            // Direct Simulation using the input physical N and current staffing level
            int activeN = (int)Math.Max(1, Math.Round(N * (StaffingPercentage / 100.0)));
            List<Passenger> simPassengers = CreatePassenger(arrivalTimes, genServiceTimes);
            List<Counter> simCounters = CreateCounters(activeN);

            RunQueue(simPassengers, simCounters);

            double avgWait = 0;
            double maxWait = 0;
            double wait95 = 0;
            GetPassengerMetrics(simPassengers, ref avgWait, ref maxWait, ref wait95);

            int peakQueue = GetPeakQueueLength(simPassengers);

            List<double> utilization = new List<double>();
            GetCounterUtilization(simPassengers, simCounters, ref utilization);

            double x = (MaxLoS > 0.0) ? (wait95 / MaxLoS) : 0.0;
            double fitness = (x > 1.0 || x < 0.5) ? -1.0 : x;

            chosenN = N;
            chosenActiveN = activeN;
            bestFitness = fitness;
            finalAverageWait = avgWait;
            finalMaxWait = maxWait;
            finalWait95 = wait95;
            finalPeakQueueLength = peakQueue;
            finalUtilization = utilization;
        }
        else
        {
            // Fallback variables: records the lowest configuration that satisfies wait95 <= MaxLoS
            int fallbackN = -1;
            int fallbackActiveN = -1;
            double fallbackWait95 = double.MaxValue;
            double fallbackAvgWait = 0;
            double fallbackMaxWait = 0;
            int fallbackPeakQueue = 0;
            List<double> fallbackUtilization = null;

            int startSearch = 1;
            int endSearch = Math.Max(50, N * 2);

            for (int currentN = startSearch; currentN <= endSearch; currentN++)
            {
                // Calculate active counters based on the current physical counter count and staffing level
                int activeN = (int)Math.Max(1, Math.Round(currentN * (StaffingPercentage / 100.0)));

                List<Passenger> simPassengers = CreatePassenger(arrivalTimes, genServiceTimes);
                List<Counter> simCounters = CreateCounters(activeN); // Simulate using staffed desks

                RunQueue(simPassengers, simCounters);

                double avgWait = 0;
                double maxWait = 0;
                double wait95 = 0;
                GetPassengerMetrics(simPassengers, ref avgWait, ref maxWait, ref wait95);

                int peakQueue = GetPeakQueueLength(simPassengers);

                List<double> utilization = new List<double>();
                GetCounterUtilization(simPassengers, simCounters, ref utilization);

                double x = (MaxLoS > 0.0) ? (wait95 / MaxLoS) : 0.0;
                double fitness = (x > 1.0 || x < 0.5) ? -1.0 : x;

                if (fitness > bestFitness)
                {
                    bestFitness = fitness;
                    chosenN = currentN;
                    chosenActiveN = activeN;
                    finalAverageWait = avgWait;
                    finalMaxWait = maxWait;
                    finalWait95 = wait95;
                    finalPeakQueueLength = peakQueue;
                    finalUtilization = utilization;
                }

                // Track standard fallback (lowest configurations meeting service target)
                if (wait95 <= MaxLoS && (fallbackN == -1 || currentN < fallbackN))
                {
                    fallbackN = currentN;
                    fallbackActiveN = activeN;
                    fallbackWait95 = wait95;
                    fallbackAvgWait = avgWait;
                    fallbackMaxWait = maxWait;
                    fallbackPeakQueue = peakQueue;
                    fallbackUtilization = utilization;
                }

                // Optimization Early Exit
                if (x < 0.5)
                {
                    break;
                }
            }

            // Apply fallback if no configuration produced a valid fitness score in the strict [0.5, 1.0] range
            if (bestFitness == -1.0 && fallbackN != -1)
            {
                chosenN = fallbackN;
                chosenActiveN = fallbackActiveN;
                finalAverageWait = fallbackAvgWait;
                finalMaxWait = fallbackMaxWait;
                finalWait95 = fallbackWait95;
                finalPeakQueueLength = fallbackPeakQueue;
                finalUtilization = fallbackUtilization;
            }
        }

        // ------------------------------------------------------------------
        // Assign Outputs
        // ------------------------------------------------------------------
        OptimalN = chosenN;               // Total physical counters required
        StaffedN = chosenActiveN;         // Active, staffed counters simulated
        Fitness = bestFitness;
        ArrivalMinutes = arrivalTimes;
        ServiceTimes = genServiceTimes;
        LambdaValues = lambda;
        Histogram = hist;
        PeakQueueLength = finalPeakQueueLength;
        AverageWait = finalAverageWait;
        MaxWait = finalMaxWait;
        Wait95 = finalWait95;
        CounterUtilization = finalUtilization;

        double totalDemand = genServiceTimes.Sum();
        double totalCapacity = chosenActiveN * (arrivalTimes.Count > 0 ? arrivalTimes.Max() : 1.0);
        Print($"Physical Desks: {chosenN} | Staffed Desks: {chosenActiveN} ({StaffingPercentage}%) | Demand/Capacity: {Math.Round(totalDemand / totalCapacity, 2)}");
    }

    // ----------------------------------------------------------------------
    // Helper Methods
    // ----------------------------------------------------------------------
    private int SamplePoisson(double lambda, Random rnd)
    {
        if (lambda <= 0.0)
            return 0;

        double L = Math.Exp(-lambda);
        int k = 0;
        double p = 1.0;

        do
        {
            k++;
            p *= rnd.NextDouble();
        }
        while (p > L);

        return k - 1;
    }

    private double SampleLognormal(double mean, double std, Random rnd)
    {
        double v = std * std;
        double s = Math.Sqrt(Math.Log(1.0 + (v / (mean * mean))));
        double m = Math.Log(mean) - 0.5 * s * s;

        double u1 = rnd.NextDouble();
        double u2 = rnd.NextDouble();
        
        if (u1 < 1e-9) u1 = 1e-9; 

        double z = Math.Sqrt(-2.0 * Math.Log(u1)) * Math.Cos(2.0 * Math.PI * u2);

        return Math.Round(Math.Exp(m + s * z), 2);
    }

    public List<Passenger> CreatePassenger(List<double> arrivalTimes, List<double> serviceTimes)
    {
        List<Passenger> passengers = new List<Passenger>();
        for (int i = 0; i < arrivalTimes.Count; i++)
        {
            Passenger p = new Passenger();
            p.ArrivalTime = arrivalTimes[i];
            p.ServiceTime = (i < serviceTimes.Count) ? serviceTimes[i] : 0.0;
            passengers.Add(p);
        }
        return passengers;
    }

    public List<Counter> CreateCounters(int numberOfCounters)
    {
        List<Counter> counters = new List<Counter>();
        for (int i = 0; i < numberOfCounters; i++)
        {
            Counter c = new Counter();
            c.Id = i;
            c.NextAvailableTime = 0.0;
            counters.Add(c);
        }
        return counters;
    }

    private void RunQueue(List<Passenger> passengers, List<Counter> counters)
    {
        passengers.Sort((a, b) => a.ArrivalTime.CompareTo(b.ArrivalTime));

        foreach (Passenger p in passengers)
        {
            Counter best = counters[0];
            for (int i = 1; i < counters.Count; i++)
            {
                if (counters[i].NextAvailableTime < best.NextAvailableTime)
                {
                    best = counters[i];
                }
            }

            p.StartServiceTime = Math.Max(p.ArrivalTime, best.NextAvailableTime);
            p.WaitTime = p.StartServiceTime - p.ArrivalTime;
            p.EndServiceTime = p.StartServiceTime + p.ServiceTime;
            p.AssignedCounter = best.Id;
            best.NextAvailableTime = p.EndServiceTime;
        }
    }

    private void GetPassengerMetrics(List<Passenger> passengers, ref double AverageWait, ref double MaxWait, ref double Wait95)
    {
        if (passengers == null || passengers.Count == 0)
        {
            AverageWait = 0.0;
            MaxWait = 0.0;
            Wait95 = 0.0;
            return;
        }

        List<double> sortedWaitTimes = passengers.Select(p => p.WaitTime).OrderBy(w => w).ToList();
        int index = (int)Math.Ceiling(0.95 * sortedWaitTimes.Count) - 1;
        if (index < 0) index = 0;

        AverageWait = passengers.Average(p => p.WaitTime);
        MaxWait = passengers.Max(p => p.WaitTime);
        Wait95 = sortedWaitTimes[index];
    }

    private int GetPeakQueueLength(List<Passenger> passengers)
    {
        if (passengers == null || passengers.Count == 0)
            return 0;

        List<KeyValuePair<double, int>> events = new List<KeyValuePair<double, int>>();

        foreach (Passenger p in passengers)
        {
            if (p.StartServiceTime > p.ArrivalTime)
            {
                events.Add(new KeyValuePair<double, int>(p.ArrivalTime, 1));
                events.Add(new KeyValuePair<double, int>(p.StartServiceTime, -1));
            }
        }

        events.Sort((a, b) =>
        {
            int cmp = a.Key.CompareTo(b.Key);
            if (cmp != 0) return cmp;
            return a.Value.CompareTo(b.Value); 
        });

        int currentQueue = 0;
        int peakQueue = 0;

        foreach (var ev in events)
        {
            currentQueue += ev.Value;
            if (currentQueue > peakQueue)
            {
                peakQueue = currentQueue;
            }
        }

        return peakQueue;
    }

    private void GetCounterUtilization(List<Passenger> passengers, List<Counter> counters, ref List<double> utilization)
    {
        utilization = new List<double>();
        if (counters == null || counters.Count == 0)
            return;

        if (passengers == null || passengers.Count == 0)
        {
            for (int i = 0; i < counters.Count; i++)
                utilization.Add(0.0);
            return;
        }

        double simulationDuration = passengers.Max(p => p.EndServiceTime);
        if (simulationDuration <= 0.0)
        {
            for (int i = 0; i < counters.Count; i++)
                utilization.Add(0.0);
            return;
        }

        foreach (Counter c in counters)
        {
            double busyTime = 0.0;
            foreach (Passenger p in passengers)
            {
                if (p.AssignedCounter == c.Id)
                {
                    busyTime += p.ServiceTime;
                }
            }
            double u = busyTime / simulationDuration;
            utilization.Add(u);
        }
    }
}
# ---------- end c_script ----------

filter_9 = StreamFilter(
    Gate=total_check_in_counters_optimise_boolean,
    Stream0=planning_inputs_total_check_in_counters,
    Stream1=c_script.OptimalN)
integer_division = IntegerDivision(A=filter_9, B=filter)

series_3 = Series(Start=0, Step=brec_12.DimensionX, Count=expr("x/2", filter_9))
division_20 = Division(A=filter_9, B="2")
round_5 = Round(Number=division_20)  # -> Nearest, Floor, Ceiling
division_21 = Division(A=division_20, B=integer_division)
round_6 = Round(Number=division_21)  # -> Nearest, Floor, Ceiling
division_22 = Division(A=brec_13.DimensionX, B=integer_division)
int = Integer(division_22)
range_2 = Range(Domain=Domain(0, 1), Steps=expr("x-1", integer_division))  # -> expr("x", Range)
series_4 = Series(Start=0, Step=int, Count=integer_division)

multiplication_16 = Multiplication(A=integer_division, B=round_6.Ceiling)

divide = DivideCurve(Curve=crv_2, Count=integer_division, Kinks=False)  # -> Points, Tangents, Parameters
item_16 = ListItem(List=divide.Points, Index=0, Wrap=True)
cull_ends = CullEnds(List=divide.Points)  # -> List, Culled
cp = ClosestPoint(Point=eval.Point, Cloud=cull_ends.List)  # -> ClosestPoint, CPIndex, Distance
ln = Line(StartPoint=eval.Point, EndPoint=cp.ClosestPoint)

repeat_2 = RepeatData(Data=round_6.Ceiling, Length=integer_division)
subtraction_7 = Subtraction(A=multiplication_16, B=round_5.Nearest)
c_script_2 = CSharpScript(values=repeat_2, remainder=subtraction_7)  # -> out, result, a; inputs values: list of Int32, remainder: Int32
# ---------- c_script_2: C# ----------
// Grasshopper Script Instance
#region Usings
using System;
using System.Linq;
using System.Collections;
using System.Collections.Generic;
using System.Drawing;

using Rhino;
using Rhino.Geometry;

using Grasshopper;
using Grasshopper.Kernel;
using Grasshopper.Kernel.Data;
using Grasshopper.Kernel.Types;
#endregion

public class Script_Instance : GH_ScriptInstance
{
    #region Notes
    /* 
      Members:
        RhinoDoc RhinoDocument
        GH_Document GrasshopperDocument
        IGH_Component Component
        int Iteration

      Methods (Virtual & overridable):
        Print(string text)
        Print(string format, params object[] args)
        Reflect(object obj)
        Reflect(object obj, string method_name)
    */
    #endregion

    private void RunScript(
		List<int> values,
		int remainder,
		ref object result,
		ref object a)
{
    if (values == null || values.Count == 0)
    {
        result = new List<int>();
        return;
    }

    int n = values.Count;

    // If remainder is 0 or negative, just return the original list
    if (remainder <= 0)
    {
        result = new List<int>(values);
        return;
    }

    // If remainder is larger than n, we can only subtract 1 from each element at most
    // (for a -1 distribution). If you want to allow subtracting more than 1 per element,
    // adjust the logic accordingly.
    int countSmaller = remainder % n;        // how many elements get -1
    int extra = remainder / n;               // how many full units we can subtract from each

    // Base smaller value = original - 1 - extra
    // Larger value = original - extra
    // But we'll assume remainder < n and extra = 0 for the simple case (each change is -1)

    if (extra == 0)
    {
        // Simple case: each of 'countSmaller' elements is reduced by 1
        int baseValue = values[0]; // assume all are equal
        int smaller = baseValue - 1;
        int larger = baseValue;
        

        List<int> list = new List<int>(n);

        // Alternate fairly: larger, smaller, larger, smaller, ...
        for (int i = 0; i < n; i++)
        {   int A=0;
            // Put smaller values at positions where i % 2 == 1, until we have enough
            if (i % 2 == 1 && countSmaller > 0 && A==1)
            {
                list.Add(smaller);
                countSmaller--;
                A=1;
            }
            else if (i % 2 == 0 && countSmaller > 0 && A==0)
            {
                // If we run out of odd positions, fill remaining smaller at even positions
                list.Add(smaller);
                countSmaller--;
                A=0;
            }
            else
            {
                list.Add(larger);
            }
        }

        result = list;
    }
    else
    {
        // More general case: subtract 'extra' from all, and then 1 more from 'countSmaller'
        int baseValue = values[0];
        int allSub = extra;
        int smaller = baseValue - allSub - 1;
        int larger = baseValue - allSub;

        List<int> list = new List<int>(n);

        for (int i = 0; i < n; i++)
        {
            if (i % 2 == 1 && countSmaller > 0)
            {
                list.Add(smaller);
                countSmaller--;
            }
            else if (countSmaller > 0)
            {
                list.Add(smaller);
                countSmaller--;
            }
            else
            {
                list.Add(larger);
            }
        }

        result = list;
    }
}
}
# ---------- end c_script_2 ----------
division_23 = Division(A=filter_9, B=multiplication_12)
round_7 = Round(Number=division_23)  # -> Nearest, Floor, Ceiling
divide_2 = DivideCurve(Curve=item_8.Item2, Count=expr("x-1", round_7.Nearest), Kinks=False)  # -> reverse(Points), Tangents, Parameters
divide_3 = DivideCurve(Curve=item_8.Item, Count=expr("x-1", round_7.Nearest), Kinks=False)  # -> Points, Tangents, Parameters
line_4 = LineSDL(Start=divide_2.Points, Direction=expr("-x", Y_2), Length=multiplication_13)
avr_2 = Average(Input=c_script.ServiceTimes)
bnd = Bounds(Numbers=c_script.LambdaValues)
panel_24 = Panel(c_script.out)
dedomain = DeconstructDomain(Domain=bnd)  # -> Start, End
merge_6 = Merge(
    Data1=flatten(c_script.out),
    Data2=flatten(qs.PeakQueueLength),
    Data3=flatten(qs.AverageWait),
    Data4=flatten(qs.MaximumWait),
    Data5=flatten(qs._95thPercentileWait))  # -> simplify(flatten(Result))
roundd_2 = RoundToDecimalPlace(NumberX=dedomain.End, DecimalPlace=2, RoundType=0)  # -> Rounded, Difference
item_17 = ListItem(List=merge_6, Index=0, Wrap=True)  # -> Item, Item1, Item2, Item3, Item4
shift = ShiftList(List=divide_3.Parameters, Shift=1, Wrap=False)

# ---- group: Peak Queueing Area
multiplication_17 = Multiplication(A=item_17.Item1, B=item_3)
area_for_ropes_corners = Panel("1.2")

# ----
offset_2 = OffsetCurve(Curve=line_4, Distance=expr("x/2", "3"), Corners=1)
offset_3 = OffsetCurve(Curve=line_4, Distance=expr("-x/2", "3"), Corners=1)
panel_25 = Panel(item_17.Item1)
merge_7 = Merge(Data1=offset_3, Data2=offset_2)  # -> simplify(Result)
flip_2 = FlipCurve(Curve=offset_2)  # -> Curve, Flag
flip_3 = FlipCurve(Curve=offset_3)  # -> Curve, Flag
divlength = DivideLength(Curve=flip_3.Curve, Length=expr("x/2", brec_12.DimensionX))  # -> Points, Tangents, Parameters
divlength_2 = DivideLength(Curve=flip_2.Curve, Length=expr("x/2", brec_12.DimensionX))  # -> Points, Tangents, Parameters
brec_14 = BoundingRectangle(Geometry=merge_7, Plane=PlaneXY(0, 0, 0), Axis=0, Slide=0, Union=True)  # -> Bounding, DimensionX, DimensionY
cull_i = CullIndex(List=divlength_2.Points, Indices=0, Wrap=True)
cull_i_2 = CullIndex(List=divlength.Points, Indices=0, Wrap=True)
flippln = FlipPlane(Plane=cull_i, FlipX=True, FlipY=True, FlipZ=True)  # -> Flipped, R
pflip = FlipPlane(Plane=cull_i_2, ReverseX=False, ReverseY=True, SwapAxes=True)
offset_4 = OffsetCurve(Curve=brec_14.Bounding, Distance=expr("-x/2", "1"), Corners=1)
dispatch_4 = Dispatch(List=pflip, DispatchPattern=[True, False])  # -> reverse(ListA), ListB
dispatch_5 = Dispatch(List=flippln.Flipped, DispatchPattern=[True, False])  # -> reverse(ListA), ListB
fillet = Fillet(Curve=offset_4, Radius=expr("x/2", "1"))
fillet_2 = Fillet(Curve=brec_14.Bounding, Radius="1")
item_18 = ListItem(List=dispatch_5.ListA, Index=0, Wrap=True)  # -> Item1, Item
item_19 = ListItem(List=dispatch_4.ListA, Index=0, Wrap=True)  # -> Item1, Item
transform = Transform(Geometry=mesh, Transform=item_18.Item1)
transform_2 = Transform(Geometry=mesh, Transform=item_19.Item1)  # -> flatten(Geometry)
bbox_2 = BoundingBox(Content=transform_2, Plane=PlaneXY(0, 0, 0))  # -> Box, Box_2

merge_8 = Merge(Data1=fillet_2, Data2=fillet)  # -> flatten(Result)
area_6 = Area(Geometry=merge_8)  # -> Area, Centroid
scale = Scale(Geometry=merge_8, Center=area_6.Centroid, Factor="0.98")  # -> Geometry, Transform
boundary_2 = BoundarySurfaces(Edges=scale.Geometry)
transform_3 = Transform(Geometry=mesh_2, Transform=dispatch_4.ListB)
transform_4 = Transform(Geometry=mesh_2, Transform=dispatch_5.ListB)
xy_3 = XYPlane(Origin=Point(0, 0, 0))
extr = Extrude(Base=boundary_2, Direction=Z_2)
mirror_3 = Mirror(Geometry=transform_4, Plane=xy_3)  # -> Geometry, Transform
mesh_4 = MeshBrep(Brep=extr, Settings=custom_mesh_settings)

mirror_4 = Mirror(Geometry=transform, Plane=xy_3)  # -> Geometry, Transform
area_7 = Area(Geometry=bbox_2.Box)  # -> Area, Centroid
xz = XZPlane(Origin=area_7.Centroid)
mirror_5 = Mirror(Geometry=mirror_4.Geometry, Plane=xz)  # -> Geometry, Transform
item_20 = ListItem(List=mirror_5.Geometry, Index=0, Wrap=True)
mirror_6 = Mirror(Geometry=transform_2, Plane=xz)  # -> Geometry, Transform

merge_9 = Merge(Data1=mirror_6.Geometry, Data2=item_20)
merge_10 = Merge(Data1=transform_3, Data2=mirror_3.Geometry)
lng_2 = ListLength(List=flatten(merge_9))
lng_3 = ListLength(List=flatten(merge_10))  # -> expr("x*2", Length)
ma = MassAddition(Input=[lng_2, lng_3])  # -> Result, PartialResults
merge_11 = Merge(Data1=merge_9, Data2=merge_10)
subtraction_8 = Subtraction(A=ma.Result, B=filter_9)
min_counters = CSharpScript(x=subtraction_8)  # -> out, a; inputs x: Int32, y: Boolean
# ---------- min_counters: C# ----------
// Grasshopper Script Instance
#region Usings
using System;
using System.Linq;
using System.Collections;
using System.Collections.Generic;
using System.Drawing;

using Rhino;
using Rhino.Geometry;

using Grasshopper;
using Grasshopper.Kernel;
using Grasshopper.Kernel.Data;
using Grasshopper.Kernel.Types;
#endregion

public class Script_Instance : GH_ScriptInstance
{
    #region Notes
    /* 
      Members:
        RhinoDoc RhinoDocument
        GH_Document GrasshopperDocument
        IGH_Component Component
        int Iteration

      Methods (Virtual & overridable):
        Print(string text)
        Print(string format, params object[] args)
        Reflect(object obj)
        Reflect(object obj, string method_name)
    */
    #endregion

    private void RunScript(int x, bool y, ref object a)
    {
        if(x>0)
        a=$"You can reduce {x} counter";
        else if(x==0)
        a=$"The Configuration fits {x} counters";
        else 
        a=$"You need to add {Math.Abs(x)} counters";
    }
}
# ---------- end min_counters ----------

min_walk = CSharpScript(x=cp.Distance, y="75")  # -> out, b, a; inputs x: list of Int32, y: Int32
# ---------- min_walk: C# ----------
// Grasshopper Script Instance
#region Usings
using System;
using System.Linq;
using System.Collections;
using System.Collections.Generic;
using System.Drawing;

using Rhino;
using Rhino.Geometry;

using Grasshopper;
using Grasshopper.Kernel;
using Grasshopper.Kernel.Data;
using Grasshopper.Kernel.Types;
#endregion

public class Script_Instance : GH_ScriptInstance
{
    #region Notes
    /* 
      Members:
        RhinoDoc RhinoDocument
        GH_Document GrasshopperDocument
        IGH_Component Component
        int Iteration

      Methods (Virtual & overridable):
        Print(string text)
        Print(string format, params object[] args)
        Reflect(object obj)
        Reflect(object obj, string method_name)
    */
    #endregion

    private void RunScript(List<int> x, int y, ref object b, ref object a)
    {
        foreach(int l in x)
        {
        if(l<75)
        {a="Walk Distance from Entry to E-Gates is comfortable";
          b=1;}
        else 
        {a=$"Walking Distance from Entry to E-Gate {l}m is not comfortable";
         b=2; }
        }
    }
}
# ---------- end min_walk ----------
item_21 = ListItem(List=min_walk.a, Index=0, Wrap=True)
panel_26 = Panel(item_21)
panel_27 = Panel(min_counters.a)
multiplication_18 = Multiplication(A=item_17.Item1, B=item_4)
multiplication_19 = Multiplication(A=division_14, B=item_17.Item4)
smaller = SmallerThan(FirstNumber=multiplication_19, SecondNumber=wait_ciculatearea_m2)  # -> SmallerThan, OrEqualTo
dispatch_6 = Dispatch(List=index_2, DispatchPattern=smaller.SmallerThan)  # -> ListA, ListB
smaller_2 = SmallerThan(FirstNumber=multiplication_19, SecondNumber=item_5)  # -> SmallerThan, OrEqualTo
item_22 = ListItem(List=dispatch_6.ListA, Index=0, Wrap=True)
item_23 = ListItem(List=panel_2, Index=item_22, Wrap=True)

c_script_3 = CSharpScript(y=multiplication_19)  # -> out, a; inputs y: Double
# ---------- c_script_3: C# ----------
// Grasshopper Script Instance
#region Usings
using System;
using System.Linq;
using System.Collections;
using System.Collections.Generic;
using System.Drawing;

using Rhino;
using Rhino.Geometry;

using Grasshopper;
using Grasshopper.Kernel;
using Grasshopper.Kernel.Data;
using Grasshopper.Kernel.Types;
#endregion

public class Script_Instance : GH_ScriptInstance
{
    #region Notes
    /* 
      Members:
        RhinoDoc RhinoDocument
        GH_Document GrasshopperDocument
        IGH_Component Component
        int Iteration

      Methods (Virtual & overridable):
        Print(string text)
        Print(string format, params object[] args)
        Reflect(object obj)
        Reflect(object obj, string method_name)
    */
    #endregion

    private void RunScript(double y, ref object a)
    {
        string b;
        // Write your logic here
       
         if(y<10)
         b="A";
         else if(y<12)
         b="B";
         else if(y<20)
         b="C";
         else if(y<25)
         b="D";
         else if(y<30)
         b="E";
         else
         b="F";
        
        a=b;
    }
}
# ---------- end c_script_3 ----------
expression_2 = Expression(x=item, y=c_script_3.a, Expression="If(x=y, true, false)")
and = GateAnd(A=expression_2, B=smaller_2.SmallerThan)
filter_10 = StreamFilter(Gate=and, Stream0=item_23, Stream1=c_script_3.a)

concat_4 = Concatenate(FragmentA="Your desired LoS was ", FragmentB=item, FragmentC=",but you are delivering ", FragmentD=filter_10)

filter_11 = StreamFilter(Gate=and, Stream0=concat_4, Stream1=concat_3)
c_script_4 = CSharpScript(x=multiplication_19, y=item_5)  # -> out, a; inputs x: Double, y: Double
# ---------- c_script_4: C# ----------
// Grasshopper Script Instance
#region Usings
using System;
using System.Linq;
using System.Collections;
using System.Collections.Generic;
using System.Drawing;

using Rhino;
using Rhino.Geometry;

using Grasshopper;
using Grasshopper.Kernel;
using Grasshopper.Kernel.Data;
using Grasshopper.Kernel.Types;
#endregion

public class Script_Instance : GH_ScriptInstance
{
    #region Notes
    /* 
      Members:
        RhinoDoc RhinoDocument
        GH_Document GrasshopperDocument
        IGH_Component Component
        int Iteration

      Methods (Virtual & overridable):
        Print(string text)
        Print(string format, params object[] args)
        Reflect(object obj)
        Reflect(object obj, string method_name)
    */
    #endregion

    private void RunScript(double x, double y, ref object a)
    {
    if (x < y/2)
         a= 1;
    else if (x < y) // here x is already >= 10
         a= 0;
    else
   a= 2;     // x >= 20
    }
    
}
# ---------- end c_script_4 ----------
int_2 = Integer(c_script_4.a)
round_8 = Round(Number=item_17.Item2)  # -> Nearest, Floor, Ceiling
filter_12 = StreamFilter(Gate=int_2, Stream0=optimum, Stream1=over_design, Stream2=sub_optimum)
concat_5 = Concatenate(FragmentC="[", FragmentA=filter_12, FragmentB="(200)", FragmentD="]")
round_9 = Round(Number=multiplication_19)  # -> Nearest, Floor, Ceiling
filter_13 = StreamFilter(Gate=int_2, Stream0="Optimum", Stream1="Over-Designed", Stream2="Sub-Optimum")
panel_28 = Panel(concat_5)
_95_percentile_wait_time_min = Panel(round_8.Floor)
peak_queue_length = Panel(item_17.Item1)
demand_capacity = Panel(item_17.Item)
_95_percentile_wait_time_min_2 = Panel(round_9.Ceiling)
c_print = ContextPrint(CheckInAreaColor=concat_5)
concat_6 = Concatenate(FragmentA="Peak Queue Length Combined", FragmentD=":", FragmentB=peak_queue_length)
concat_7 = Concatenate(FragmentA="95th Percentile Wait Time (min)", FragmentD=":", FragmentB=_95_percentile_wait_time_min_2)
concat_8 = Concatenate(FragmentA="Average Wait Time (min)", FragmentD=":", FragmentB=_95_percentile_wait_time_min)
concat_9 = Concatenate(FragmentC="Configuration of ", FragmentA=filter_9, FragmentD=" Counters is ", FragmentB=filter_13)
concat_10 = Concatenate(FragmentA="*", FragmentB=filter_11, FragmentC="*")
textsrf_2 = TextOnSurface(Text=filter_13, Font="Sans Bold:no Italic:no", Height=3, Depth=0, BaseLine=flip.Curve, BaseSurface=srf_2)
panel_29 = Panel(filter_9)
multiplication_20 = Multiplication(A=panel_29, B="2")
concat_11 = Concatenate(FragmentA="{", FragmentE="*", FragmentB=panel_29, FragmentF="*", FragmentC="}", FragmentD="[146, 172, 30]")
c_print_2 = ContextPrint(NoOfCountersInConfiguration=concat_11)  # disabled

# ---- group: ARDM text
c_bake_4 = ContextBake(Counters_46_61_122_180=textsrf_2)

# ----
panel_30 = Panel(concat_11)

partition = PartitionList(List=series_3, Size=c_script_2.result)  # -> simplify(Chunks)
lng_4 = ListLength(List=partition)
multiplication_21 = Multiplication(A=lng_4, B=brec_12.DimensionX)
bnd_2 = Bounds(Numbers=partition)
dedomain_2 = DeconstructDomain(Domain=bnd_2)  # -> Start, End
subtraction_9 = Subtraction(A=simplify(graft(series_4)), B=dedomain_2.Start)
panel_31 = Panel("0")

subtraction_10 = Subtraction(A=int, B=multiplication_21)
addition_8 = Addition(A=partition, B=subtraction_9)

cull_i_3 = CullIndex(List=flatten(subtraction_10), Indices=integer_division, Wrap=True)

lng_5 = ListLength(List=cull_i_3)  # -> expr("x-1", Length)
max = Maximum(A=lng_5, B="1")
ma_2 = MassAddition(Input=cull_i_3)  # -> Result, PartialResults

division_24 = Division(A=ma_2.Result, B=max)

panel_32 = Panel(division_24)
min_cross_circulation_spacing = Integer(division_24)
min_cross_circulation = CSharpScript(x=min_cross_circulation_spacing, y="10")  # -> out, b, c, a; inputs x: Int32, y: Int32
# ---------- min_cross_circulation: C# ----------
// Grasshopper Script Instance
#region Usings
using System;
using System.Linq;
using System.Collections;
using System.Collections.Generic;
using System.Drawing;

using Rhino;
using Rhino.Geometry;

using Grasshopper;
using Grasshopper.Kernel;
using Grasshopper.Kernel.Data;
using Grasshopper.Kernel.Types;
#endregion

public class Script_Instance : GH_ScriptInstance
{
    #region Notes
    /* 
      Members:
        RhinoDoc RhinoDocument
        GH_Document GrasshopperDocument
        IGH_Component Component
        int Iteration

      Methods (Virtual & overridable):
        Print(string text)
        Print(string format, params object[] args)
        Reflect(object obj)
        Reflect(object obj, string method_name)
    */
    #endregion

    private void RunScript(int x, int y, ref object b, ref object c, ref object a)
    {
        if(x>y)
        {a=$"You can reduce {x-y}m for cross circulation per aisle.";
         b=true;
         c=0;}
        else if(x<y)
        {a=$"You need to increase {y-x}m for cross circulation per aisle.";
         b=false;
         c=2;}
        else if(x==y)
        {a=$"Optimum cross circulation aisle";
         b=true;
         c=1;}
    }
}
# ---------- end min_cross_circulation ----------
int_3 = Integer(min_cross_circulation.b)
panel_33 = Panel(min_cross_circulation_spacing)

multiplication_22 = Multiplication(A=simplify(graft(range_2)), B=subtraction_10)  # -> simplify(Result)
addition_9 = Addition(A=addition_8, B=multiplication_22)
X_10 = UnitX(Factor=addition_9)

move_10 = Move(Geometry=item_16, Motion=X_10)  # -> Geometry, Transform
move2pt = MoveToPoint(Geometry=_2checkin_module, PointA=Point(1554.866621, 821.5733485, 0), PointB=move_10.Geometry)  # -> Moved, Vector, Transform

lng_6 = ListLength(List=flatten(move_10.Geometry))
xy_4 = XYPlane(Origin=move_10.Geometry)
brec_15 = BoundingRectangle(Geometry=move2pt.Moved, Plane=PlaneXY(0, 0, 0), Axis=0, Slide=0, Union=True)  # -> simplify(Bounding), DimensionX, DimensionY
disc_3 = Discontinuity(Curve=brec_15.Bounding, Level=1)  # -> Points, Parameters
shatter_3 = Shatter(Curve=brec_15.Bounding, Parameters=disc_3.Parameters)
item_24 = ListItem(List=shatter_3, Index=0, Wrap=True)  # -> Item1, Item, Item1_2, Item2
crv_3 = Curve(item_24.Item2)
len = Length(Curve=crv_3)
eval_2 = EvaluateCurve(Curve=reparameterize(crv_3), Parameter="0.5")  # -> Point, Tangent, Angle
dom_5 = ConstructDomain(DomainStart=expr("-x/2", len), DomainEnd=expr("x/2", len))

move_11 = Move(Geometry=xy_4, Motion=X_9)  # -> Geometry, Transform
multiplication_23 = Multiplication(A=lng_6, B="2")
min_check_in = CSharpScript(x=multiplication_23, y=filter_9)  # -> out, a; inputs x: Int32, y: Int32
# ---------- min_check_in: C# ----------
// Grasshopper Script Instance
#region Usings
using System;
using System.Linq;
using System.Collections;
using System.Collections.Generic;
using System.Drawing;

using Rhino;
using Rhino.Geometry;

using Grasshopper;
using Grasshopper.Kernel;
using Grasshopper.Kernel.Data;
using Grasshopper.Kernel.Types;
#endregion

public class Script_Instance : GH_ScriptInstance
{
    #region Notes
    /* 
      Members:
        RhinoDoc RhinoDocument
        GH_Document GrasshopperDocument
        IGH_Component Component
        int Iteration

      Methods (Virtual & overridable):
        Print(string text)
        Print(string format, params object[] args)
        Reflect(object obj)
        Reflect(object obj, string method_name)
    */
    #endregion

    private void RunScript(int x, int y, ref object a)
    {
        if(x>y)
        a=$"You can reduce {x-y} check in counters.";
        else if(x<y)
        a=$"You need to increase {y-x} heck in counters.";
        else if(x==y)
        a=$"The Configuration matches the check in counter demand.";
    }
}
# ---------- end min_check_in ----------

division_25 = Division(A=brec_10.DimensionY, B="2")
division_26 = Division(A=brec_6.DimensionY, B="2")
addition_10 = Addition(A=division_26, B=division_25)
Y_4 = UnitY(Factor=addition_10)
move2pt_2 = MoveToPoint(PointA=area_3.Centroid, PointB=area_5.Centroid)  # -> Moved, Vector, Transform
move_12 = Move(Motion=Y_4)  # -> Geometry, Transform
comp = Compound(Transforms=flatten([move2pt_2.Transform, move_12.Transform]))
transform_5 = Transform(Geometry=arrlinear.Geometry, Transform=comp)
brec_16 = BoundingRectangle(Geometry=flatten(transform_5), Plane=PlaneXY(0, 0, 0), Axis=0, Slide=0, Union=True)  # -> Bounding, DimensionX, DimensionY
explode_4 = Explode(Curve=brec_16.Bounding, Recursive=True)  # -> Segments, Vertices
item_25 = ListItem(List=explode_4.Segments, Index=0, Wrap=True)  # -> Item2, Item1, Item
Y_5 = UnitY(Factor="2")
move_13 = Move(Geometry=item_25.Item2, Motion=Y_5)  # -> Geometry, Transform
len_2 = Length(Curve=move_13.Geometry)
division_27 = Division(A=size_4.QueueArea, B=len_2)
Y_6 = UnitY(Factor=division_27)
move_14 = Move(Geometry=move_13.Geometry, Motion=Y_6)  # -> Geometry, Transform
extr_2 = Extrude(Base=move_13.Geometry, Direction=Y_6)
curvepoint_3 = PointOnCurve(move_14.Geometry, parameter=0.5)
Y_7 = UnitY(Factor=expr("-x", spatial_inputs_immigration_offset_from_e))
pdecon_2 = Deconstruct(Point=curvepoint_2)  # -> XComponent, YComponent, ZComponent

crv_4 = Curve(extr_2)
merge_12 = Merge(Data1=transform_5, Data2=crv_4)

tstat = TreeStatistics(Tree=move_11.Geometry)  # -> Paths, Length, Count

avr_3 = Average(Input=tstat.Length)
smaller_3 = SmallerThan(FirstNumber=tstat.Length, SecondNumber=expr("x/2", avr_3))  # -> SmallerThan, OrEqualTo
panel_34 = Panel(tstat.Length)
dispatch_7 = Dispatch(List=tstat.Paths, DispatchPattern=smaller_3.SmallerThan)  # -> ListA, ListB
branch = TreeBranch(Tree=move_11.Geometry, Path=dispatch_7.ListB, MaintainPaths=True)

addition_11 = Addition(A=brec_12.DimensionY, B="2")
addition_12 = Addition(A=brec_12.DimensionY, B="2")
offset_5 = OffsetCurve(Curve=offset_3, Distance=expr("-x", addition_12), Corners=1)
offset_6 = OffsetCurve(Curve=offset_2, Distance=addition_11, Corners=1)
len_3 = Length(Curve=offset_6)
eval_3 = EvaluateCurve(Curve=reparameterize(offset_5), Parameter=0)  # -> Point, Tangent, Angle
eval_4 = EvaluateCurve(Curve=reparameterize(offset_6), Parameter=1)  # -> Point, Tangent, Angle
len_4 = Length(Curve=offset_5)
ma_3 = MassAddition(Input=flatten([len_3, len_4]))  # -> Result, PartialResults
prot_2 = RotatePlane(Plane=eval_3.Point, Angle=degrees("-90"))
prot_3 = RotatePlane(Plane=eval_4.Point, Angle=degrees("90"))
dom_6 = ConstructDomain(DomainStart=0, DomainEnd=len_3)
division_28 = Division(A="3", B="2")
subtraction_11 = Subtraction(A=round_7.Nearest, B="1")
division_29 = Division(A=brec_13.DimensionX, B="2")
panel_35 = Panel(division_29)

multiplication_24 = Multiplication(A="2", B="2")

md_slider_2 = MDSlider(
    SliderMode=0,
    slider_value=Point(0.5406689528, 0.826637082, 0.5),
    x_domain=Domain(0, 1),
    y_domain=Domain(0, 1),
    z_domain=Domain(0, 1))
evalsrf = EvaluateSurface(Surface=reparameterize(brec_13.Bounding), Point=md_slider_2)  # -> Point, Normal, UDirection, VDirection, Frame
Y_8 = UnitY(Factor="2")
move_15 = Move(Geometry=evalsrf.Point, Motion=Y_8)  # -> Geometry, Transform
X_11 = UnitX(Factor=expr("-x", division_29))
move_16 = Move(Geometry=move_15.Geometry, Motion=X_11)  # -> Geometry, Transform

transform_6 = Transform(Geometry=mesh_2, Transform=branch)

furniture_blocks = StreamFilter(Gate=dispatch_3.ListA, Stream0=transform_6, Stream1=[merge_11, mesh_4])

# ---- group: Counter Blocks
geo_4 = Geometry(flatten(furniture_blocks))
c_bake_5 = ContextBake(Counters_47_71_172_150=geo_4)

# ----
multiplication_25 = Multiplication(A=multiplication_17, B=area_for_ropes_corners)
roundf_2 = RoundToFactor(NumberX=multiplication_25, Factor="5", RoundType=0)  # -> Rounded, Difference, MultiplierR, MultiplierX
md_slider_3 = MDSlider(
    SliderMode=0,
    slider_value=Point(0.502658751, 0, 0.5),
    x_domain=Domain(0, 1),
    y_domain=Domain(0, 1),
    z_domain=Domain(0, 1))
division_30 = Division(A=multiplication_25, B=division_20)
multiplication_26 = Multiplication(A=division_30, B=lng_4)  # -> simplify(Result)
division_31 = Division(A=multiplication_26, B=len)  # -> simplify(Result)

multiplication_27 = Multiplication(A=division_31, B="1")

addition_13 = Addition(A="2", B=multiplication_27)
dom_7 = ConstructDomain(DomainStart="2", DomainEnd=addition_13)
rectangle_3 = Rectangle(Plane=eval_2.Point, XSize=dom_5, YSize=dom_7, Radius=0)  # -> Rectangle, Length

panel_36 = Panel(addition_13)
brec_17 = BoundingRectangle(Geometry=flatten(rectangle_3.Rectangle), Plane=PlaneXY(0, 0, 0), Axis=0, Slide=0, Union=True)  # -> Bounding, DimensionX, DimensionY
rdiff = RegionDifference(CurvesA=brec_17.Bounding, CurvesB=flatten(rectangle_3.Rectangle))
evalsrf_2 = EvaluateSurface(Surface=reparameterize(brec_17.Bounding), Point=md_slider)  # -> Point, Normal, UDirection, VDirection, Frame
brec_18 = BoundingRectangle(Geometry=rdiff, Plane=PlaneXY(0, 0, 0), Axis=0, Slide=0, Union=False)  # -> Bounding, DimensionX, DimensionY
addition_14 = Addition(A=brec_17.DimensionY, B="2", C=brec_12.DimensionY)
paramptinrec_2 = ParameterPointInRectangle(Rectangle=brec_18.Bounding, ParameterX=0.5, ParameterY=0)  # -> Point, Normal
division_32 = Division(A=addition_14, B=brec_17.DimensionY)
area_8 = Area(Geometry=rdiff)  # -> Area, Centroid
subtraction_12 = Subtraction(A=multiplication_18, B=area_8.Area)
scale_nu_2 = ScaleNU(Geometry=brec_17.Bounding, Plane=evalsrf_2.Point, ScaleX=1, ScaleY=division_32, ScaleZ=1)  # -> Geometry, Transform
area_9 = Area(Geometry=scale_nu_2.Geometry)  # -> Area, Centroid
area_10 = Area(Geometry=scale_nu_2.Geometry)  # -> Area, Centroid
addition_15 = Addition(A=subtraction_12, B=area_9.Area)

evalsrf_3 = EvaluateSurface(Surface=reparameterize(scale_nu_2.Geometry), Point=md_slider_3)  # -> Point, Normal, UDirection, VDirection, Frame
item_26 = ListItem(List=addition_15, Index=0, Wrap=True)
division_33 = Division(A=item_26, B=area_9.Area)
item_27 = ListItem(List=flatten(multiplication_27), Index=0, Wrap=True)

scale_nu_3 = ScaleNU(Geometry=scale_nu_2.Geometry, Plane=evalsrf_3.Point, ScaleX=1, ScaleY=division_33, ScaleZ=1)  # -> Geometry, Transform
offset_7 = OffsetCurve(Curve=scale_nu_3.Geometry, Distance=1, Corners=1)
roundf_3 = RoundToFactor(NumberX=area_10.Area, Factor="5", RoundType=0)  # -> Rounded, Difference, MultiplierR, MultiplierX
subtraction_13 = Subtraction(A=brec_13.DimensionY, B=addition_14)
min_cross_circulation_2 = CSharpScript(x=subtraction_13, y="10")  # -> out, b, a; inputs x: Int32, y: Int32
# ---------- min_cross_circulation_2: C# ----------
// Grasshopper Script Instance
#region Usings
using System;
using System.Linq;
using System.Collections;
using System.Collections.Generic;
using System.Drawing;

using Rhino;
using Rhino.Geometry;

using Grasshopper;
using Grasshopper.Kernel;
using Grasshopper.Kernel.Data;
using Grasshopper.Kernel.Types;
#endregion

public class Script_Instance : GH_ScriptInstance
{
    #region Notes
    /* 
      Members:
        RhinoDoc RhinoDocument
        GH_Document GrasshopperDocument
        IGH_Component Component
        int Iteration

      Methods (Virtual & overridable):
        Print(string text)
        Print(string format, params object[] args)
        Reflect(object obj)
        Reflect(object obj, string method_name)
    */
    #endregion

    private void RunScript(int x, int y, ref object b, ref object a)
    {
        if(x<y)
        {a=$"You need {y-x}m space for circulation behind queueing area.";
         b=true;}
        else if((x>y)&&((x-y)<10))
        {a=$"You have {x-y}m deep Check-In Hall area,do check if that's sufficient.";
         b=false;}
        else 
        {a=$"You have {x-y}m deep Check-In Hall area,do check if it's not overdesigned.";
         b=true;}
    }
}
# ---------- end min_cross_circulation_2 ----------
queue_area_sq_m = Panel(multiplication_25)
concat_12 = Concatenate(FragmentA="Queue Area (sq.m)", FragmentD=":", FragmentB=queue_area_sq_m)

concat_13 = Concatenate(FragmentA="3.", FragmentB=min_cross_circulation.a)
concat_14 = Concatenate(FragmentA="1.", FragmentB=min_check_in.a)
concat_15 = Concatenate(FragmentA="4.", FragmentB=min_cross_circulation_2.a)
concat_16 = Concatenate(FragmentA="2.", FragmentB=item_21)
config_summariser = Concatenate(Min_Counters=concat_14, Min_Walk=concat_16, Min_Cross_Space=concat_13, Min_Space_Behind_Queue=concat_15)

panel_37 = Panel(config_summariser)

division_34 = Division(A=multiplication_25, B=ma_3.Result)
dom_8 = ConstructDomain(DomainStart=0, DomainEnd=division_34)
addition_16 = Addition(A=division_34, B=addition_11, C=division_28)
multiplication_28 = Multiplication(A=addition_16, B=subtraction_11, C="2")
roundd_3 = RoundToDecimalPlace(NumberX=multiplication_28, DecimalPlace="2", RoundType=0)  # -> Rounded, Difference
roundd_4 = RoundToDecimalPlace(NumberX=division_34, DecimalPlace="2", RoundType=2)  # -> Rounded, Difference
subtraction_14 = Subtraction(A=dim.UDimension, B=roundd_3.Rounded)
division_35 = Division(A=subtraction_14, B=subtraction_11)
min_circulation_space = CSharpScript(x=division_35, y="6")  # -> out, b, a; inputs x: Int32, y: Double
# ---------- min_circulation_space: C# ----------
// Grasshopper Script Instance
#region Usings
using System;
using System.Linq;
using System.Collections;
using System.Collections.Generic;
using System.Drawing;

using Rhino;
using Rhino.Geometry;

using Grasshopper;
using Grasshopper.Kernel;
using Grasshopper.Kernel.Data;
using Grasshopper.Kernel.Types;
#endregion

public class Script_Instance : GH_ScriptInstance
{
    #region Notes
    /* 
      Members:
        RhinoDoc RhinoDocument
        GH_Document GrasshopperDocument
        IGH_Component Component
        int Iteration

      Methods (Virtual & overridable):
        Print(string text)
        Print(string format, params object[] args)
        Reflect(object obj)
        Reflect(object obj, string method_name)
    */
    #endregion

    private void RunScript(int x, double y, ref object b, ref object a)
    {
        if(x>y)
       { a=$"You can reduce {x-y}m for cross circulation per aisle.";
         b= true;}
        else if(x<y)
        {a=$"You need to increase {y-x}m for cross circulation per aisle.";
          b= false;}
        else if(x==y)
       { a=$"Optimum cross circulation aisle";
        b= true;}
    }
}
# ---------- end min_circulation_space ----------
int_4 = Integer(min_circulation_space.b)

multiplication_29 = Multiplication(A=division_34, B="2")
addition_17 = Addition(A=multiplication_24, B=multiplication_29)
subtraction_15 = Subtraction(A=shift, B=addition_17)

rectangle_4 = Rectangle(Plane=simplify(prot_3), XSize=dom_6, YSize=dom_8, Radius=0)  # -> Rectangle, Length
rectangle_5 = Rectangle(Plane=simplify(prot_2), XSize=dom_6, YSize=dom_8, Radius=0)  # -> simplify(Rectangle), Length
flatten = FlattenTree(Tree=[rectangle_5.Rectangle, rectangle_4.Rectangle], Path="{0}")

partition_2 = PartitionList(List=flatten, Size="2")
brec_19 = BoundingRectangle(Geometry=flatten, Plane=PlaneXY(0, 0, 0), Axis=0, Slide=0, Union=True)  # -> Bounding, DimensionX, DimensionY
brec_20 = BoundingRectangle(Geometry=partition_2, Plane=PlaneXY(0, 0, 0), Axis=0, Slide=0, Union=False)  # -> Bounding, DimensionX, DimensionY
multiplication_30 = Multiplication(A=brec_19.DimensionY, B=brec_3.DimensionX)
offset_8 = OffsetCurve(Curve=brec_19.Bounding, Distance=1, Corners=1)
rdiff_2 = RegionDifference(CurvesA=brec_19.Bounding, CurvesB=flatten(brec_20.Bounding))
roundf_4 = RoundToFactor(NumberX=multiplication_30, Factor="5", RoundType=0)  # -> Rounded, Difference, MultiplierR, MultiplierX
brec_21 = BoundingRectangle(Geometry=rdiff_2, Plane=PlaneXY(0, 0, 0), Axis=0, Slide=0, Union=False)  # -> Bounding, DimensionX, DimensionY

paramptinrec_3 = ParameterPointInRectangle(Rectangle=brec_21.Bounding, ParameterX=0.5, ParameterY=0)  # -> Point, Normal
dispatch_8 = Dispatch(List=paramptinrec_3.Point, DispatchPattern=[True, False])  # -> ListA, ListB
queue_area = StreamFilter(Gate=dispatch_3.ListA, Stream0=rectangle_3.Rectangle, Stream1=flatten)
que_depth = StreamFilter(Gate=dispatch_3.ListA, Stream0=item_27, Stream1=roundd_4.Rounded)
furniture_blocks_2 = StreamFilter(Gate=dispatch_3.ListA, Stream0=int_3, Stream1=int_4)

furniture_blocks_3 = StreamFilter(
    Gate=dispatch_3.ListA,
    Stream0=" is not sufficient (Check Width of Aisles).",
    Stream1=" is not sufficient (Check Depth or Aisle Spacing).")
furniture_blocks_4 = StreamFilter(Gate=dispatch_3.ListA, Stream0=move_16.Geometry, Stream1=move_16.Geometry)
total_cuvre = StreamFilter(Gate=dispatch_3.ListA, Stream0=offset_7, Stream1=offset_8)
total_cuvre_2 = StreamFilter(Gate=dispatch_3.ListA, Stream0=paramptinrec_2.Point, Stream1=dispatch_8.ListB)

gate = StreamGate(Stream=furniture_blocks_3, Gate=furniture_blocks_2)  # -> Target0, Target1
gate_2 = StreamGate(Stream=rectangle.Rectangle, Gate=furniture_blocks_2)  # -> Target0, Target1

Y_9 = UnitY(Factor=1)
line_5 = LineSDL(Start=total_cuvre_2, Direction=expr("-x", Y_9), Length="6")
end = EndPoints(Curve=line_5)  # -> Start, End
panel_38 = Panel("45")
Z_5 = UnitZ(Factor=1)
X_12 = UnitX(Factor=end.End)
vrot = Rotate(Vector=X_12, Axis=Z_5, Angle=degrees("45"))
yz_2 = YZPlane(Origin=end.End)
line_6 = LineSDL(Start=end.End, Direction=vrot, Length="1.5")
mirror_7 = Mirror(Geometry=line_6, Plane=yz_2)  # -> Geometry, Transform
join_2 = JoinCurves(Curves=[mirror_7.Geometry, line_6, line_5], Preserve=False)
offcrv = OffsetCurve(Curve=join_2, Plane=PlaneXY(0, 0, 0), Distance=-0.2, BothSides=0.2, Kinks=0, CapType=1)  # -> flatten(Offset)
runion = RegionUnion(Curves=offcrv)
srf_3 = Surface(runion)

pt_2 = Point(end.End)
lng_7 = ListLength(List=pt_2)
division_36 = Division(A=ver.RequiredGates, B=lng_7)
multiplication_31 = Multiplication(A=addition, B=division_36)
dom_9 = ConstructDomain(DomainStart=expr("-x/2", multiplication_31), DomainEnd=expr("x/2", multiplication_31))
rectangle_6 = Rectangle(Plane=pt_2, XSize=dom_9, YSize=brec.DimensionY, Radius=0)  # -> Rectangle, Length
debrep_3 = DeconstructBrep(Brep=rectangle_6.Rectangle)  # -> Faces, Edges, Vertices
item_28 = ListItem(List=debrep_3.Vertices, Index=0, Wrap=True)
move2pt_3 = MoveToPoint(Geometry=e_gate, PointA=item_7, PointB=item_28)  # -> Moved, Vector, Transform
arrlinear_2 = LinearArray(Geometry=move2pt_3.Moved, Direction=X_3, Count=division_36)  # -> Geometry, Transform
move_17 = Move(Geometry=arrlinear_2.Geometry, Motion=Y)  # -> Geometry, Transform
brec_22 = BoundingRectangle(Geometry=move_17.Geometry, Plane=PlaneXY(0, 0, 0), Axis=0, Slide=0, Union=True)  # -> Bounding, DimensionX, DimensionY
explode_5 = Explode(Curve=brec_22.Bounding, Recursive=True)  # -> Segments, Vertices
item_29 = ListItem(List=explode_5.Segments, Index=0, Wrap=True)  # -> simplify(Item)
tstat_2 = TreeStatistics(Tree=item_29)  # -> Paths, Length, Count
lng_8 = ListLength(List=tstat_2.Paths)
multiplication_32 = Multiplication(A=division_7, B=lng_8)
round_10 = Round(Number=multiplication_32)  # -> Nearest, Floor, Ceiling
partition_3 = PartitionList(List=tstat_2.Paths, Size=round_10.Nearest)  # -> simplify(Chunks)
branch_2 = TreeBranch(Tree=simplify(partition_3), Path="1", MaintainPaths=True)
branch_3 = TreeBranch(Tree=simplify(partition_3), Path="0", MaintainPaths=True)
branch_4 = TreeBranch(Tree=simplify(item_29), Path=branch_3, MaintainPaths=True)
branch_5 = TreeBranch(Tree=simplify(item_29), Path=branch_2, MaintainPaths=True)
brec_23 = BoundingRectangle(Geometry=flatten(branch_5), Plane=PlaneXY(0, 0, 0), Axis=0, Slide=0, Union=True)  # -> Bounding, DimensionX, DimensionY
curvepoint_4 = PointOnCurve(branch_4, parameter=0.5)
explode_6 = Explode(Curve=brec_23.Bounding, Recursive=True)  # -> Segments, Vertices
item_30 = ListItem(List=explode_6.Segments, Index=0, Wrap=True)
curvepoint_5 = PointOnCurve(item_30, parameter=0.5)
pdecon_3 = Deconstruct(Point=curvepoint_4)  # -> XComponent, YComponent, ZComponent
subtraction_16 = Subtraction(A=pdecon.YComponent, B=pdecon_3.YComponent)
addition_18 = Addition(A=subtraction_16, B=Slider(2, range=2..10))
Y_10 = UnitY(Factor=expr("-x", addition_18))
move_18 = Move(Geometry=merge_4, Motion=Y_10)  # -> Geometry, Transform
brec_24 = BoundingRectangle(Geometry=flatten(move_18.Geometry), Plane=PlaneXY(0, 0, 0), Axis=0, Slide=0, Union=True)  # -> Bounding, DimensionX, DimensionY

Y_11 = UnitY(Factor="1")
X_13 = UnitX(Factor=1)
move_19 = Move(Geometry=end.Start, Motion=Y_11)  # -> Geometry, Transform
line_7 = LineSDL(Start=move_19.Geometry, Direction=expr("-x", X_13), Length="3")
line_8 = LineSDL(Start=move_19.Geometry, Direction=X_13, Length="3")
join_3 = JoinCurves(Curves=[line_8, line_7], Preserve=False)  # -> flatten(Curves)
srf_4 = Surface(total_cuvre)
flip_4 = FlipCurve(Curve=join_3)  # -> Curve, Flag
concat_17 = Concatenate(FragmentA="E-Gates")
textsrf_3 = TextOnSurface(Text=concat_17, Font="Sans Bold:no Italic:no", Height=1.2, Depth=0, BaseLine=flip_4.Curve, BaseSurface=srf_4)  # -> flatten(Symbols)

srf_5 = Surface(gate_2.Target0)  # disabled
srf_6 = Surface(queue_area)
runion_2 = RegionUnion(Curves=flatten(srf_6))
crv_5 = Curve(runion_2)
srf_7 = Surface(crv_5)
queue_depth_m = Panel(que_depth)
area_11 = Area(Geometry=crv_5)  # -> Area, Centroid
c_bake_6 = ContextBake(CheckInArea=srf_7)
roundd_5 = RoundToDecimalPlace(NumberX=queue_depth_m, DecimalPlace="1", RoundType=0)  # -> Rounded, Difference
sort_pt_2 = SortPoints(Points=area_11.Centroid)  # -> Points, Indices
concat_18 = Concatenate(FragmentA="Queue Depth (m)", FragmentD=":", FragmentB=roundd_5.Rounded)
index_5 = ItemIndex(List=sort_pt_2.Points, Item=sort_pt_2.Points)
item_31 = ListItem(List=panel_21, Index=index_5, Wrap=True)
merge_13 = Merge(Data1=concat_9, Data2=concat_12, Data3=concat_6, Data4=concat_8, Data5=concat_7, Data6=concat_18)  # -> flatten(Result)
c_print_3 = ContextPrint(Metrics=merge_13)  # disabled
concat_19 = Concatenate(FragmentA="Zone ", FragmentB=item_31)
pl_origin = PlaneOrigin(Base=tag_orientation, Origin=sort_pt_2.Points)
brec_25 = BoundingRectangle(Geometry=srf_7, Plane=pl_origin, Axis=0, Slide=0, Union=True)  # -> Bounding, flatten(DimensionX), DimensionY
item_32 = ListItem(List=brec_25.DimensionX, Index=0, Wrap=True)
deplane = DeconstructPlane(Plane=pl_origin)  # -> Origin, XAxis, YAxis, ZAxis
c_bake_7 = ContextBake(Arrows_0_0_0_150=flatten(srf_3))
offset_9 = OffsetCurve(Curve=total_cuvre, Distance=expr("-x/2", "0.15"), Corners=1)
offset_10 = OffsetCurve(Curve=total_cuvre, Distance=expr("x/2", "0.15"), Corners=1)
amp = Amplitude(Vector=deplane.XAxis, Amplitude=expr("-x/2", item_32))
c_bake_8 = ContextBake(Text_0_0_0_150=flatten(textsrf_3))
boundary_3 = BoundarySurfaces(Edges=[offset_9, offset_10])
c_bake_9 = ContextBake(CheckIn_BoundingBox_179_57_26_150=flatten(boundary_3))
move_20 = Move(Geometry=pl_origin, Motion=amp)  # -> Geometry, Transform
area_12 = Area(Geometry=offset_9)  # -> Area, Centroid
line_9 = LineSDL(Start=move_20.Geometry, Direction=deplane.XAxis, Length=item_32)
roundf_5 = RoundToFactor(NumberX=area_12.Area, Factor="10", RoundType=0)  # -> Rounded, Difference, MultiplierR, MultiplierX
textsrf_4 = TextOnSurface(Text=concat_19, Font="Sans Bold:no Italic:no", Height="1.5", Depth=0, BaseLine=line_9, BaseSurface=srf_7)
concat_20 = Concatenate(FragmentA="{", FragmentE="*", FragmentB=roundf_5.Rounded, FragmentF="*", FragmentC="}", FragmentD="[146, 172, 30]")
concat_21 = Concatenate(FragmentD="Designed Check In  Area of ", FragmentA=concat_20, FragmentB="sq.m", FragmentC=gate.Target0)
gate_3 = StreamGate(Stream=concat_21, Gate=furniture_blocks_2)  # -> Target0, Target1
move_21 = Move(Geometry=textsrf_4, Motion=Z_4)  # -> Geometry, Transform
concat_22 = Concatenate(FragmentA="Total designed check in area is ", FragmentB=concat_20, FragmentC=panel_23)

concat_23 = Concatenate(FragmentA="1.", FragmentB=min_counters.a, FragmentC=" in the layout")
concat_24 = Concatenate(FragmentA="2.", FragmentB=min_circulation_space.a)
concat_25 = Concatenate(FragmentA="3.", FragmentB=min_circulation_space.a)
config_summariser_2 = Concatenate(Min_Counters=concat_23, Min_Cross_Space=concat_24)

iata_los_summary = Concatenate(LoS_Provided=concat_10, Min_Cross_Space=concat_22, C=gate_3.Target0)
c_print_4 = ContextPrint(LoSSummary=iata_los_summary)
panel_39 = Panel(config_summariser_2)
panel_40 = Panel(iata_los_summary)
filter_14 = StreamFilter(Gate=dispatch_3.ListA, Stream0=config_summariser, Stream1=config_summariser_2)
txt = Text(flatten(filter_14))

# ----
# Summary:
# Metrics:
panel_41 = Panel(merge_13)
# Suggested Improvements:
panel_42 = Panel(iata_los_summary)
panel_43 = Panel(txt)

c_print_5 = ContextPrint(SuggestedSpatialImprovements=txt)

# ---- group: Check In Area
c_bake_10 = ContextBake(CheckIn_BoundingBox_179_57_26_150=flatten(boundary_3))

# ----
c_script_5 = CSharpScript(
    FlightProfile="International Full-Service (Widebody Mix)",
    ProcessingConcept="Common Use Terminal Equipment (CUTE) – Traditional Desks",
    TotalPax=dhp,
    AvgServiceTime=avr_2,
    PeakArrivalRate=roundd_2.Rounded,
    DemandCapacityRatio=roundd.Rounded,
    TargetWait=item_5,
    Wait95=qs._95thPercentileWait,
    MaxWait=qs.MaximumWait,
    AvgWait=qs.AverageWait,
    Counters=panel_29,
    Pitch="2",
    PeakQueueLength=qs.PeakQueueLength,
    QueueFootprint=roundf_2.Rounded,
    SpacePerPax=item_3,
    QueueDepth=roundd_5.Rounded,
    TargetLoS=planning_inputs_level_of_service,
    TagClass="85, 85, 85",
    TagClass1="119,119,119",
    ColorGood="#9BAB20")  # -> out, SummaryOutput; inputs FlightProfile: String, ProcessingConcept: String, TotalPax: Int32, AvgServiceTime: Double, PeakArrivalRate: Double, DemandCapacityRatio: Double, TargetWait: Double, Wait95: Double, MaxWait: Double, AvgWait: Double, Counters: Int32, Pitch: Double, PeakQueueLength: Int32, QueueFootprint: Double, SpacePerPax: Double, QueueDepth: Double, TargetLoS: String, WaitThresholds: list of Double, TagClass: String, TagClass1: String, ColorTooGood: String, ColorGood: String, ColorLittleBad: String, ColorBad: String, ColorWorst: String, ColorVeryWorst: String
# ---------- c_script_5: C# ----------
using System;
using System.Collections.Generic;
using System.Text;

public class Script_Instance : GH_ScriptInstance
{
    private void RunScript(
		string FlightProfile,
		string ProcessingConcept,
		int TotalPax,
		double AvgServiceTime,
		double PeakArrivalRate,
		double DemandCapacityRatio,
		double TargetWait,
		double Wait95,
		double MaxWait,
		double AvgWait,
		int Counters,
		double Pitch,
		int PeakQueueLength,
		double QueueFootprint,
		double SpacePerPax,
		double QueueDepth,
		string TargetLoS,
		List<double> WaitThresholds,
		string TagClass,
		string TagClass1,
		string ColorTooGood,
		string ColorGood,
		string ColorLittleBad,
		string ColorBad,
		string ColorWorst,
		string ColorVeryWorst,
		ref object SummaryOutput)
    {
        // ----------------------------------------------------------------------
        // Default Header/Label Colors (Dark & Medium Grey)
        // ----------------------------------------------------------------------
        if (string.IsNullOrWhiteSpace(TagClass)) TagClass = "#555555";
        if (string.IsNullOrWhiteSpace(TagClass1)) TagClass1 = "#777777";
        
        // ----------------------------------------------------------------------
        // Custom LoS Severity Palette Fallbacks (lightest to darkest HEX codes)
        // ----------------------------------------------------------------------
        if (string.IsNullOrWhiteSpace(ColorTooGood))   ColorTooGood   = "#FFD9D0";
        if (string.IsNullOrWhiteSpace(ColorGood))      ColorGood      = "#FDBDAD";
        if (string.IsNullOrWhiteSpace(ColorLittleBad)) ColorLittleBad = "#FF8D70";
        if (string.IsNullOrWhiteSpace(ColorBad))       ColorBad       = "#F6633E";
        if (string.IsNullOrWhiteSpace(ColorWorst))     ColorWorst     = "#D8431E";
        if (string.IsNullOrWhiteSpace(ColorVeryWorst)) ColorVeryWorst = "#B3391A";

        // Default target to "C" if nothing is provided
        if (string.IsNullOrWhiteSpace(TargetLoS)) TargetLoS = "C";
        int targetIndex = GetLoSIndex(TargetLoS);

        // Fallback for wait thresholds if list is empty or not plugged in
        if (WaitThresholds == null || WaitThresholds.Count < 6)
        {
            WaitThresholds = new List<double> { 10.0, 12.0, 20.0, 25.0, 30.0, 1000.0 };
        }

        // ----------------------------------------------------------------------
        // 1. Evaluate SPACE LoS
        // ----------------------------------------------------------------------
        string achievedSpaceLoS = GetAchievedSpaceLoS(SpacePerPax);
        int spaceDiff = GetLoSIndex(achievedSpaceLoS) - targetIndex;
        string dynamicSpaceColor = GetSeverityColor(spaceDiff, ColorTooGood, ColorGood, ColorLittleBad, ColorBad, ColorWorst, ColorVeryWorst);

        // ----------------------------------------------------------------------
        // 2. Evaluate WAIT TIME LoS
        // ----------------------------------------------------------------------
        string achievedWaitLoS = GetAchievedWaitLoS(Wait95, WaitThresholds);
        int waitDiff = GetLoSIndex(achievedWaitLoS) - targetIndex;
        string dynamicWaitColor = GetSeverityColor(waitDiff, ColorTooGood, ColorGood, ColorLittleBad, ColorBad, ColorWorst, ColorVeryWorst);

        // Auto-evaluate Capacity Color (Reusing Good and Bad colors)
        string dcEvalText = DemandCapacityRatio <= 1.0 
            ? $"{{*Balanced System*}}[{ColorGood}]" 
            : $"{{*Overloaded System*}}[{ColorBad}]";


        StringBuilder sb = new StringBuilder();

        // --- Block 1: Scenario Definition ---
        sb.AppendLine($"{{*Scenario Definition*}}[{TagClass}]");
        sb.AppendLine();
        sb.AppendLine($"{{*Flight Profile:*}}[{TagClass1}] {FlightProfile}");
        sb.AppendLine();
        sb.AppendLine($"{{*Processing Concept:*}}[{TagClass1}] {ProcessingConcept}");
        sb.AppendLine("--------------------------------");

        // --- Block 2: Demand & Throughput ---
        sb.AppendLine($"{{*Demand & Throughput*}}[{TagClass}]");
        sb.AppendLine();
        sb.AppendLine($"{{*Total Passenger Demand:*}}[{TagClass1}] {TotalPax} pax (Design Hour Volume)");
        sb.AppendLine();
        sb.AppendLine($"{{*Average Service Time:*}}[{TagClass1}] {Math.Round(AvgServiceTime, 1)} seconds / pax");
        sb.AppendLine();
        sb.AppendLine($"{{*Peak Arrival Rate:*}}[{TagClass1}] {Math.Round(PeakArrivalRate, 1)} passengers / minute");
        sb.AppendLine();
        sb.AppendLine($"{{*System Demand/Capacity Ratio:*}}[{TagClass1}] {Math.Round(DemandCapacityRatio, 2)} – {dcEvalText}");
        sb.AppendLine("--------------------------------");

        // --- Block 3: Operational Performance ---
        sb.AppendLine($"{{*Operational Performance (Metrics)*}}[{TagClass}]");
        sb.AppendLine();
        sb.AppendLine($"{{*Target Wait Time (Max LoS {TargetLoS}):*}}[{TagClass1}] {Math.Round(TargetWait, 1)} minutes");
        
        string waitEvalText = $"{{*Achieved LoS {achievedWaitLoS} (Target: {TargetLoS})*}}[{dynamicWaitColor}]";
        sb.AppendLine();
        sb.AppendLine($"{{*95th Percentile Wait Time:*}}[{TagClass1}] {Math.Round(Wait95, 1)} minutes – {waitEvalText}");
        sb.AppendLine();
        sb.AppendLine($"{{*Maximum Wait Time:*}}[{TagClass1}] {Math.Round(MaxWait, 1)} minutes");
        sb.AppendLine();
        sb.AppendLine($"{{*Average Wait Time:*}}[{TagClass1}] {Math.Round(AvgWait, 1)} minutes");
        sb.AppendLine("--------------------------------");

        // --- Block 4: Resource Configuration ---
        sb.AppendLine($"{{*Resource Configuration*}}[{TagClass}]");
        sb.AppendLine();
        sb.AppendLine($"{{*Optimized Counter Allocation:*}}[{TagClass1}] {Counters} Desks Required");
        sb.AppendLine();
        double frontage = Math.Round(Counters * Pitch, 1);
        sb.AppendLine($"{{*Required Linear Frontage:*}}[{TagClass1}] ~{frontage} meters (assuming {Pitch}m pitch per desk)");
        sb.AppendLine();
        sb.AppendLine("--------------------------------");

        // --- Block 5: Space & Layout Metrics ---
        sb.AppendLine($"{{*Space & Layout Metrics*}}[{TagClass}]");
        sb.AppendLine();
        sb.AppendLine($"{{*Peak Queue Length:*}}[{TagClass1}] {PeakQueueLength} passengers (Maximum simultaneous accumulation)");
        sb.AppendLine();
        sb.AppendLine($"{{*Estimated Queue Footprint:*}}[{TagClass1}] {Math.Round(QueueFootprint, 1)} sq.m");
        
        string spaceEvalText = $"{{*Achieved LoS {achievedSpaceLoS} (Target: {TargetLoS})*}}[{dynamicSpaceColor}]";
        sb.AppendLine();
        sb.AppendLine($"{{*Space per Passenger:*}}[{TagClass1}] {Math.Round(SpacePerPax, 2)} sq.m/pax – {spaceEvalText}");
        sb.AppendLine();
        sb.AppendLine($"{{*Required Queue Depth:*}}[{TagClass1}] {Math.Round(QueueDepth, 1)} meters");

        SummaryOutput = sb.ToString();
    }

    // --- HELPER METHODS ---

    // reusable method to map the numeric difference to your palette
    private string GetSeverityColor(int diff, string cTooGood, string cGood, string cLittleBad, string cBad, string cWorst, string cVeryWorst)
    {
        if (diff < 0) return cTooGood;           
        if (diff == 0) return cGood;             
        if (diff == 1) return cLittleBad;        
        if (diff == 2) return cBad;              
        if (diff == 3) return cWorst;            
        return cVeryWorst;                       
    }

    // Convert LoS string to a numeric index for comparison
    private int GetLoSIndex(string los)
    {
        string upper = los.Trim().ToUpper();
        if (upper == "A") return 0;
        if (upper == "B") return 1;
        if (upper == "C") return 2;
        if (upper == "D") return 3;
        if (upper == "E") return 4;
        if (upper == "F") return 5;
        return 2; // Default to C
    }

    // Determine Achieved LoS based on Space per Passenger (Higher space = Better LoS)
    private string GetAchievedSpaceLoS(double space)
    {
        if (space >= 1.6) return "A";
        if (space >= 1.4) return "B"; 
        if (space >= 1.2) return "C"; 
        if (space >= 1.0) return "D";
        if (space >= 0.8) return "E";
        return "F";
    }

    // Determine Achieved LoS based on Wait Time Thresholds (Lower wait = Better LoS)
    private string GetAchievedWaitLoS(double wait, List<double> thresholds)
    {
        if (wait <= thresholds[0]) return "A";
        if (wait <= thresholds[1]) return "B";
        if (wait <= thresholds[2]) return "C";
        if (wait <= thresholds[3]) return "D";
        if (wait <= thresholds[4]) return "E";
        return "F";
    }
}
# ---------- end c_script_5 ----------
c_print_6 = ContextPrint(ProjectSummary=c_script_5.SummaryOutput)

# ---- group: Check In Zone Texts
c_bake_11 = ContextBake(Zone_47_43_38_200=flatten(move_21.Geometry))

# ----
c_bake_12 = ContextBake(ErrorBox_255_23_23_100=srf_5)  # disabled
panel_44 = Panel(c_script_5.SummaryOutput)

move2pt_4 = MoveToPoint(Geometry=merge_12, PointA=curvepoint_3, PointB=curvepoint_5)  # -> Moved, Vector, Transform
move_22 = Move(Geometry=move2pt_4.Moved, Motion=Y_7)  # -> Geometry, Transform
brec_26 = BoundingRectangle(Geometry=flatten(move_22.Geometry), Plane=PlaneXY(0, 0, 0), Axis=0, Slide=0, Union=True)  # -> Bounding, DimensionX, DimensionY
explode_7 = Explode(Curve=brec_26.Bounding, Recursive=True)  # -> Segments, Vertices
item_33 = ListItem(List=explode_7.Segments, Index=0, Wrap=True)
curvepoint_6 = PointOnCurve(item_33, parameter=0.5)
pdecon_4 = Deconstruct(Point=curvepoint_6)  # -> XComponent, YComponent, ZComponent
subtraction_17 = Subtraction(A=pdecon_2.YComponent, B=pdecon_4.YComponent)
addition_19 = Addition(A=subtraction_17, B=Slider(2, range=2..10))
Y_12 = UnitY(Factor=expr("-x", addition_19))
move_23 = Move(Geometry=merge_3, Motion=Y_12)  # -> Geometry, Transform

subtraction_18 = Subtraction(A=pdecon_4.XComponent, B=pdecon_2.XComponent)
X_14 = UnitX(Factor=subtraction_18)
move_24 = Move(Geometry=move_23.Geometry, Motion=X_14)  # -> Geometry, Transform

brec_27 = BoundingRectangle(Geometry=flatten(move_24.Geometry), Plane=PlaneXY(0, 0, 0), Axis=0, Slide=0, Union=True)  # -> Bounding, DimensionX, DimensionY

brec_28 = BoundingRectangle(
    Geometry=flatten([brec_27.Bounding, brec_25.Bounding, rectangle.Rectangle]),
    Plane=PlaneXY(0, 0, 0),
    Axis=0,
    Slide=0,
    Union=True)  # -> Bounding, DimensionX, DimensionY
explode_8 = Explode(Curve=brec_28.Bounding, Recursive=True)  # -> Segments, Vertices
item_34 = ListItem(List=explode_8.Segments, Index=0, Wrap=True)  # -> Item2, Item1, Item
len_5 = Length(Curve=item_34.Item)
division_37 = Division(A=size_6.ProcessingArea, B=len_5)
round_11 = Round(Number=division_37)  # -> Nearest, Floor, Ceiling
division_38 = Division(A=graft(size_6.EquipmentCounts), B=round_11.Ceiling)  # -> simplify(Result)
addition_20 = Addition(A=round_11.Ceiling, B="10")
lng_9 = ListLength(List=flatten(division_38))
offcrv_2 = OffsetCurve(Curve=item_34.Item, Plane=PlaneXY(0, 0, 0), Distance=round_11.Ceiling, BothSides=0, Kinks=0, CapType=1)
offset_11 = OffsetCurve(Curve=item_34.Item, Distance=addition_20, Corners=1)
curvepoint_7 = PointOnCurve(offset_11, parameter=0.5)
evalsrf_4 = EvaluateSurface(Surface=reparameterize(offcrv_2), Point="0,0,0")  # -> Point, Normal, UDirection, VDirection, Frame
dom_10 = ConstructDomain(DomainStart=0, DomainEnd=round_11.Ceiling)
dom_11 = ConstructDomain(DomainStart=0, DomainEnd=division_38)
series_5 = Series(Start="0", Step=1, Count=lng_9)
rectangle_7 = Rectangle(Plane=evalsrf_4.Point, XSize=dom_11, YSize=dom_10, Radius=0)  # -> simplify(Rectangle), Length
repeat_3 = RepeatData(Data=division_38, Length=lng_9)
flip_5 = FlipMatrix(Data=repeat_3)
repeat_4 = RepeatData(Data=flip_5, Length=graft(series_5))  # -> simplify(Data)
ma_4 = MassAddition(Input=repeat_4)  # -> Result, PartialResults
nullrep = ReplaceNulls(Items=ma_4.Result, Replacements="0")  # -> Items, Count
X_15 = UnitX(Factor=nullrep.Items)
move_25 = Move(Geometry=simplify(rectangle_7.Rectangle), Motion=simplify(X_15))  # -> Geometry, Transform
area_13 = Area(Geometry=move_25.Geometry)  # -> Area, Centroid
screentext = ScreenOrientedText(
    Text=graft(size_6.EquipmentNames),
    Justification=7,
    Location=area_13.Centroid,
    SizeFactor="1",
    Color=ColourSwatch(SwatchColor=RGB(0, 0, 0)),
    Depth=0,
    Absolute=True)
srf_8 = Surface(flatten(move_25.Geometry))
preview = CustomPreview(Geometry=srf_8, Material=concat_2)

b_std = BoardingStandards(
    CriticalAircraftCapacity="180",
    PassengerLoadFactor=Slider(0.8, range=0.1..1),
    TurnaroundTime="60",
    GateUtilization=Slider(0.8, range=0.1..1),
    GateShowUpRate=Slider(0.8, range=0.1..1),
    SeatingProvision=Slider(0.9, range=0.1..1))
tpl_7 = FacilityTemplate(FacilityType=list_19)  # -> Template, AvailableTopologies
size_7 = FacilitySizer(Passengers=dwell.Passengers, Standards=b_std, Template=tpl_7.Template)  # -> SizingResult, TotalArea, QueueArea, ProcessingArea, CirculationArea, Topology, Advice, EquipmentNames, EquipmentCounts
item_35 = ListItem(List=size_7.EquipmentCounts, Index=0, Wrap=True)  # -> Item, Item1, Item2, Item3
panel_45 = Panel(size_7.EquipmentCounts)
panel_46 = Panel(size_7.EquipmentNames)
division_39 = Division(A=size_7.ProcessingArea, B=item_35.Item)
panel_47 = Panel(size_7.Advice)

multiplication_33 = Multiplication(A="18", B=item_35.Item)
X_16 = UnitX(Factor=expr("-x/2", multiplication_33))
line_10 = LineSDL(Start=curvepoint_7, Direction=expr("-x", X_16), Length=X_16)
line_11 = LineSDL(Start=curvepoint_7, Direction=X_16, Length=X_16)
join_4 = JoinCurves(Curves=[line_11, line_10], Preserve=False)

divide_4 = DivideCurve(Curve=join_4, Count=item_35.Item, Kinks=False)  # -> Points, Tangents, Parameters
shatter_4 = Shatter(Curve=join_4, Parameters=divide_4.Parameters)
len_6 = Length(Curve=shatter_4)
division_40 = Division(A=division_39, B=len_6)
offcrv_3 = OffsetCurve(Curve=shatter_4, Plane=PlaneXY(0, 0, 0), Distance=expr("x", division_40), BothSides=0, Kinks=0, CapType=1)

eval_5 = EvaluateCurve(Curve=reparameterize(shatter_4), Parameter=Slider(0.15, range=0..1))  # -> Point, Tangent, Angle
xprod = CrossProduct(VectorA=eval_5.Tangent, VectorB=Z_3, Unitize=False)  # -> Vector, Length
line_12 = LineSDL(Start=eval_5.Point, Direction=xprod.Vector, Length="20")
offset_12 = OffsetCurve(Curve=shatter_4, Distance=expr("x/2", "3"), Corners=1)
division_41 = Division(A=item_35.Item1, B=list_18)
round_12 = Round(Number=division_41)  # -> Nearest, Floor, Ceiling
brec_29 = BoundingRectangle(Geometry=offcrv_3, Plane=PlaneXY(0, 0, 0), Axis=0, Slide=0, Union=True)  # -> Bounding, simplify(DimensionX), DimensionY
c_script_6 = CSharpScript(TargetSeats=item_35.Item1, ModuleSizes=panel_19)  # -> out, BestLayoutText, BestIslandCounts, AllOptions; inputs TargetSeats: Int32, ModuleSizes: list of Int32
# ---------- c_script_6: C# ----------
// Grasshopper Script Instance
#region Usings
using System;
using System.Linq;
using System.Collections;
using System.Collections.Generic;
using System.Drawing;

using Rhino;
using Rhino.Geometry;

using Grasshopper;
using Grasshopper.Kernel;
using Grasshopper.Kernel.Data;
using Grasshopper.Kernel.Types;
#endregion

public class Script_Instance : GH_ScriptInstance
{
    #region Notes
    /* 
      Members:
        RhinoDoc RhinoDocument
        GH_Document GrasshopperDocument
        IGH_Component Component
        int Iteration

      Methods (Virtual & overridable):
        Print(string text)
        Print(string format, params object[] args)
        Reflect(object obj)
        Reflect(object obj, string method_name)
    */
    #endregion

   private void RunScript(
		int TargetSeats,
		List<int> ModuleSizes,
		ref object BestLayoutText,
		ref object BestIslandCounts,
		ref object AllOptions)
{
    if (TargetSeats <= 0 || ModuleSizes == null || ModuleSizes.Count == 0)
    {
        Print("Please provide a valid Target Seat count and a list of Module Sizes.");
        return;
    }

    // 1. Convert "Module Sizes" (e.g., 3) into "Island Sizes" (e.g., 6) since they are paired back-to-back
    int[] moduleSizes = ModuleSizes.ToArray();
    int[] islandSizes = ModuleSizes.Select(m => m * 2).ToArray();
    
    List<SeatingLayout> validLayouts = new List<SeatingLayout>();

    // 2. Auto-expanding search limit: We will search up to the size of the largest island
    // This guarantees we NEVER break, even if you only input a single module size!
    int maxSearchLimit = TargetSeats + islandSizes.Max();

    // 3. RECURSIVE SEARCH ALGORITHM
    Action<int[], int, int> Search = null;
    Search = (currentCounts, currentIndex, currentSeats) =>
    {
        // Base Case: We have assigned a count to every island size in the list
        if (currentIndex == islandSizes.Length)
        {
            // Keep any combination that hits the target or overshoots within the safe limit
            if (currentSeats >= TargetSeats && currentSeats <= maxSearchLimit)
            {
                int totalIslands = currentCounts.Sum();
                
                // SCORING LOGIC:
                // Multiply extra seats by 100 so accuracy is the #1 priority.
                // Add the total islands so if two layouts have the same seats, it picks the one with fewer, larger islands.
                int penalty = ((currentSeats - TargetSeats) * 100) + totalIslands;
                
                validLayouts.Add(new SeatingLayout {
                    Counts = (int[])currentCounts.Clone(),
                    TotalSeats = currentSeats,
                    TotalIslands = totalIslands,
                    PenaltyScore = penalty
                });
            }
            return;
        }

        // Calculate the maximum number of THIS island we could possibly fit
        int maxCount = maxSearchLimit / islandSizes[currentIndex];
        
        for (int i = 0; i <= maxCount; i++)
        {
            currentCounts[currentIndex] = i;
            Search(currentCounts, currentIndex + 1, currentSeats + (i * islandSizes[currentIndex]));
        }
    };

    // Start the search
    Search(new int[islandSizes.Length], 0, 0);

    if (validLayouts.Count == 0)
    {
        BestLayoutText = "Error: Could not calculate a layout.";
        return;
    }

    // 4. Sort by the best score
    validLayouts = validLayouts.OrderBy(l => l.PenaltyScore).ToList();
    SeatingLayout best = validLayouts.First();

    // 5. FORMAT THE OUTPUTS FOR GRASSHOPPER
    List<string> bestParts = new List<string>();
    for (int i = 0; i < moduleSizes.Length; i++)
    {
        if (best.Counts[i] > 0)
        {
            bestParts.Add($"{best.Counts[i]}x [{moduleSizes[i]}-Seat Islands]");
        }
    }

    BestLayoutText = $"BEST: {best.TotalSeats} Seats | " + string.Join(", ", bestParts);
    
    // Output the raw integer counts of ISLANDS so you can plug them into your Array components
    BestIslandCounts = best.Counts.ToList();

    // Format the list of all options for the user to review
    List<string> optionsList = new List<string>();
    foreach (var l in validLayouts)
    {
        List<string> p = new List<string>();
        for (int i = 0; i < moduleSizes.Length; i++) 
        {
            if (l.Counts[i] > 0) p.Add($"{l.Counts[i]}x [{moduleSizes[i]}-Seat]");
        }
        optionsList.Add($"{l.TotalSeats} Seats ({l.TotalIslands} Islands) -> {string.Join(", ", p)}");
    }
    
    AllOptions = optionsList;
}

// <Custom additional code> 
private class SeatingLayout
{
    public int[] Counts { get; set; }
    public int TotalSeats { get; set; }
    public int TotalIslands { get; set; }
    public int PenaltyScore { get; set; }
}
// </Custom additional code>
// </Custom additional code>
}
# ---------- end c_script_6 ----------
crv_6 = Curve(offcrv_3)
item_36 = ListItem(List=c_script_6.BestIslandCounts, Index=0, Wrap=True)  # -> Item, Item1
ma_5 = MassAddition(Input=c_script_6.BestIslandCounts)  # -> Result, PartialResults
division_42 = Division(A=ma_5.Result, B=round_3.Ceiling)
mod = Modulus(A=ma_5.Result, B=round_3.Ceiling)
round_13 = Round(Number=division_42)  # -> Nearest, Floor, Ceiling
larger = LargerThan(FirstNumber=mod, SecondNumber="1")  # -> LargerThan, OrEqualTo
series_6 = Series(Start=0, Step=addition_7, Count=round_13.Ceiling)
X_17 = UnitX(Factor=series_6)

# ==== cluster Cluster
N = ClusterInput()
C = ClusterInput()
O = ClusterInput()
relay = ClusterInput()
series = Series(Start=0, Step=N, Count=C)
yz = YZPlane(Origin=O)
X = UnitX(Factor=series)
mirror = Mirror(Geometry=relay, Plane=yz)  # -> Geometry, Transform
division = Division(A=C, B="2")
move = Move(Geometry=relay, Motion=X)  # -> Geometry, Transform
move_2 = Move(Geometry=mirror.Geometry, Motion=X)  # -> Geometry, Transform
dispatch = Dispatch(List=move.Geometry, DispatchPattern=[True, False])  # -> ListA, ListB
dispatch_2 = Dispatch(List=move_2.Geometry, DispatchPattern=[True, False])  # -> ListA, ListB
weave = Weave(Pattern=[0, 1], Stream0=dispatch.ListA, Stream1=dispatch_2.ListB, NullGaps=False)
geo = Geometry(weave)
brec = BoundingRectangle(Geometry=geo, Plane=PlaneXY(0, 0, 0), Axis=0, Slide=0, Union=True)  # -> Bounding, DimensionX, DimensionY
explode = Explode(Curve=brec.Bounding, Recursive=True)  # -> Segments, Vertices
A = ClusterInput()
A_2 = ClusterInput()
item = ListItem(List=explode.Segments, Index=0, Wrap=True)  # -> Item2, Item1, Item
crv = Curve(item.Item2)
divide = DivideCurve(Curve=crv, Count=division, Kinks=False)  # -> Points, Tangents, Parameters
shatter = Shatter(Curve=crv, Parameters=divide.Parameters)
len = Length(Curve=crv)
len_2 = Length(Curve=shatter)
curvepoint = PointOnCurve(shatter, parameter=1)
division_2 = Division(A=A, B=len)
division_3 = Division(A=A_2, B=len)
rectangle = Rectangle(Plane=curvepoint, XSize=len_2, YSize=division_2, Radius=0)  # -> Rectangle, Length
Y = UnitY(Factor=division_3)
geo_2 = ClusterOutput(geo)
R = ClusterOutput(rectangle.Rectangle)
V = ClusterOutput(Y)
