# Grasshopper definition aviation_update.ghx (Grasshopper 1.0.8)
# plug-ins: BitmapPlus, AirportPlanning

panel = Panel("""A
B
C
D
E
F""")
panel_2 = Panel("""0
1
2
0
1
2""")
index = ItemIndex(List=panel, Item=panel)

# ---- group: International Profile
checked_bag = Slider(30, range=10..100)
online_check_in = Slider(30, range=10..100)
male = Slider(70, range=10..100)
peak_arrival_time_before_flight_min = Panel("120")

# ----
peak_arrival = Slider(30, range=0..100)
gate_open_time_before_departure_min = Panel("50")
gate_close_time_before_departure_min = Panel("15")

# ---- group: Domestic Profile
# Passenger Profiles
online_check_in_2 = Slider(30, range=10..100)
checked_bag_2 = Slider(30, range=10..100)
peak_arrival_time_before_flight_min_2 = Panel("90")
male_2 = Slider(70, range=10..100)

# ---- group: Spatial Inputs
boundary_dimensions_x = Slider(350, range=50..350)
boundary_dimensionsy = Slider(40, range=10..100)
# Facility Specific Inputs
no_of_entry_gates = Slider(5, range=2..30)

# ----
security_staffing_percentage = Slider(80, range=0..100)
security_lanes = Slider(12, range=10..50)

# ---- group: Spatial Inputs
check_in_counters = Slider(200, range=60..200)
toggle = BooleanToggle(True)

# ---- group: Spatial Inputs / Check In
number_of_islands = Slider(3, range=2..12)

# ---- group: Spatial Inputs / Immigration Counters
emigration_staffing_percentage = Slider(80, range=0..100)
toggle_2 = BooleanToggle(False)
emigration_counters = Slider(10, range=10..50)

# ---- group: Spatial Inputs / E-Gates
e_gates = Slider(60, range=10..100)
toggle_3 = BooleanToggle(False)

# ---- group: Planning Inputs
p_domestic = Slider(60, range=0..100)
p_departing = Slider(70, range=20..100)
p_using_checkin = Slider(80, range=20..80)
level_of_service = ValueList({"A", "B", "C", "D", "E", "F"}, selected="C")

# ----
# Planning Inputs
annual_pax_million = Slider(30, range=1..50)

list = ValueList({"PHP Method": 0, "Design Day Schedule Method": 1}, selected="Design Day Schedule Method")
path = FilePath("N:\ZZ_TRANSFER\261019_Archive\25mppa Schedule.xlsx")
fsi = FlightScheduleImport(ExcelPath=path, LinkedRows=True, FallbackTerminal="T1")  # -> FlightSchedule, Rotations, ArrivalLegs, DepartureLegs, ScheduleSummary, ImportIssues, ColumnMap
dep = DeplaningProfile(Preset=0, Name="Custom", W15=25, W30=50, W60=100, UseAirportSizePreset=False, TargetAnnualMPPA=25)  # -> DeplaningProfile, Validation, Source
fsd = FlightScheduleDeconstruct(FlightSchedule=fsi.FlightSchedule)  # -> SourceRow, Direction, Airline, FlightNumber, RotationID, Station, Via, Sector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
split = TextSplit(Text=fsd.LinkID, Separators="mppa")
cset = CreateSet(List=fsd.ICAOCode)  # -> Set, Map
item = ListItem(List=split, Index=0, Wrap=True)  # -> flatten(Item)
mindex = MemberIndex(Set=fsd.ICAOCode, Member=cset.Set)  # -> simplify(Index), Count
cset_2 = CreateSet(List=item)  # -> Set, Map
plf = ListItem(List=fsd.LoadFactor, Index=mindex.Index, Wrap=True)
plf_2 = ListItem(List=fsd.Seats, Index=mindex.Index, Wrap=True)
multiplication = Multiplication(A=plf, B=plf_2)
item_2 = ListItem(List=fsd.Passengers, Index=mindex.Index, Wrap=True)
round = Round(Number=multiplication)  # -> Nearest, Floor, Ceiling
pax = Maximum(A=round.Ceiling, B=item_2)
filter = StreamFilter(Gate=list, Stream0=annual_pax_million, Stream1=cset_2.Set)

# ---- group: Facility Details CSV Parsing
annual_passengers_map = Slider(21, range=1..50)
subtraction = Subtraction(A=filter, B="1")
division = Division(A=subtraction, B="10")
round_2 = Round(Number=division)  # -> Nearest, Floor, Ceiling

# ---- group: Boarding Gates Inputs / Aircraft Inputs As per Code for Boarding Gates / Domestic
domestic_occupancy = GenePool(Decimals=0, Maximum=200, Minimum=0, Value=[100, 100, 100, 50, 85, 95])
domestic_atm_s = GenePool(Decimals=0, Maximum=200, Minimum=0, Value=[100, 100, 100, 100, 100, 100])
code_wise_domestic_atm_s = Integer(flatten(domestic_atm_s))
domestic_occupancy_min = Integer(flatten(domestic_occupancy))

# ----
tmatch = MatchText(Text=level_of_service, Pattern=panel, Case=True)
dispatch = Dispatch(List=index, DispatchPattern=tmatch)  # -> ListA, ListB
division_2 = Division(A=dispatch.ListA, B="2")

_02_domestic_passenger_profile_peak_arri = GetString(peak_arrival_time_before_flight_min_2, AtLeast=1, AtMost=1, TreeAccess=False)  # "{02.Domestic Passenger Profile} Peak Arrival Time Before Flight (min)"
_02_domestic_passenger_profile_checked_b = GetInteger(checked_bag_2, AtLeast=1, AtMost=1, Maximum=100, Minimum=10, TreeAccess=False)  # "{02.Domestic Passenger Profile} Checked Bag (%)"
_02_domestic_passenger_profile_online_ch = GetInteger(online_check_in_2, AtLeast=1, AtMost=1, Maximum=100, Minimum=10, TreeAccess=False)  # "{02.Domestic Passenger Profile} Online Check In (%)"
_02_domestic_passenger_profile_male = GetInteger(male_2, AtLeast=1, AtMost=1, Maximum=100, Minimum=10, TreeAccess=False)
division_3 = Division(A=_02_domestic_passenger_profile_checked_b, B="100")
division_4 = Division(A=_02_domestic_passenger_profile_online_ch, B="100")
division_5 = Division(A=_02_domestic_passenger_profile_male, B="100")

# ---- group: Spatial Inputs
_04_spatial_inputs_no_of_entry_gates = GetInteger(no_of_entry_gates, AtLeast=1, AtMost=1, Maximum=30, Minimum=2, TreeAccess=False)
_04_spatial_inputs_boundary_dimensions_x = GetInteger(boundary_dimensions_x, AtLeast=1, AtMost=1, Maximum=350, Minimum=50, TreeAccess=False)
_04_spatial_inputs_boundary_dimensions_y = GetInteger(boundary_dimensionsy, AtLeast=1, AtMost=1, Maximum=100, Minimum=10, TreeAccess=False)
_06_check_in_inputs_number_of_check_in_i = GetInteger(number_of_islands, AtLeast=1, AtMost=1, Maximum=50, Minimum=15, TreeAccess=False)  # "{06.Check In Inputs} Number of Check In Islands"

# ----
_03_international_passenger_profile_peak = GetString(peak_arrival_time_before_flight_min, AtLeast=1, AtMost=1, TreeAccess=False)  # "{03.International Passenger Profile} Peak Arrival Time Before Flight (min)"
_03_international_passenger_profile_chec = GetInteger(checked_bag, AtLeast=1, AtMost=1, Maximum=100, Minimum=10, TreeAccess=False)  # "{03.International Passenger Profile} Checked Bag (%)"
_03_international_passenger_profile_onli = GetInteger(online_check_in, AtLeast=1, AtMost=1, Maximum=100, Minimum=10, TreeAccess=False)  # "{03.International Passenger Profile} Online Check In (%)"
_03_international_passenger_profile_male = GetInteger(male, AtLeast=1, AtMost=1, Maximum=100, Minimum=10, TreeAccess=False)
division_6 = Division(A=_03_international_passenger_profile_chec, B="100")
division_7 = Division(A=_03_international_passenger_profile_male, B="100")
division_8 = Division(A=_03_international_passenger_profile_onli, B="100")

# ---- group: Spatial Inputs / Check-In Inputs
_06_check_in_inputs_manually_input_check = GetInteger(check_in_counters, AtLeast=1, AtMost=1, Maximum=150, Minimum=60, TreeAccess=False)  # "{06.Check In Inputs} Manually Input Check In Counters"
_06_check_in_inputs_get_optimum_check_in = GetBoolean(
    toggle,
    AtLeast=1,
    AtMost=1,
    FalseValue="Optimize Manually",
    TreeAccess=False,
    TrueValue="Optimize Counters Automatically")  # "{06.Check In Inputs} Get Optimum Check In Counters"

# ----
_07_e_gates_inputs_get_optimum_e_gates = GetBoolean(
    toggle_3,
    AtLeast=1,
    AtMost=1,
    FalseValue="Optimize Manually",
    TreeAccess=False,
    TrueValue="Optimize Counters Automatically")
_07_e_gates_inputs_manually_input_e_gate = GetInteger(e_gates, AtLeast=1, AtMost=1, Maximum=100, Minimum=10, TreeAccess=False)  # "{07.E Gates Inputs} Manually Input E Gates"

_09_security_inputs_get_optimum_security = GetBoolean(
    Toggle(False),
    AtLeast=1,
    AtMost=1,
    FalseValue="Optimize Manually",
    TreeAccess=False,
    TrueValue="Optimize Counters Automatically")  # "{09.Security Inputs} Get Optimum Security Lanes"
_09_security_inputs_manually_input_secur = GetInteger(security_lanes, AtLeast=1, AtMost=1, Maximum=100, Minimum=10, TreeAccess=False)  # "{09.Security Inputs} Manually Input Security Lanes"
_09_security_inputs_security_staffing_pe = GetInteger(security_staffing_percentage, AtLeast=1, AtMost=1, Maximum=100, Minimum=10, TreeAccess=False)  # "{09.Security Inputs} Security Staffing Percentage"

_08_emigration_inputs_emigration_staffin = GetInteger(emigration_staffing_percentage, AtLeast=1, AtMost=1, Maximum=100, Minimum=10, TreeAccess=False)  # "{08.Emigration Inputs} Emigration Staffing Percentage"
_08_emigration_inputs_get_optimum_emigra = GetBoolean(
    toggle_2,
    AtLeast=1,
    AtMost=1,
    FalseValue="Optimize Manually",
    TreeAccess=False,
    TrueValue="Optimize Counters Automatically")  # "{08.Emigration Inputs} Get Optimum Emigration Counters"
_08_emigration_inputs_manually_input_emi = GetInteger(emigration_counters, AtLeast=1, AtMost=1, Maximum=100, Minimum=10, TreeAccess=False)  # "{08.Emigration Inputs} Manually Input Emigration Counters"

# ---- group: Planning Inputs
_01_planning_inputs_legacy_level_of_serv = GetString(level_of_service, {"A", "B", "C", "D", "E", "F"}, selected=[], AtLeast=1, AtMost=1, TreeAccess=False)  # "{01.Planning Inputs} Legacy Level Of Service"
_01_planning_inputs_passengers_using_che = GetInteger(p_using_checkin, AtLeast=1, AtMost=1, Maximum=80, Minimum=20, TreeAccess=False)  # "{01.Planning Inputs} Passengers Using Check-In (%)"
_01_planning_inputs_annual_pax_million = GetInteger(annual_pax_million, AtLeast=1, AtMost=1, Maximum=50, Minimum=1, TreeAccess=False)
_01_planning_inputs_passenger_departing = GetInteger(p_departing, AtLeast=1, AtMost=1, Maximum=100, Minimum=10, TreeAccess=False)

# ----
_01_planning_inputs_domestic_passenger = GetInteger(p_domestic, AtLeast=1, AtMost=1, Maximum=100, Minimum=10, TreeAccess=False)
round_3 = Round(Number=division_2)  # -> Nearest, Floor, Ceiling

# ---- group: Boarding Gates Inputs / Aircraft Inputs As per Code for Boarding Gates / International
genes = GenePool(Decimals=0, Maximum=200, Minimum=0, Value=[100, 100, 100, 100, 100, 100])
domestic_occupancy_2 = GenePool(Decimals=0, Maximum=200, Minimum=0, Value=[100, 100, 100, 100, 100, 100])
international_occupancy_min = Integer(flatten(domestic_occupancy_2))
code_wise_international_atm_s = Integer(flatten(genes))

# ---- group: Boarding Gates Inputs
# Space m2/person: Seated Passenger
# Standing Passenger
# Boarding Queue Passenger
aircraft_code = Panel("""A
B
C
D
E
F""")
remote_stands_per_gate = Slider(80, range=0..200)
contactintl = Slider(80, range=0..100)
remoteperbus = Slider(2, range=0..4)
buffer_min = Slider(10, range=0..30)
spares = Slider(5, range=0..20)
contactdom = Slider(50, range=0..100)
contactswing = Slider(70, range=0..100)
max_stands_to_active_ratio = Slider(6, range=0..10)
remoteperbus_2 = Slider(1.25, range=1..2)
podiumarea = Slider(12, range=0..30)
panel_3 = Panel("""Input,Code C,Code E,Code F
Average seats,180,300,500
Load factor (%),85,85,85
Seated (%),60,60,60
Standing (%),20,20,20
Next-seat allowance (%),10,10,10
Open-lounge reduction (%),0,0,0
Boarding podiums (positions per lounge),1,1,1
In boarding queue (%),20,20,20""")
code_wise_swing_stands = GenePool(Decimals=0, Maximum=100, Minimum=0, Value=[50, 50, 50, 50, 50, 50])
over = Panel("""2.0
1.4
1.5""")
optimum = Panel("""1.7
1.2
1.2""")
under = Panel("""1.5
1.0
1.0""")
code_wise_swing_stands_2 = Integer(flatten(code_wise_swing_stands))
entwine = Entwine(Branch00=domestic_occupancy_min, Branch01=international_occupancy_min, FlattenInputs=True)  # -> simplify(Result)
entwine_2 = Entwine(Branch00=code_wise_domestic_atm_s, Branch01=code_wise_international_atm_s, FlattenInputs=True)  # -> simplify(Result)

# ----
division_9 = Division(A=spares, B="100")
entwine_3 = Entwine(Branch00=over, Branch01=optimum, Branch02=under, FlattenInputs=True)  # -> simplify(Result)
branch = TreeBranch(Tree=entwine_3, Path=round_3.Floor, MaintainPaths=True)
split_2 = TextSplit(Text=panel_3, Separators=",")
panel_4 = Panel(round_3.Floor)
item_3 = ListItem(List=branch, Index=0, Wrap=True)  # -> Item, Item1, Item2
a_std = FacilityAreaStandards(DefaultQueueSpacePerPax=1.2, Circulation="15", MEP="10", Structure=5)
tstat = TreeStatistics(Tree=split_2)  # -> Paths, Length, Count
spaceseated = Number(item_3.Item)
spacestanding = Number(item_3.Item1)
boarding_queue_passenger_area = Number(item_3.Item2)
cull_i = CullIndex(List=tstat.Paths, Indices="0", Wrap=True)
branch_2 = TreeBranch(Tree=split_2, Path=cull_i, MaintainPaths=True)
lng = ListLength(List=cull_i)
g_std = GateStandards(
    BufferMinutes=buffer_min,
    Spares=spares,
    LoadFactor=0.85,
    ContactDomestic=contactdom,
    ContactSwing=contactswing,
    ContactInternational=contactintl,
    RemoteStandsPerBusGate=remote_stands_per_gate,
    MaxActiveStands=max_stands_to_active_ratio,
    SeatedSpaceM2=spaceseated,
    StandingSpaceM2=spacestanding,
    BoardingQueueSpaceM2=boarding_queue_passenger_area,
    NextSeatAllowance=0,
    OpenLoungeReduction=0,
    PodiumsPerLounge=1,
    PodiumAreaEachM2=podiumarea,
    BusLoungeCode="C")
panel_5 = Panel(branch)
multiplication_2 = Multiplication(A=_01_planning_inputs_annual_pax_million, B="1000000", C=_01_planning_inputs_domestic_passenger, D="0.01")
multiplication_3 = Multiplication(A=_01_planning_inputs_annual_pax_million, B="1000000")
cull_i_2 = CullIndex(List=branch_2, Indices="0", Wrap=True)  # -> simplify(List)
g_size = GateStandSizer(GateStandards=g_std, ExpansionFactor=0)  # -> GateSizingResult, AircraftStands, ContactStands, BusGates, RemoteStands, MaxStands, NetRemoteStands, GateLounges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
item_4 = ListItem(List=cull_i_2, Index=0, Wrap=True)  # -> Item, Item1, Item2
subtraction_2 = Subtraction(A=multiplication_3, B=multiplication_2)
repeat = RepeatData(Data="0", Length=lng)
gate_inputs = GateInputs(DomesticATMs=code_wise_domestic_atm_s, InternationalATMs=code_wise_international_atm_s)
entwine_4 = Entwine(
    Branch00=repeat,
    Branch01=repeat,
    Branch02=item_4.Item,
    Branch03=repeat,
    Branch04=item_4.Item1,
    Branch05=item_4.Item2,
    FlattenInputs=True)  # -> simplify(Result)
international_passengers = Integer(subtraction_2)
domestic_passengers = Integer(multiplication_2)
item_5 = ListItem(List=entwine_4, Index=0, Wrap=True)  # -> Item, Item1, Item2, Item3, Item4, Item5, Item6, Item7
subtraction_3 = Subtraction(A="100", B=_01_planning_inputs_passenger_departing)
in_boarding_queue = Number(flatten(item_5.Item7))
average_seats = Number(flatten(item_5.Item))
load_factor = Number(flatten(item_5.Item1))
pct_seated = Number(flatten(item_5.Item2))
pct_standing = Number(flatten(item_5.Item3))
next_seat_allowance = Number(flatten(item_5.Item4))
boarding_podiums = Number(flatten(item_5.Item6))
open_lounge_reduction = Number(flatten(item_5.Item5))
merge = Merge(Data1=_01_planning_inputs_passenger_departing, Data2=subtraction_3)  # -> graft(Result)
merge_2 = Merge(Data1=domestic_passengers, Data2=international_passengers)  # -> graft(Result)
multiplication_4 = Multiplication(A=merge_2, B=merge, C="0.01")
panel_6 = Panel(next_seat_allowance)
division_10 = Division(A=open_lounge_reduction, B="100")
division_11 = Division(A=next_seat_allowance, B="100")
division_12 = Division(A=load_factor, B="100")
division_13 = Division(A=pct_standing, B="100")
division_14 = Division(A=pct_seated, B="100")

panel_7 = Panel("""A
B
C
D
E
F""")
tmatch_2 = MatchText(Text=_01_planning_inputs_legacy_level_of_serv, Pattern=panel_7, Case=True)
index_2 = ItemIndex(List=panel_7, Item=panel_7)
dispatch_2 = Dispatch(List=index_2, DispatchPattern=tmatch_2)  # -> ListA, ListB
target_time_check_in_los_min = Panel("""5
10
20
30
45
100""")
security_screening_and_immigration_min = Panel("""5
7.5
10
20
30
45""")
check_in_area_m2 = Panel("""1.6
1.4
1.2
1.0
0.8
0.5""")
item_6 = ListItem(List=security_screening_and_immigration_min, Index=dispatch_2.ListA, Wrap=True)
item_7 = ListItem(List=check_in_area_m2, Index=dispatch_2.ListA, Wrap=True)
item_8 = ListItem(List=target_time_check_in_los_min, Index=dispatch_2.ListA, Wrap=True)

division_15 = Division(A=in_boarding_queue, B="100")
subtraction_4 = Subtraction(A=merge_2, B=multiplication_4)
merge_3 = Merge(Data1=multiplication_4, Data2=subtraction_4)
bang = ExplodeTree(Data=graft(merge_3))  # -> Branch0, Branch1, Branch2, Branch3
panel_8 = Panel(merge_3)
departure_international_passengers = Integer(bang.Branch2)
arrival_departure_international_passenge = Integer(bang.Branch3)  # "Arrival Departure International Passengers"
departure_domestic_passengers = Integer(bang.Branch0)
arrival_domestic_passengers = Integer(bang.Branch1)
dhp_factor = Panel("0.0005")
multiplication_5 = Multiplication(A=dhp_factor, B=merge_3)
item_9 = ListItem(List=multiplication_5, Index=0, Wrap=True)  # -> Item, Item1
bang_2 = ExplodeTree(Data=item_9.Item1)  # -> Branch0, Branch1
bang_3 = ExplodeTree(Data=item_9.Item)  # -> Branch0, Branch1
dhp_departure_domestic_passengers = Integer(bang_3.Branch0)
dhp_departure_international_passengers = Integer(bang_3.Branch1)
dhp_arrival_domestic_passengers = Integer(bang_2.Branch0)
dhp_arrival_international_passengers = Integer(bang_2.Branch1)

# ---- group: Domestic Passenger Profiles (Must Sum 100%)
panel_9 = Panel("Economy")
panel_10 = Panel("Business")
list_2 = ValueList({"Origin": 0, "Transfer": 1, "Destination": 2}, selected="Origin")
list_3 = ValueList({"Domestic": 0, "International": 1}, selected="Domestic")
list_4 = ValueList({"Origin": 0, "Transfer": 1, "Destination": 2}, selected="Origin")
list_5 = ValueList({"Domestic": 0, "International": 1}, selected="Domestic")
ap = ArrivalProfile(Peak=_02_domestic_passenger_profile_peak_arri, Sigma="20")
ap_2 = ArrivalProfile(Peak=_02_domestic_passenger_profile_peak_arri, Sigma="20")
pp = PassengerProfile(
    Name=panel_9,
    Percentage=Slider(80, range=0..100),
    PassengerType=list_3,
    Journey=list_2,
    OnlineCheckInProbability=division_4,
    CheckedBagProbability=division_3,
    ServiceTimeMultiplier=1,
    MaleProbability=division_5,
    ArrivalProfile=ap,
    MinAdvance="30",
    MaxAdvance="120")
pp_2 = PassengerProfile(
    Name=panel_10,
    Percentage=Slider(20, range=0..100),
    PassengerType=list_5,
    Journey=list_4,
    OnlineCheckInProbability=division_4,
    CheckedBagProbability=division_3,
    ServiceTimeMultiplier=1,
    MaleProbability=division_5,
    ArrivalProfile=ap_2,
    MinAdvance="30",
    MaxAdvance="120")

# ----
filter_2 = StreamFilter(Gate=list_3)
merge_4 = Merge(Data1=pp, Data2=pp_2)

# ---- group: International Passenger Profiles (Must Sum 100%)
list_6 = ValueList({"Domestic": 0, "International": 1}, selected="International")
panel_11 = Panel("Business")
list_7 = ValueList({"Origin": 0, "Transfer": 1, "Destination": 2}, selected="Origin")
list_8 = ValueList({"Domestic": 0, "International": 1}, selected="International")
list_9 = ValueList({"Origin": 0, "Transfer": 1, "Destination": 2}, selected="Origin")
ap_3 = ArrivalProfile(Peak=_03_international_passenger_profile_peak, Sigma="30")
panel_12 = Panel("Economy")
ap_4 = ArrivalProfile(Peak=_03_international_passenger_profile_peak, Sigma="30")
panel_13 = Panel("800")
pp_3 = PassengerProfile(
    Name=panel_11,
    Percentage=Slider(20, range=0..100),
    PassengerType=list_6,
    Journey=list_7,
    OnlineCheckInProbability=division_8,
    CheckedBagProbability=division_6,
    ServiceTimeMultiplier=1,
    MaleProbability=division_7,
    ArrivalProfile=ap_3,
    MinAdvance="60",
    MaxAdvance="180")
pp_4 = PassengerProfile(
    Name=panel_12,
    Percentage=Slider(80, range=0..100),
    PassengerType=list_8,
    Journey=list_9,
    OnlineCheckInProbability=division_8,
    CheckedBagProbability=division_6,
    ServiceTimeMultiplier=1,
    MaleProbability=division_7,
    ArrivalProfile=ap_4,
    MinAdvance="60",
    MaxAdvance="180")

# ----
division_16 = Division(A=_01_planning_inputs_domestic_passenger, B="100")
merge_5 = Merge(Data1=pp_4, Data2=pp_3)
presets = ValueList({"Leisure", "Business", "Mix", "Custom (Use fields below)": "Custom"}, selected="Mix")

schedule_variability_min = Slider(0, range=0..10)
walk_dispersion_min = Panel("0")
random_seed = Panel("6")
wp = WalkingProfile(AverageSpeed="1.35", StandardDeviation="1")

sup = ShowUpProfile(Preset=presets, W15="50", W30="75", W60="100")  # -> ShowUpProfile, BandShares, BandWindows, W15, W30, W60, Validation

number_slider = Slider(2, range=1..3)
list_10 = ValueList({"Domestic Departure": 0, "Domestic Arrival": 1, "International Departure": 2, "International Arrival": 3}, selected="International Departure")
list_11 = ValueList({"Domestic Departure": 0, "Domestic Arrival": 1, "International Departure": 2, "International Arrival": 3}, selected="Domestic Departure")
analysis_period_hrs = Panel("5")
panel_15 = Panel("""50
60
90
80
60""")
panel_16 = Panel("""50
60
90
80
60""")
analysis_period_hrs_2 = Panel("5")
cpd = CreatePassengerDemand(
    DHPType=list_11,
    DesignHourDemand=dhp_departure_domestic_passengers,
    DemandPerHour=panel_16,
    AnalysisPeriod=analysis_period_hrs_2,
    DesignHourIndex=number_slider,
    WarmUp=Toggle(False),
    WarmUpDuration=60,
    WarmUpFactor=50)
cpd_2 = CreatePassengerDemand(
    DHPType=list_10,
    DesignHourDemand=dhp_departure_international_passengers,
    DemandPerHour=panel_15,
    AnalysisPeriod=analysis_period_hrs,
    DesignHourIndex=number_slider,
    WarmUp=Toggle(False),
    WarmUpDuration=60,
    WarmUpFactor=50)
cpg = CreatePassengerGroup(DHP=cpd_2, Profiles=merge_5, Type=-1)
cpg_2 = CreatePassengerGroup(DHP=cpd, Profiles=merge_4, Type=-1)

list_12 = ValueList({"Domestic Departure": 0, "Domestic Arrival": 1, "International Departure": 2, "International Arrival": 3}, selected="International Arrival")
panel_17 = Panel("""50
60
90
80
60""")
analysis_period_hrs_3 = Panel("5")
list_13 = ValueList({"Domestic Departure": 0, "Domestic Arrival": 1, "International Departure": 2, "International Arrival": 3}, selected="Domestic Arrival")
panel_18 = Panel("""50
70
90
80
60""")
analysis_period_hrs_4 = Panel("5")
cpd_3 = CreatePassengerDemand(
    DHPType=list_12,
    DesignHourDemand=dhp_arrival_international_passengers,
    DemandFactors=panel_17,
    AnalysisPeriod=analysis_period_hrs_3,
    DesignHourIndex=number_slider,
    WarmUp=Toggle(False),
    WarmUpDuration=60,
    WarmUpFactor=50)
cpd_4 = CreatePassengerDemand(
    DHPType=list_13,
    DesignHourDemand=dhp_arrival_domestic_passengers,
    DemandFactors=panel_18,
    AnalysisPeriod=analysis_period_hrs_4,
    DesignHourIndex=number_slider,
    WarmUp=Toggle(False),
    WarmUpDuration=60,
    WarmUpFactor=50)
cpg_3 = CreatePassengerGroup(DHP=cpd_4, Profiles=merge_5, Type=-1)
cpg_4 = CreatePassengerGroup(DHP=cpd_3, Profiles=merge_5, Type=-1)

panel_19 = Panel(sup.BandShares)
min_passenger = Panel("1.5")
min_passenger_2 = Panel("1.5")
avg_processing_min = Panel("2.5")
sp = ServiceProfile(MeanServiceTime=avg_processing_min, StandardDeviation=min_passenger_2)
cspg = CreateSchedulePassengerGroup(Profiles=merge_4, Type=list_11)
cspg_2 = CreateSchedulePassengerGroup(Profiles=merge_5, Type=list_10)
cspg_3 = CreateSchedulePassengerGroup(Profiles=merge_5, Type=list_13)
cspg_4 = CreateSchedulePassengerGroup(Profiles=merge_5, Type=list_12)
arrival_basis = ValueList({"At Terminal": 0, "At Check-In Counter": 1}, selected="At Terminal")

filter_3 = StreamFilter(
    Gate=list_11,
    Stream0="DomesticDeparture",
    Stream1="DomesticArrival",
    Stream2="InternationalDeparture",
    Stream3="InternationalArrival")
filter_4 = StreamFilter(
    Gate=list_10,
    Stream0="DomesticDeparture",
    Stream1="DomesticArrival",
    Stream2="InternationalDeparture",
    Stream3="InternationalArrival")
merge_6 = Merge(Data1=filter_3, Data2=filter_4)

panel_20 = Panel("45")
ciw = CheckInWindowRules(DomesticOpens=120, DomesticLastAdmission="30", InternationalOpens=180, InternationalLastAdmission=60)  # -> CheckInWindows, Rules, Issues
list_14 = ValueList({"One": 0, "Two": 1}, selected="Two")
list_15 = ValueList({"One": 0, "Two": 1}, selected="One")
b_std = BoardingStandards(
    CriticalAircraftCapacity=180,
    PassengerLoadFactor=0.85,
    TurnaroundTime=60,
    GateUtilization=0.8,
    GateShowUpRate=0.85,
    SeatingProvision=0.6)
dom = ConstructDomain(DomainStart="50", DomainEnd="500")
list_16 = ValueList({"CheckIn": 0, "BagDrop": 1, "Security": 2, "Immigration": 3}, selected="CheckIn")
a_std_2 = FacilityAreaStandards(DefaultQueueSpacePerPax=1.2, Circulation=15, MEP=10, Structure=5)
std = FacilityStandards(FacilityType=0, QueueAreaPax=1.2, ProcessorWidth=1.5, ProcessorDepth=2, ProcessorPitch=1.8, Circulation=25, Support=10)

list_17 = ValueList({"Island", "Linear", "Flow-Through"}, selected="Island")
list_18 = ValueList({"CheckIn": 0, "BagDrop": 1, "Security": 2, "Immigration": 3}, selected="CheckIn")
tpl = FacilityTemplate(FacilityType=list_18, TopologyOverride=list_17)  # -> Template, AvailableTopologies
division_17 = Division(B="2")
std_2 = FacilityStandards(
    FacilityType=list_18,
    QueueAreaPax=item_7,
    ProcessorWidth=division_17,
    ProcessorDepth=2,
    ProcessorPitch=division_17,
    Circulation=25,
    Support=10)

# ---- group: Boarding Gates and Stands
arriving_atm_s = Number(entwine_2)
occupancy = Number(entwine)
buffer = Number(buffer_min)
addition = Addition(A=occupancy, B=buffer)
division_18 = Division(A=addition, B="60")
multiplication_6 = Multiplication(A=arriving_atm_s, B=division_18)
stand_hours = Number(simplify(multiplication_6))

sparespct = Number(division_9)
addition_2 = Addition(A="1", B=sparespct)
multiplication_7 = Multiplication(A=stand_hours, B=addition_2)
need = Number(simplify(multiplication_7))
ma = MassAddition(Input=need)  # -> Result, PartialResults
round_4 = Round(Number=need)  # -> Nearest, Floor, Ceiling
round_5 = Round(Number=ma.Result)  # -> Nearest, Floor, Ceiling
per_code = Number(simplify(round_4.Ceiling))
sectortotal = Number(simplify(round_5.Ceiling))
ma_2 = MassAddition(Input=per_code)  # -> Result, PartialResults
subtraction_5 = Subtraction(A=ma_2.Result, B=sectortotal)
splitextra = Number(simplify(subtraction_5))

# ---- group: Facility Details CSV Parsing
facility_requirements_1_100_csv = Panel("""Band,Stage,Facility,Unit,Demand nom,PT nom (s),MQT (min),Min,Nominal,Max
0–10,Terminal Entry,Terminal entry — manual verification,position,625,15 s/pax,3,1,3,10
0–10,Terminal Entry,Terminal entry — e-gate / DigiYatra,position,375,7 s/pax,2,1,1,3
0–10,Check-in & Baggage,Self-service check-in kiosk,kiosk,170,45 s/pax,2,1,3,13
0–10,Check-in & Baggage,Self-service bag drop,position,170,69 s/pax,3,1,4,20
0–10,Check-in & Baggage,Check-in counter — economy,counter,607,78 s/pax,10,1,12,56
0–10,Check-in & Baggage,Check-in counter — business,counter,53,78 s/pax,3,1,2,11
0–10,Check-in & Baggage,Baggage make-up unit,unit,12,2 flights/position,—,1,7,28
0–10,Security,Security screening lane,lane,1000,20 s/pax,10,1,5,14
0–10,Emigration,Emigration e-gate,gate,120,25 s/pax,2,1,1,8
0–10,Emigration,Emigration counter,counter,180,60 s/pax,10,1,3,19
0–10,Immigration,Immigration e-gate,gate,120,25 s/pax,2,1,1,8
0–10,Immigration,Immigration counter,counter,180,60 s/pax,10,1,3,19
0–10,Baggage Reclaim,Baggage reclaim belt,belt,1000,600 pax/hr,—,1,2,6
0–10,Customs,Customs red-channel desk,desk,15,30 s/pax,10,1,1,3
11–20,Terminal Entry,Terminal entry — manual verification,position,1695,15 s/pax,3,2,7,18
11–20,Terminal Entry,Terminal entry — e-gate / DigiYatra,position,1017,7 s/pax,2,1,2,5
11–20,Check-in & Baggage,Self-service check-in kiosk,kiosk,461,45 s/pax,2,2,6,22
11–20,Check-in & Baggage,Self-service bag drop,position,461,69 s/pax,3,2,9,35
11–20,Check-in & Baggage,Check-in counter — economy,counter,1647,78 s/pax,10,9,31,98
11–20,Check-in & Baggage,Check-in counter — business,counter,143,78 s/pax,3,1,3,19
11–20,Check-in & Baggage,Baggage make-up unit,unit,34,2 flights/position,—,8,17,48
11–20,Security,Security screening lane,lane,2713,20 s/pax,10,7,13,23
11–20,Emigration,Emigration e-gate,gate,326,25 s/pax,2,1,3,14
11–20,Emigration,Emigration counter,counter,488,60 s/pax,10,1,7,33
11–20,Immigration,Immigration e-gate,gate,326,25 s/pax,2,1,3,14
11–20,Immigration,Immigration counter,counter,488,60 s/pax,10,1,7,33
11–20,Baggage Reclaim,Baggage reclaim belt,belt,2713,600 pax/hr,—,3,6,10
11–20,Customs,Customs red-channel desk,desk,41,30 s/pax,10,1,1,4
21–30,Terminal Entry,Terminal entry — manual verification,position,2391,15 s/pax,3,4,10,22
21–30,Terminal Entry,Terminal entry — e-gate / DigiYatra,position,1434,7 s/pax,2,1,3,7
21–30,Check-in & Baggage,Self-service check-in kiosk,kiosk,650,45 s/pax,2,3,8,28
21–30,Check-in & Baggage,Self-service bag drop,position,650,69 s/pax,3,4,12,44
21–30,Check-in & Baggage,Check-in counter — economy,counter,2323,78 s/pax,10,14,44,126
21–30,Check-in & Baggage,Check-in counter — business,counter,202,78 s/pax,3,1,5,25
21–30,Check-in & Baggage,Baggage make-up unit,unit,48,2 flights/position,—,12,24,62
21–30,Security,Security screening lane,lane,3825,20 s/pax,10,11,19,30
21–30,Emigration,Emigration e-gate,gate,459,25 s/pax,2,1,4,17
21–30,Emigration,Emigration counter,counter,689,60 s/pax,10,2,10,43
21–30,Immigration,Immigration e-gate,gate,459,25 s/pax,2,1,4,17
21–30,Immigration,Immigration counter,counter,689,60 s/pax,10,2,10,43
21–30,Baggage Reclaim,Baggage reclaim belt,belt,3825,600 pax/hr,—,5,8,13
21–30,Customs,Customs red-channel desk,desk,57,30 s/pax,10,1,1,5
31–40,Terminal Entry,Terminal entry — manual verification,position,3328,15 s/pax,3,5,14,30
31–40,Terminal Entry,Terminal entry — e-gate / DigiYatra,position,1997,7 s/pax,2,2,4,9
31–40,Check-in & Baggage,Self-service check-in kiosk,kiosk,905,45 s/pax,2,4,11,38
31–40,Check-in & Baggage,Self-service bag drop,position,905,69 s/pax,3,5,17,59
31–40,Check-in & Baggage,Check-in counter — economy,counter,3233,78 s/pax,10,20,61,168
31–40,Check-in & Baggage,Check-in counter — business,counter,281,78 s/pax,3,2,6,33
31–40,Check-in & Baggage,Baggage make-up unit,unit,66,2 flights/position,—,18,34,82
31–40,Security,Security screening lane,lane,5325,20 s/pax,10,15,26,40
31–40,Emigration,Emigration e-gate,gate,639,25 s/pax,2,1,5,23
31–40,Emigration,Emigration counter,counter,959,60 s/pax,10,3,14,57
31–40,Immigration,Immigration e-gate,gate,639,25 s/pax,2,1,5,23
31–40,Immigration,Immigration counter,counter,959,60 s/pax,10,3,14,57
31–40,Baggage Reclaim,Baggage reclaim belt,belt,5325,600 pax/hr,—,7,10,17
31–40,Customs,Customs red-channel desk,desk,80,30 s/pax,10,1,1,7
41–50,Terminal Entry,Terminal entry — manual verification,position,4266,15 s/pax,3,7,17,37
41–50,Terminal Entry,Terminal entry — e-gate / DigiYatra,position,2559,7 s/pax,2,2,5,11
41–50,Check-in & Baggage,Self-service check-in kiosk,kiosk,1160,45 s/pax,2,5,15,47
41–50,Check-in & Baggage,Self-service bag drop,position,1160,69 s/pax,3,7,22,74
41–50,Check-in & Baggage,Check-in counter — economy,counter,4144,78 s/pax,10,27,77,210
41–50,Check-in & Baggage,Check-in counter — business,counter,360,78 s/pax,3,2,8,41
41–50,Check-in & Baggage,Baggage make-up unit,unit,85,2 flights/position,—,23,43,103
41–50,Security,Security screening lane,lane,6825,20 s/pax,10,20,33,50
41–50,Emigration,Emigration e-gate,gate,819,25 s/pax,2,1,6,28
41–50,Emigration,Emigration counter,counter,1229,60 s/pax,10,4,18,71
41–50,Immigration,Immigration e-gate,gate,819,25 s/pax,2,1,6,28
41–50,Immigration,Immigration counter,counter,1229,60 s/pax,10,4,18,71
41–50,Baggage Reclaim,Baggage reclaim belt,belt,6825,600 pax/hr,—,9,13,21
41–50,Customs,Customs red-channel desk,desk,102,30 s/pax,10,1,1,8
51–60,Terminal Entry,Terminal entry — manual verification,position,5203,15 s/pax,3,8,21,44
51–60,Terminal Entry,Terminal entry — e-gate / DigiYatra,position,3122,7 s/pax,2,3,6,13
51–60,Check-in & Baggage,Self-service check-in kiosk,kiosk,1415,45 s/pax,2,6,18,56
51–60,Check-in & Baggage,Self-service bag drop,position,1415,69 s/pax,3,8,26,88
51–60,Check-in & Baggage,Check-in counter — economy,counter,5055,78 s/pax,10,33,94,251
51–60,Check-in & Baggage,Check-in counter — business,counter,440,78 s/pax,3,2,10,49
51–60,Check-in & Baggage,Baggage make-up unit,unit,103,2 flights/position,—,29,52,123
51–60,Security,Security screening lane,lane,8325,20 s/pax,10,25,40,59
51–60,Emigration,Emigration e-gate,gate,999,25 s/pax,2,1,7,34
51–60,Emigration,Emigration counter,counter,1499,60 s/pax,10,4,22,85
51–60,Immigration,Immigration e-gate,gate,999,25 s/pax,2,1,7,34
51–60,Immigration,Immigration counter,counter,1499,60 s/pax,10,4,22,85
51–60,Baggage Reclaim,Baggage reclaim belt,belt,8325,600 pax/hr,—,11,16,25
51–60,Customs,Customs red-channel desk,desk,125,30 s/pax,10,1,1,10
61–70,Terminal Entry,Terminal entry — manual verification,position,6141,15 s/pax,3,10,25,52
61–70,Terminal Entry,Terminal entry — e-gate / DigiYatra,position,3684,7 s/pax,2,3,7,15
61–70,Check-in & Baggage,Self-service check-in kiosk,kiosk,1670,45 s/pax,2,7,21,66
61–70,Check-in & Baggage,Self-service bag drop,position,1670,69 s/pax,3,10,31,103
61–70,Check-in & Baggage,Check-in counter — economy,counter,5966,78 s/pax,10,39,111,293
61–70,Check-in & Baggage,Check-in counter — business,counter,519,78 s/pax,3,2,11,57
61–70,Check-in & Baggage,Baggage make-up unit,unit,122,2 flights/position,—,35,62,144
61–70,Security,Security screening lane,lane,9825,20 s/pax,10,30,47,69
61–70,Emigration,Emigration e-gate,gate,1179,25 s/pax,2,1,8,40
61–70,Emigration,Emigration counter,counter,1769,60 s/pax,10,5,26,99
61–70,Immigration,Immigration e-gate,gate,1179,25 s/pax,2,1,8,40
61–70,Immigration,Immigration counter,counter,1769,60 s/pax,10,5,26,99
61–70,Baggage Reclaim,Baggage reclaim belt,belt,9825,600 pax/hr,—,13,19,29
61–70,Customs,Customs red-channel desk,desk,147,30 s/pax,10,1,2,12
71–80,Terminal Entry,Terminal entry — manual verification,position,7078,15 s/pax,3,11,29,59
71–80,Terminal Entry,Terminal entry — e-gate / DigiYatra,position,4247,7 s/pax,2,3,8,18
71–80,Check-in & Baggage,Self-service check-in kiosk,kiosk,1925,45 s/pax,2,8,24,75
71–80,Check-in & Baggage,Self-service bag drop,position,1925,69 s/pax,3,12,36,117
71–80,Check-in & Baggage,Check-in counter — economy,counter,6877,78 s/pax,10,46,128,335
71–80,Check-in & Baggage,Check-in counter — business,counter,598,78 s/pax,3,3,13,65
71–80,Check-in & Baggage,Baggage make-up unit,unit,141,2 flights/position,—,40,71,164
71–80,Security,Security screening lane,lane,11325,20 s/pax,10,35,54,79
71–80,Emigration,Emigration e-gate,gate,1359,25 s/pax,2,2,10,45
71–80,Emigration,Emigration counter,counter,2039,60 s/pax,10,6,30,114
71–80,Immigration,Immigration e-gate,gate,1359,25 s/pax,2,2,10,45
71–80,Immigration,Immigration counter,counter,2039,60 s/pax,10,6,30,114
71–80,Baggage Reclaim,Baggage reclaim belt,belt,11325,600 pax/hr,—,15,21,33
71–80,Customs,Customs red-channel desk,desk,170,30 s/pax,10,1,2,13
81–90,Terminal Entry,Terminal entry — manual verification,position,8016,15 s/pax,3,13,32,66
81–90,Terminal Entry,Terminal entry — e-gate / DigiYatra,position,4809,7 s/pax,2,4,10,20
81–90,Check-in & Baggage,Self-service check-in kiosk,kiosk,2180,45 s/pax,2,9,27,84
81–90,Check-in & Baggage,Self-service bag drop,position,2180,69 s/pax,3,13,40,132
81–90,Check-in & Baggage,Check-in counter — economy,counter,7787,78 s/pax,10,52,145,377
81–90,Check-in & Baggage,Check-in counter — business,counter,677,78 s/pax,3,3,14,73
81–90,Check-in & Baggage,Baggage make-up unit,unit,159,2 flights/position,—,46,80,185
81–90,Security,Security screening lane,lane,12825,20 s/pax,10,40,62,89
81–90,Emigration,Emigration e-gate,gate,1539,25 s/pax,2,2,11,51
81–90,Emigration,Emigration counter,counter,2309,60 s/pax,10,7,33,128
81–90,Immigration,Immigration e-gate,gate,1539,25 s/pax,2,2,11,51
81–90,Immigration,Immigration counter,counter,2309,60 s/pax,10,7,33,128
81–90,Baggage Reclaim,Baggage reclaim belt,belt,12825,600 pax/hr,—,17,24,37
81–90,Customs,Customs red-channel desk,desk,192,30 s/pax,10,1,2,15
91–100,Terminal Entry,Terminal entry — manual verification,position,8953,15 s/pax,3,14,36,74
91–100,Terminal Entry,Terminal entry — e-gate / DigiYatra,position,5372,7 s/pax,2,4,11,22
91–100,Check-in & Baggage,Self-service check-in kiosk,kiosk,2435,45 s/pax,2,10,30,94
91–100,Check-in & Baggage,Self-service bag drop,position,2435,69 s/pax,3,15,45,147
91–100,Check-in & Baggage,Check-in counter — economy,counter,8698,78 s/pax,10,58,162,419
91–100,Check-in & Baggage,Check-in counter — business,counter,756,78 s/pax,3,3,16,81
91–100,Check-in & Baggage,Baggage make-up unit,unit,178,2 flights/position,—,51,89,205
91–100,Security,Security screening lane,lane,14325,20 s/pax,10,44,69,99
91–100,Emigration,Emigration e-gate,gate,1719,25 s/pax,2,2,12,56
91–100,Emigration,Emigration counter,counter,2579,60 s/pax,10,8,37,142
91–100,Immigration,Immigration e-gate,gate,1719,25 s/pax,2,2,12,56
91–100,Immigration,Immigration counter,counter,2579,60 s/pax,10,8,37,142
91–100,Baggage Reclaim,Baggage reclaim belt,belt,14325,600 pax/hr,—,19,27,41
91–100,Customs,Customs red-channel desk,desk,215,30 s/pax,10,1,2,16""")
split_3 = TextSplit(Text=facility_requirements_1_100_csv, Separators=",")
flip = FlipMatrix(Data=split_3)
cull_i_3 = CullIndex(List=flip, Indices="0", Wrap=True)  # -> simplify(List)
branch_3 = TreeBranch(Tree=cull_i_3, Path="0", MaintainPaths=True)
cset_3 = CreateSet(List=branch_3)  # -> Set, Map
item_10 = ListItem(List=cset_3.Set, Index=round_2.Floor, Wrap=True)
mindex_2 = MemberIndex(Set=branch_3, Member=item_10)  # -> Index, Count
partition = PartitionList(List=cull_i_3, Size=mindex_2.Count)
subtraction_6 = Subtraction(A="10", B="2")
series = Series(Start="2", Step=1, Count=subtraction_6)
concat = Concatenate(FragmentC="{", FragmentA=series, FragmentB=";", FragmentD=round_2.Floor, FragmentE="}")
panel_21 = Panel("""0
1""")
branch_4 = TreeBranch(Tree=partition, Path=concat, MaintainPaths=True)
cull_i_4 = CullIndex(List=concat, Indices=panel_21, Wrap=True)
branch_5 = TreeBranch(Tree=partition, Path=cull_i_4, MaintainPaths=True)
bang_4 = ExplodeTree(Data=branch_5)  # -> Branch0, Branch1, Branch2, Branch3, Branch4, Branch5
max_units = Data(bang_4.Branch5)
min_units = Data(bang_4.Branch3)
int = Integer(bang_4.Branch2)
split_4 = TextSplit(Text=bang_4.Branch1, Separators=" ")
path_mapper = PathMapper(max_units, source="{A;B}", target="{path_index}")
path_mapper_2 = PathMapper(min_units, source="{A;B}", target="{path_index}")
item_11 = ListItem(List=split_4, Index=0, Wrap=True)
nullrep = ReplaceNulls(Items=int, Replacements="0")  # -> Items, Count
dom_2 = ConstructDomain(DomainStart=path_mapper_2, DomainEnd=path_mapper)
max_queuing_time_mqt_min = Data(nullrep.Items)
demand_nom = Data(bang_4.Branch0)
process_time_nom_s = Data(item_11)
resource_domain = ListItem(List=dom_2, Index=0, Wrap=True)  # -> Item, Item1, Item2, Item3, Item4, Item5, Item6, Item7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
pocess_time_s_pax = ListItem(List=flatten(process_time_nom_s), Index=0, Wrap=True)  # -> Item, Item1, Item2, Item3, Item4, Item5, Item6, Item7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
target_wait_time_min = ListItem(List=max_queuing_time_mqt_min, Index=0, Wrap=True)  # -> Item, Item1, Item2, Item3, Item4, Item5, Item6, Item7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
customs_desk = Data(resource_domain.Item13)
self_service_check_in_kiosk = Data(resource_domain.Item2)
baggage_reclaim_belt = Data(resource_domain.Item12)
emigration_counter = Data(resource_domain.Item9)
self_service_bag_drop = Data(resource_domain.Item3)
check_in_counter_business = Data(resource_domain.Item5)
emigration_e_gate = Data(resource_domain.Item8)
imigration_e_gate = Data(resource_domain.Item10)
imigration_counter = Data(resource_domain.Item11)
check_in_counter_economy = Data(resource_domain.Item4)
baggage_make_up_unit = Data(resource_domain.Item6)
security_screening_lane = Data(resource_domain.Item7)
manual_verification = Data(resource_domain.Item)
customs_desk_2 = Data(target_wait_time_min.Item13)
self_service_check_in_kiosk_2 = Data(target_wait_time_min.Item2)
emigration_counter_2 = Data(target_wait_time_min.Item9)
baggage_reclaim_belt_2 = Data(target_wait_time_min.Item12)
self_service_bag_drop_2 = Data(target_wait_time_min.Item3)
check_in_counter_business_2 = Data(target_wait_time_min.Item5)
emigration_e_gate_2 = Data(target_wait_time_min.Item8)
imigration_counter_2 = Data(target_wait_time_min.Item11)
e_gates_2 = Data(target_wait_time_min.Item1)
check_in_counter_economy_2 = Data(target_wait_time_min.Item4)
security_screening_lane_2 = Data(target_wait_time_min.Item7)
imigration_e_gate_2 = Data(target_wait_time_min.Item10)
baggage_make_up_unit_2 = Data(target_wait_time_min.Item6)
manual_verification_2 = Data(target_wait_time_min.Item)
customs_desk_3 = Data(pocess_time_s_pax.Item13)
self_service_check_in_kiosk_3 = Data(pocess_time_s_pax.Item2)
baggage_make_up_unit_flights_position = Data(pocess_time_s_pax.Item6)
emigration_counter_3 = Data(pocess_time_s_pax.Item9)
self_service_bag_drop_3 = Data(pocess_time_s_pax.Item3)
check_in_counter_business_3 = Data(pocess_time_s_pax.Item5)
emigration_e_gate_3 = Data(pocess_time_s_pax.Item8)
imigration_counter_3 = Data(pocess_time_s_pax.Item11)
e_gates_3 = Data(pocess_time_s_pax.Item1)
check_in_counter_economy_3 = Data(pocess_time_s_pax.Item4)
security_screening_lane_3 = Data(pocess_time_s_pax.Item7)
imigration_e_gate_3 = Data(pocess_time_s_pax.Item10)
baggage_reclaim_belt_pax_hr = Data(pocess_time_s_pax.Item12)
manual_verification_3 = Data(pocess_time_s_pax.Item)

# ----
nominal_units = Data(bang_4.Branch4)
panel_22 = Panel(bang_4.Branch1)

# ---- group: Facility Details CSV Parsing (continued)
nominal_resources = ListItem(List=nominal_units, Index=0, Wrap=True)  # -> Item, Item1, Item2, Item3, Item4, Item5, Item6, Item7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
customs_desk_4 = Data(nominal_resources.Item13)
self_service_check_in_kiosk_4 = Data(nominal_resources.Item2)
baggage_reclaim_belt_3 = Data(nominal_resources.Item12)
emigration_counter_4 = Data(nominal_resources.Item9)
self_service_bag_drop_4 = Data(nominal_resources.Item3)
check_in_counter_business_4 = Data(nominal_resources.Item5)
emigration_e_gate_4 = Data(nominal_resources.Item8)
imigration_e_gate_4 = Data(nominal_resources.Item10)
imigration_counter_4 = Data(nominal_resources.Item11)
e_gates_4 = Data(nominal_resources.Item1)
check_in_counter_economy_4 = Data(nominal_resources.Item4)
baggage_make_up_unit_3 = Data(nominal_resources.Item6)
security_screening_lane_4 = Data(nominal_resources.Item7)
manual_verification_4 = Data(nominal_resources.Item)

# ----
e_gates_5 = Data(resource_domain.Item1)

repeat_2 = RepeatData(Data=self_service_check_in_kiosk_4, Length="2")
repeat_3 = RepeatData(Data=self_service_bag_drop_4, Length="2")
merge_7 = Merge(Data1=check_in_counter_economy_4, Data2=check_in_counter_business_4)
weave = Weave(Pattern=panel_2, Stream0=merge_7, Stream1=repeat_2, Stream2=repeat_3, NullGaps=False)

repeat_4 = RepeatData(Data=self_service_check_in_kiosk_3, Length="2")
repeat_5 = RepeatData(Data=self_service_bag_drop_3, Length="2")
merge_8 = Merge(Data1=check_in_counter_economy_3, Data2=check_in_counter_business_3)
weave_2 = Weave(Pattern=panel_2, Stream0=merge_8, Stream1=repeat_4, Stream2=repeat_5, NullGaps=False)

repeat_6 = RepeatData(Data=self_service_check_in_kiosk_2, Length="2")
repeat_7 = RepeatData(Data=self_service_bag_drop_2, Length="2")
merge_9 = Merge(Data1=check_in_counter_economy_2, Data2=check_in_counter_business_2)
weave_3 = Weave(Pattern=panel_2, Stream0=merge_9, Stream1=repeat_6, Stream2=repeat_7, NullGaps=False)

merge_10 = Merge(Data1=check_in_counter_economy, Data2=check_in_counter_business)
repeat_8 = RepeatData(Data=self_service_check_in_kiosk, Length="2")
repeat_9 = RepeatData(Data=self_service_bag_drop, Length="2")
weave_4 = Weave(Pattern=panel_2, Stream0=merge_10, Stream1=repeat_8, Stream2=repeat_9, NullGaps=False)

# ---- group: Check-In Channel Routing
international_economy = Panel("""55
25
20""")
domestic_business = Panel("""65
25
10""")
international_business = Panel("""60
20
20""")
domestic_economy = Panel("""55
25
20""")
merge_11 = Merge(Data1=panel_9, Data2=panel_10, Data3=panel_12, Data4=panel_11)
panel_23 = Panel("""Counter
Kiosk
Bag-Drop""")
entwine_5 = Entwine(
    Branch00=domestic_economy,
    Branch01=domestic_business,
    Branch02=international_economy,
    Branch03=international_business,
    FlattenInputs=True)
division_19 = Division(A=entwine_5, B="100")
lng_2 = ListLength(List=panel_23)
lng_3 = ListLength(List=division_19)
repeat_10 = RepeatData(Data=graft(merge_6), Length=flatten(lng_2))  # -> simplify(flatten(Data))
repeat_11 = RepeatData(Data=graft(merge_11), Length=flatten(lng_2))  # -> simplify(flatten(Data))
repeat_12 = RepeatData(Data=panel_23, Length=lng_3)  # -> simplify(flatten(Data))
lng_4 = ListLength(List=repeat_11)
lng_5 = ListLength(List=repeat_10)
division_20 = Division(A=lng_4, B=lng_5)
repeat_13 = RepeatData(Data=weave_4, Length=lng_4)  # -> simplify(flatten(Data))
repeat_14 = RepeatData(Data=weave_3, Length=lng_4)  # -> simplify(flatten(Data))
repeat_15 = RepeatData(Data=weave, Length=lng_4)  # -> simplify(flatten(Data))
repeat_16 = RepeatData(Data=graft(repeat_10), Length=division_20)  # -> flatten(Data)
repeat_17 = RepeatData(Data=weave_2, Length=lng_4)  # -> simplify(flatten(Data))
chr = ChannelRouting(ProfileKeys=repeat_11, Channels=repeat_12, Shares=flatten(division_19), DefaultChannel="Counter")
avg_processing_min_2 = Division(A=repeat_17, B="60")

# ----
sp_2 = ServiceProfile(MeanServiceTime=avg_processing_min_2, StandardDeviation=min_passenger)
concat_2 = Concatenate(FragmentA=repeat_12, FragmentB="|", FragmentC=repeat_16, FragmentD="|", FragmentE=repeat_11)
stmap = ServiceTimeMap(DefaultProfile=sp, Keys=concat_2, ServiceProfiles=sp_2)
poolplan = PoolPlans(PoolIdentities=concat_2, NominalResources=repeat_15, TargetWait=repeat_14, ResourceDomains=repeat_13)
panel_24 = Panel(poolplan)
spg = SchedulePassengerGenerator(
    FlightSchedule=fsi.FlightSchedule,
    DomesticDeparture=cspg,
    DomesticArrival=cspg_3,
    InternationalDeparture=cspg_2,
    InternationalArrival=cspg_4,
    WalkingProfile=wp,
    RandomSeed=random_seed,
    ArrivalBasis=arrival_basis,
    ApplyEntryWalk=Toggle(True),
    EntryWalkDistance="50",
    CheckInWindows=ciw.CheckInWindows,
    ArrivalDelayMin=0,
    ArrivalDelayMax=30,
    FallbackShowUpProfile=sup.ShowUpProfile,
    ChannelRouting=chr,
    DesignHour=-1)  # -> Passengers, PassengerGenerationResult, ArrivalSimulations, DemandSummary, Issues, IDDemand, IADemand, DHDCombined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
wpg = WindowedPassengerGenerator(
    DomesticDeparture=cpg_2,
    DomesticArrival=cpg_3,
    InternationalDeparture=cpg,
    InternationalArrival=cpg_4,
    WalkingProfile=wp,
    RandomSeed=random_seed,
    ScheduleVariability=schedule_variability_min,
    WalkDispersion=walk_dispersion_min,
    ShowUpProfile=sup.ShowUpProfile,
    ChannelRouting=chr)  # -> Passengers, PassengerGenerationResult, ArrivalSimulations
pax_2 = StreamFilter(Gate=list, Stream0=wpg.ArrivalSimulations, Stream1=spg.ArrivalSimulations)
pax_3 = StreamFilter(Gate=list, Stream0=wpg.Passengers, Stream1=spg.Passengers)
spp = SchedulePeakProfile(ScheduleResult=spg.PassengerGenerationResult, View=list_14)  # -> Chart, PeakSummary, Summary, ChartData
previmg = PrevImage(SmartBitmap=spp.Chart)
spp_2 = SchedulePeakProfile(ScheduleResult=spg.PassengerGenerationResult, View=list_15)  # -> Chart, PeakSummary, Summary, ChartData
previmg_2 = PrevImage(SmartBitmap=spp_2.Chart)
arrchart = ArrivalChart(ArrivalSimulations=pax_2, Passengers=pax_3, View="Demand Profile")  # -> Chart, Summary, ChartData
previmg_3 = PrevImage(SmartBitmap=arrchart.Chart)

# ---- group: Check In
min_passenger_3 = Panel("1.5")
avg_processing_min_3 = Panel("2.5")
staffing = Slider(100, range=0..100)
sp_3 = ServiceProfile(MeanServiceTime=avg_processing_min_3, StandardDeviation=min_passenger_3)
chk = CheckIn(
    Passengers=pax_3,
    ServiceProfile=sp_3,
    PhysicalCounters=8,
    OptimizeCounters=toggle,
    TargetWait=item_8,
    StaffingPercentage=staffing,
    RandomSeed=random_seed,
    Channels=panel_23,
    ServiceProfiles=stmap,
    ResourceDomain=Domain(1, 1200),
    ChannelRouting=chr,
    PoolPlans=poolplan)  # -> Passengers, CheckInPassengers, QueueResults, CountersUsed, PeakQueueLength, AverageWait, MaximumWait, _95thPercentileWait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
qs = QueueStatistics(QueueResults=chk.QueueResults)  # -> AverageWait, MaximumWait, _95thPercentileWait, PeakQueueLength, ResourceUtilization, PeakQueueTime, StepIndices, StepWait95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

# ----
panel_25 = Panel(chk.PoolNames)
optchart = OptimizerChart(SearchOutcomes=chk.SearchOutcomes, PerChannel=Toggle(False))  # -> Chart, Summary, ChartData
previmg_4 = PrevImage(SmartBitmap=optchart.Chart)
panel_26 = Panel(chk.PhysicalPerPool)

# ---- group: Bag Drop
avg_processing_min_4 = Panel("1.5")
min_passenger_4 = Panel("0.5")
target_wait_min = Panel("10")
staffing_2 = Slider(100, range=0..100)
optimize_counters = BooleanToggle(True)
sp_4 = ServiceProfile(MeanServiceTime=avg_processing_min_4, StandardDeviation=min_passenger_4)
bd = BagDrop(
    Passengers=chk.Passengers,
    ServiceProfile=sp_4,
    BagDropCounters=8,
    OptimizeCounters=optimize_counters,
    TargetWait=target_wait_min,
    StaffingPercentage=staffing_2,
    RandomSeed=random_seed,
    ResourceDomain=Domain(1, 1200))  # -> Passengers, QueueResults, PhysicalCounters, PoolNames, PhysicalPerPool, ActivePerPool, Wait95PerPool, SearchOutcomes, NominalPerPool

# ----
size = FacilitySizer(
    OperationalResults=chk.QueueResults,
    Passengers=chk.Passengers,
    Standards=std,
    FacilityType=list_16,
    OptimizeSizing=Toggle(True),
    ManualCount=10,
    MetricBasis=0,
    DesignHourIndex=-1,
    AreaStandards=a_std_2,
    UseRoutedPoolAreas=False,
    ExpansionFactor=0)  # -> SizingResult, TotalArea, QueueArea, ProcessingArea, CirculationArea, Topology, Advice, EquipmentNames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
qmechanics = QueueMechanicsChart(QueueResults=chk.QueueResults, CumulativeFlow=Toggle(False), PoolFilter="Counter|DomesticDeparture")  # -> Chart, Summary, ChartData
qmechanics_2 = QueueMechanicsChart(QueueResults=chk.QueueResults, CumulativeFlow=Toggle(False), PoolFilter="Counter|InternationalDeparture")  # -> Chart, Summary, ChartData
qmechanics_3 = QueueMechanicsChart(QueueResults=chk.QueueResults, CumulativeFlow=Toggle(False), PoolFilter="Bag-Drop")  # -> Chart, Summary, ChartData
qmechanics_4 = QueueMechanicsChart(QueueResults=chk.QueueResults, CumulativeFlow=Toggle(False), PoolFilter="Kiosk")  # -> Chart, Summary, ChartData
qmechanics_5 = QueueMechanicsChart(QueueResults=chk.QueueResults, CumulativeFlow=Toggle(True))  # -> Chart, Summary, ChartData
previmg_5 = PrevImage(SmartBitmap=qmechanics_3.Chart)
previmg_6 = PrevImage(SmartBitmap=qmechanics_4.Chart)
previmg_7 = PrevImage(SmartBitmap=qmechanics_2.Chart)
previmg_8 = PrevImage(SmartBitmap=qmechanics.Chart)
qmechanics_6 = QueueMechanicsChart(QueueResults=bd.QueueResults, CumulativeFlow=Toggle(True))  # -> Chart, Summary, ChartData
previmg_9 = PrevImage(SmartBitmap=qmechanics_5.Chart)

# ---- group: Passenger Verification
from_facility = ValueList({"CheckIn", "BagDrop", "Immigration", "Security"}, selected="BagDrop")
from_facility_2 = ValueList({"CheckIn", "BagDrop", "Immigration", "Security"}, selected="CheckIn")
eligible = Slider(100, range=0..100)
wlk = Walking(Passengers=bd.Passengers, Distance="50", WalkingSpeed=wp, FromFacility=from_facility_2, ToFacility=from_facility)
ver = PassengerVerification(Passengers=wlk, EligiblePercentage=eligible, ThroughputPerGate=300, DesignUtilization=0.85)  # -> Passengers, VerificationResults, RequiredGates, EligiblePassengers

# ---- group: Immigration
from_facility_3 = ValueList({"CheckIn", "BagDrop", "Immigration", "Security"}, selected="Immigration")
from_facility_4 = ValueList({"CheckIn", "BagDrop", "Immigration", "Security"}, selected="BagDrop")
target_wait_min_2 = Panel("10")
avg_processing_min_5 = Panel("0.5")
min_passenger_5 = Panel("0.25")
wlk_2 = Walking(Passengers=ver.Passengers, Distance="50", WalkingSpeed=wp, FromFacility=from_facility_4, ToFacility=from_facility_3)
sp_5 = ServiceProfile(MeanServiceTime=avg_processing_min_5, StandardDeviation=min_passenger_5)
filter_5 = PassengerFilter(Passengers=wlk_2)  # -> Domestic, International, Male, Female, CheckedBags, CabinBagOnly
imm = Immigration(
    Passengers=filter_5.International,
    ServiceProfile=sp_5,
    ImmigrationBooths=_08_emigration_inputs_manually_input_emi,
    OptimizeBooths=_08_emigration_inputs_get_optimum_emigra,
    TargetWait=item_6,
    StaffingPercentage=_08_emigration_inputs_emigration_staffin,
    RandomSeed=random_seed,
    ResourceDomain=Domain(1, 1200))  # -> Passengers, QueueResults, PhysicalBooths, PoolNames, PhysicalPerPool, ActivePerPool, Wait95PerPool, SearchOutcomes, NominalPerPool

# ---- group: Security
avg_processing_min_6 = Panel("0.25")
min_passenger_6 = Panel("0.1")
sp_6 = ServiceProfile(MeanServiceTime=avg_processing_min_6, StandardDeviation=min_passenger_6)
merge_12 = Merge(Data1=flatten(filter_5.Domestic), Data2=flatten(imm.Passengers))
sec = Security(
    Passengers=merge_12,
    ServiceProfile=sp_6,
    SecurityLanes=_09_security_inputs_manually_input_secur,
    OptimizeLanes=_09_security_inputs_get_optimum_security,
    TargetWait=item_6,
    StaffingPercentage=_09_security_inputs_security_staffing_pe,
    RandomSeed=random_seed,
    ResourceDomain=Domain(1, 1200))  # -> Passengers, QueueResults, PhysicalLanes, PoolNames, PhysicalPerPool, ActivePerPool, Wait95PerPool, SearchOutcomes, NominalPerPool

# ----
pdt = PassengerDetails(Passengers=sec.Passengers)  # -> PassengerID, ArrivalTime, ServiceTime, StartService, EndService, WaitingTime, AssignedCounter, WalkingSpeed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

# ---- group: Boarding Gates and Stands
round_6 = Round(Number=code_wise_swing_stands_2)  # -> Nearest, Floor, Ceiling
bang_5 = ExplodeTree(Data=per_code)  # -> Branch0, Branch1
max = Maximum(A="0", B=round_6.Ceiling)
min = Minimum(A=bang_5.Branch0, B=bang_5.Branch1)
min_2 = Minimum(A=max, B=min)
swingused_per_code = Number(simplify(min_2))
subtraction_7 = Subtraction(A=bang_5.Branch1, B=swingused_per_code)
subtraction_8 = Subtraction(A=bang_5.Branch0, B=swingused_per_code)
dedicateddom = Number(simplify(subtraction_8))
dedicatedintl = Number(simplify(subtraction_7))
active_swing = Number(simplify(swingused_per_code))
active_dom = Number(simplify(dedicateddom))
active_intl = Number(simplify(dedicatedintl))
merge_13 = Merge(Data1=graft(active_dom), Data2=graft(active_swing), Data3=graft(active_intl))  # -> simplify(Result)
contact_pct_dom_swing_intl = Entwine(Branch00=contactdom, Branch01=contactswing, Branch02=contactintl, FlattenInputs=True)
active_dom_swing_intl = Entwine(Branch00=active_dom, Branch01=active_swing, Branch02=active_intl, FlattenInputs=True)
ma_3 = MassAddition(Input=merge_13)  # -> Result, PartialResults
division_21 = Division(A=contact_pct_dom_swing_intl, B="100")
active_total_by_code = Number(simplify(graft(ma_3.Result)))
multiplication_8 = Multiplication(A=active_dom_swing_intl, B=division_21)
ma_4 = MassAddition(Input=flatten(active_total_by_code))  # -> Result, PartialResults
round_7 = Round(Number=multiplication_8)  # -> Nearest, Floor, Ceiling
subtraction_9 = Subtraction(A=active_dom_swing_intl, B=round_7.Ceiling)
active_total = Number(ma_4.Result)
bang_6 = ExplodeTree(Data=simplify(round_7.Ceiling))  # -> Branch0, Branch1, Branch2
bang_7 = ExplodeTree(Data=simplify(subtraction_9))  # -> Branch0, Branch1, Branch2
multiplication_9 = Multiplication(A=active_total, B=max_stands_to_active_ratio)
round_8 = Round(Number=multiplication_9)  # -> Nearest, Floor, Ceiling
maxstands = Number(simplify(round_8.Ceiling))

# ---- group: Boarding Gates and Stands / Gates
contact_intl = Number(simplify(bang_6.Branch2))
bus_dom = Number(simplify(bang_7.Branch0))
contact_dom = Number(simplify(bang_6.Branch0))
contact_swing = Number(simplify(bang_6.Branch1))
bus_swing = Number(simplify(bang_7.Branch1))
bus_intl = Number(simplify(bang_7.Branch2))

# ---- group: Boarding Gates and Stands
# Without Flight Schedule All the non contact
# stand are considered Bus Gates
ma_5 = MassAddition(Input=flatten([bus_dom, bus_swing, bus_intl]))  # -> Result, PartialResults
ma_6 = MassAddition(Input=flatten([contact_dom, contact_swing, contact_intl]))  # -> Result, PartialResults
addition_3 = Addition(A=contact_dom, B=contact_swing, C=contact_intl)
contactggatestotal = Number(simplify(ma_6.Result))
busgatetotal = Number(simplify(ma_5.Result))

multiplication_10 = Multiplication(A=busgatetotal, B=remote_stands_per_gate)
round_9 = Round(Number=multiplication_10)  # -> Nearest, Floor, Ceiling
remoteactive = Number(simplify(round_9.Ceiling))
subtraction_10 = Subtraction(A=maxstands, B=contactggatestotal)
max_2 = Maximum(A="0", B=subtraction_10)

multiplication_11 = Multiplication(A=average_seats, B=division_12)
spaceseated_2 = Number(spaceseated)
spacestanding_2 = Number(spacestanding)
pax_k = Number(simplify(multiplication_11))
addition_4 = Addition(A="1", B=division_11)
multiplication_12 = Multiplication(A=pax_k, B=division_14, C=spaceseated_2, D=addition_4)
multiplication_13 = Multiplication(A=pax_k, B=division_13, C=spacestanding_2)
seatedarea_k = Number(simplify(multiplication_12))
standingarea_k = Number(simplify(multiplication_13))
number_of_podiums = Number(simplify(boarding_podiums))
podiumarea_k = Number(simplify(podiumarea))
addition_5 = Addition(A=seatedarea_k, B=standingarea_k)
subtraction_11 = Subtraction(A="1", B=division_10)
multiplication_14 = Multiplication(A=number_of_podiums, B=podiumarea_k)
multiplication_15 = Multiplication(A=addition_5, B=subtraction_11)
multiplication_16 = Multiplication(A=pax_k, B=division_15)
podiumarea_k_2 = Number(simplify(multiplication_14))
holdarea_k = Number(simplify(multiplication_15))
queuepax_k = Number(simplify(multiplication_16))
multiplication_17 = Multiplication(A=queuepax_k, B=boarding_queue_passenger_area)
queuearea_k = Number(simplify(multiplication_17))
addition_6 = Addition(A=holdarea_k, B=queuearea_k, C=podiumarea_k_2)
loungearea_k = Number(simplify(addition_6))
item_12 = ListItem(List=loungearea_k, Index="2", Wrap=True)
multiplication_18 = Multiplication(A=loungearea_k, B=addition_3)
multiplication_19 = Multiplication(A=busgatetotal, B=item_12)
contactarea_k = Number(simplify(multiplication_18))
busarea_k = Number(simplify(multiplication_19))
ma_7 = MassAddition(Input=contactarea_k)  # -> Result, PartialResults
addition_7 = Addition(A=ma_7.Result, B=busarea_k)
netarea = Number(simplify(addition_7))
multiplication_20 = Multiplication(A="1.15", B=netarea)
aftercirculationarea = Number(simplify(multiplication_20))
multiplication_21 = Multiplication(A=aftercirculationarea, B="1.10")
aftermeparea = Number(simplify(multiplication_21))
multiplication_22 = Multiplication(A=aftermeparea, B="1.05")

panel_27 = Panel(max)
grossarea = Number(simplify(multiplication_22))
panel_28 = Panel(grossarea)
